vi "Cleaning_Rinse_Without_tab_Count.gviweb"   [G Web Development Software 22.3.0]
inputs:
  "Aborted": string[]
  "Eco ?": string[]
  "With SG ?": string[]
  "Kategorie ?": string[]
  "Input error": error
outputs:
  "Count Light aborted": i32
  "Count medium aborted": i32
  "Count Strong aborted": i32
  "Count Express aborted": i32
  "Count Rinse without tab without tab aborted": i32
  "Count Rinse without tab aborted": i32
  "Count Rinse without tab nicht aborted eco without SG": i32
  "Count Rinse without tab nicht aborted eco with SG": i32
  "Count Rinse without tab nicht aborted standard without SG": i32
  "Count Rinse without tab nicht aborted standard with SG": i32
  "Output": error
diagram:
  s1 = 0  # shift register
  s2 = 0  # shift register
  s3 = 0  # shift register
  s4 = 0  # shift register
  s5 = 0  # shift register
  s6 = 0  # shift register
  s7 = 0  # shift register
  s8 = 0  # shift register
  s9 = 0  # shift register
  s10 = 0  # shift register
  for {
    w1 = each element of $Aborted
    w2 = each element of $"Kategorie ?"
    w3 = each element of $"Eco ?"
    w4 = each element of $"With SG ?"
    case (w1) {
      frame "False", Default {
        case (w2) {
          frame "False", Default {
            w11 = s7
            w12 = s8
            w13 = s9
            w14 = s10
          }
          frame "Rinse without tabs" {
            case (w3) {
              frame "False", Default {
                w11 = s7
                w12 = s8
                w13 = s9
                w14 = s10
              }
              frame "Eco" {
                case (w4) {
                  frame "False", Default {
                    w11 = s7
                    w12 = s8
                    w13 = s9
                    w14 = s10
                  }
                  frame "Without_SG" {
                    Increment(x=s7) -> w11
                    w12 = s8
                    w13 = s9
                    w14 = s10
                  }
                  frame "With_SG" {
                    Increment(x=s8) -> w12
                    w11 = s7
                    w13 = s9
                    w14 = s10
                  }
                }
              }
              frame "Standard" {
                case (w4) {
                  frame "False", Default {
                    w11 = s7
                    w12 = s8
                    w13 = s9
                    w14 = s10
                  }
                  frame "Without_SG" {
                    Increment(x=s9) -> w13
                    w11 = s7
                    w12 = s8
                    w14 = s10
                  }
                  frame "With_SG" {
                    Increment(x=s10) -> w14
                    w11 = s7
                    w12 = s8
                    w13 = s9
                  }
                }
              }
            }
          }
        }
        w5 = s1
        w6 = s2
        w7 = s3
        w8 = s5
        w9 = s4
        w10 = s6
      }
      frame "Aborted" {
        case (w2) {
          frame "False", Default {
            w5 = s1
            w6 = s2
            w7 = s3
            w8 = s5
            w9 = s4
            w10 = s6
          }
          frame "Medium" {
            Increment(x=s2) -> w6
            w5 = s1
            w7 = s3
            w8 = s5
            w9 = s4
            w10 = s6
          }
          frame "Strong" {
            Increment(x=s3) -> w7
            w5 = s1
            w6 = s2
            w8 = s5
            w9 = s4
            w10 = s6
          }
          frame "Light" {
            Increment(x=s1) -> w5
            w6 = s2
            w7 = s3
            w8 = s5
            w9 = s4
            w10 = s6
          }
          frame "Express" {
            Increment(x=s5) -> w8
            w5 = s1
            w6 = s2
            w7 = s3
            w9 = s4
            w10 = s6
          }
          frame "Rinse without tab" {
            Increment(x=s4) -> w9
            w5 = s1
            w6 = s2
            w7 = s3
            w8 = s5
            w10 = s6
          }
          frame "Rinse" {
            Increment(x=s6) -> w10
            w5 = s1
            w6 = s2
            w7 = s3
            w8 = s5
            w9 = s4
          }
        }
        w11 = s7
        w12 = s8
        w13 = s9
        w14 = s10
      }
    }
    next s1 = w5
    next s2 = w6
    next s3 = w7
    next s4 = w9
    next s5 = w8
    next s6 = w10
    next s7 = w11
    next s8 = w12
    next s9 = w13
    next s10 = w14
  }
  $"Count Light aborted" <- s1
  $"Count medium aborted" <- s2
  $"Count Strong aborted" <- s3
  $"Count Express aborted" <- s5
  $"Count Rinse without tab without tab aborted" <- s4
  $"Count Rinse without tab aborted" <- s6
  $"Count Rinse without tab nicht aborted eco without SG" <- s7
  $"Count Rinse without tab nicht aborted eco with SG" <- s8
  $"Count Rinse without tab nicht aborted standard without SG" <- s9
  $"Count Rinse without tab nicht aborted standard with SG" <- s10
  $Output <- $"Input error"
