vi "Display_all_programm_in_graph_iCC.gviweb"   [G Web Development Software 22.3.0]
inputs:
  "Charge infos": T1[] = [{"selected"=TRUE, "Charge Nr."="548", "Process name"="Cooking process", "Programme name"="Manual Cooking Mode", "Date and time"="2022.12.05 08:18:31", "Duration"="000:04:03", "Status"="Cancelled/aborted", "Average temp."="110.17", "Door closed"="", "Door opned"=""}, {"selected"=FALSE, "Charge Nr."="549", "Process name"="Cooking process", "Programme name"="Side Dishes Casserole", "Date and time"="2022.12.05 08:22:41", "Duration"="000:23:50", "Status"="Cancelled/aborted", "Average temp."="212.22", "Door closed"="", "Door opned"=""}, {"selected"=FALSE, "Charge Nr."="550", "Process name"="Cleaning", "Programme name"="Light eco without steam generator descaling", "Date and time"="2022.12.05 09:13:40", "Duration"="000:00:11", "Status"="Cancelled/aborted", "Average temp."="153.67", "Door closed"="", "Door opned"=""}, {"selected"=FALSE, "Charge Nr."="551", "Process name"="Cleaning", "Programme name"="Emergency clean", "Date and time"="2022.12.05 09:13:52", "Duration"="000:00:02", "Status"="Cancelled/aborted", "Average temp."="143.00", "Door closed"="", "Door opned"=""}, {"selected"=FALSE, "Charge Nr."="552", "Process name"="Cleaning", "Programme name"="Light eco without steam generator descaling", "Date and time"="2022.12.05 09:32:56", "Duration"="003:24:04", "Status"="Completed", "Average temp."="86.31", "Door closed"="", "Door opned"=""}, {"selected"=FALSE, "Charge Nr."="553", "Process name"="Cooking process", "Programme name"="Finishing Plates à la carte", "Date and time"="2022.1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
  "Error input": error
outputs:
  "Output": error
  "Curve": T2[]
  "Statistics": cluster{"Process": string, "quantity": string}[]
  "Cleaning statistics": T3[]
  "Cleaning graphic": cluster{"Element 1": f64[], "Element 2": f64[]}[]
panel indicators:
  "Cooking process": f64[]
  "Cleaning programme with descaling process": f64[]
  "\"Cleaning programme without descaling process\"": f64[]
  "Timestamp": timestamp[]
  "all cleaning programms": string[]
  "Cleaning programme without descaling process": string[]
  "Cleaning programme with descaling process_2": string[]
  "Status with": string[]
  "Status without": string[]
types:
  T1 = cluster{"selected": bool, "Charge Nr.": string, "Process name": string, "Programme name": string, "Date and time": string, "Duration": string, "Status": string, "Average temp.": string, "Door closed": string, "Door opned": string}
  T2 = cluster{"Element 1": timestamp[], "Element 2": f64[]}
  T3 = cluster{"Cleaning name": string, "Standard cleaning": u64, "Eco cleaning": u64, "Aborted cleaning": u64}
  T4 = cluster{"Cleaning name": string, "Without descaling process": u64, "With descaling process": u64, "Aborted cleaning": u64}
uses:
  WebApp::Calculate_duration_for_iCC.gviweb
diagram:
  s1 = f64[] []  # shift register
  s2 = f64[] []  # shift register
  s3 = f64[] []  # shift register
  s4 = 0  # shift register
  s5 = 0  # shift register
  s6 = 0  # shift register
  s7 = string[] []  # shift register
  s8 = 1904-01-01T00:00:00Z  # shift register
  s9 = ""  # shift register
  s10 = 0  # shift register
  for {
    w1 = each element of $"Charge infos"
    Property Node(instance in=w1) -> ("Process name"=w3, "Programme name"=w4, "Date and time"=w5)
    case (w3) {
      frame "False", Default {
        Insert Into Array(inArray=s1, new=0) -> w6
        Insert Into Array(inArray=s2, new=0) -> w7
        Insert Into Array(inArray=s3, new=0) -> w8
        w9 = s4
        w10 = s5
        w11 = s6
        w12 = s7
      }
      frame "Cleaning programme with descaling process" {
        Insert Into Array(inArray=s1, new=0) -> w6
        Insert Into Array(inArray=s2, new=1) -> w7
        Insert Into Array(inArray=s3, new=0) -> w8
        Increment(x=s5) -> w10
        Insert Into Array(inArray=s7, new=w4) -> w12
        w9 = s4
        w11 = s6
      }
      frame "Cleaning programme without descaling process" {
        Insert Into Array(inArray=s1, new=0) -> w6
        Insert Into Array(inArray=s2, new=0) -> w7
        Insert Into Array(inArray=s3, new=1) -> w8
        Increment(x=s6) -> w11
        Insert Into Array(inArray=s7, new=w4) -> w12
        w9 = s4
        w10 = s5
      }
      frame "Cooking Process" {
        Insert Into Array(inArray=s1, new=1) -> w6
        Insert Into Array(inArray=s2, new=0) -> w7
        Insert Into Array(inArray=s3, new=0) -> w8
        Increment(x=s4) -> w9
        w10 = s5
        w11 = s6
        w12 = s7
      }
    }
    call "Calculate_duration_for_iCC.gviweb"(Last date and time=w5, Error input=$"Error input") -> (TimeStamp=w13, Output Error=w14)
    # s4: Cooking Prozess
    # s5: Cleaning programme with descaling process
    # s6: Cleaning
    Is Greater(x=w13, y=2000-01-01T01:00:00Z) -> w15
    case (w15) {
      frame False, Default {
        w16 = s8
      }
      frame True {
        w16 = w13
      }
    }
    Get Date And Time String(time stamp=w16) -> (date string=w17)
    Is Equal(x=w17, y=s9) -> w18
    case (w18) {
      frame False, Default {
        Increment(x=s10) -> w19
      }
      frame True {
        w19 = s10
      }
    }
    append w16 to w2
    next s1 = w6
    next s2 = w7
    next s3 = w8
    next s4 = w9
    next s5 = w10
    next s6 = w11
    next s7 = w12
    next s8 = w16
    next s9 = w17
    next s10 = w19
  }
  Build Cluster(w2, s1) -> w20
  Build Cluster(w2, s2) -> w21
  Build Cluster(w2, s3) -> w22
  Build Array(w20, w21, w22) -> w23
  $Curve <- w23
  s11 = string[] []  # shift register
  s12 = string[] []  # shift register
  s13 = string[] []  # shift register
  s14 = string[] []  # shift register
  for {
    w24 = each element of $"Charge infos"
    Property Node(instance in=w24) -> ("Process name"=w25, "Programme name"=w26, "Status"=w27)
    case (w25) {
      frame "False", Default {
        w28 = s11
        w29 = s12
        w30 = s13
        w31 = s14
      }
      frame "Cleaning programme with descaling process" {
        Insert Into Array(inArray=s11, new=w26) -> w28
        Insert Into Array(inArray=s13, new=w27) -> w30
        w29 = s12
        w31 = s14
      }
      frame "Cleaning programme without descaling process" {
        Insert Into Array(inArray=s12, new=w26) -> w29
        Insert Into Array(inArray=s14, new=w27) -> w31
        w28 = s11
        w30 = s13
      }
    }
    next s11 = w28
    next s12 = w29
    next s13 = w30
    next s14 = w31
  }
  s15 = 0  # shift register
  s16 = 0  # shift register
  s17 = 0  # shift register
  s18 = 0  # shift register
  s19 = 0  # shift register
  s20 = 0  # shift register
  s21 = 0  # shift register
  s22 = 0  # shift register
  for {
    w32 = each element of s11
    w33 = each element of s13
    case (w32) {
      frame "False", Default {
        w34 = s15
        w35 = s16
        w36 = s17
        w37 = s18
        w38 = s19
        w39 = s20
        w40 = s21
        w41 = s22
      }
      frame "Rinse without tabs" {
        case (w33) {
          frame "False", Default {
            Increment(x=s16) -> w35
            Increment(x=s15) -> w34
            w36 = s17
            w37 = s18
            w38 = s19
            w39 = s20
            w40 = s21
            w41 = s22
          }
          frame "Completed" {
            Increment(x=s15) -> w34
            w35 = s16
            w36 = s17
            w37 = s18
            w38 = s19
            w39 = s20
            w40 = s21
            w41 = s22
          }
        }
      }
      frame "Light cleaning" {
        case (w33) {
          frame "False", Default {
            Increment(x=s17) -> w36
            Increment(x=s18) -> w37
            w34 = s15
            w35 = s16
            w38 = s19
            w39 = s20
            w40 = s21
            w41 = s22
          }
          frame "Completed" {
            Increment(x=s17) -> w36
            w34 = s15
            w35 = s16
            w37 = s18
            w38 = s19
            w39 = s20
            w40 = s21
            w41 = s22
          }
        }
      }
      frame "Medium cleaning" {
        case (w33) {
          frame "False", Default {
            Increment(x=s20) -> w39
            Increment(x=s19) -> w38
            w34 = s15
            w35 = s16
            w36 = s17
            w37 = s18
            w40 = s21
            w41 = s22
          }
          frame "Completed" {
            Increment(x=s19) -> w38
            w34 = s15
            w35 = s16
            w36 = s17
            w37 = s18
            w39 = s20
            w40 = s21
            w41 = s22
          }
        }
      }
      frame "Heavy cleaning" {
        case (w33) {
          frame "False", Default {
            Increment(x=s21) -> w40
            Increment(x=s22) -> w41
            w34 = s15
            w35 = s16
            w36 = s17
            w37 = s18
            w38 = s19
            w39 = s20
          }
          frame "Completed" {
            Increment(x=s21) -> w40
            w34 = s15
            w35 = s16
            w36 = s17
            w37 = s18
            w38 = s19
            w39 = s20
            w41 = s22
          }
        }
      }
    }
    next s15 = w34
    next s16 = w35
    next s17 = w36
    next s18 = w37
    next s19 = w38
    next s20 = w39
    next s21 = w40
    next s22 = w41
  }
  Build Array(s15) -> w42
  Build Cluster([1], w42) -> w43
  s23 = 0  # shift register
  s24 = 0  # shift register
  s25 = 0  # shift register
  s26 = 0  # shift register
  s27 = 0  # shift register
  s28 = 0  # shift register
  s29 = 0  # shift register
  s30 = 0  # shift register
  for {
    w44 = each element of s12
    w45 = each element of s14
    case (w44) {
      frame "False", Default {
        w46 = s23
        w47 = s24
        w48 = s25
        w49 = s26
        w50 = s27
        w51 = s28
        w52 = s29
        w53 = s30
      }
      frame "Rinse without tabs" {
        case (w45) {
          frame "False", Default {
            Increment(x=s24) -> w47
            Increment(x=s23) -> w46
            w48 = s25
            w49 = s26
            w50 = s27
            w51 = s28
            w52 = s29
            w53 = s30
          }
          frame "Completed" {
            Increment(x=s23) -> w46
            w47 = s24
            w48 = s25
            w49 = s26
            w50 = s27
            w51 = s28
            w52 = s29
            w53 = s30
          }
        }
      }
      frame "Light cleaning" {
        case (w45) {
          frame "False", Default {
            Increment(x=s26) -> w49
            Increment(x=s25) -> w48
            w46 = s23
            w47 = s24
            w50 = s27
            w51 = s28
            w52 = s29
            w53 = s30
          }
          frame "Completed" {
            Increment(x=s25) -> w48
            w46 = s23
            w47 = s24
            w49 = s26
            w50 = s27
            w51 = s28
            w52 = s29
            w53 = s30
          }
        }
      }
      frame "Medium cleaning" {
        case (w45) {
          frame "False", Default {
            Increment(x=s28) -> w51
            Increment(x=s27) -> w50
            w46 = s23
            w47 = s24
            w48 = s25
            w49 = s26
            w52 = s29
            w53 = s30
          }
          frame "Completed" {
            Increment(x=s27) -> w50
            w46 = s23
            w47 = s24
            w48 = s25
            w49 = s26
            w51 = s28
            w52 = s29
            w53 = s30
          }
        }
      }
      frame "Heavy cleaning" {
        case (w45) {
          frame "False", Default {
            Increment(x=s30) -> w53
            Increment(x=s29) -> w52
            w46 = s23
            w47 = s24
            w48 = s25
            w49 = s26
            w50 = s27
            w51 = s28
          }
          frame "Completed" {
            Increment(x=s29) -> w52
            w46 = s23
            w47 = s24
            w48 = s25
            w49 = s26
            w50 = s27
            w51 = s28
            w53 = s30
          }
        }
      }
    }
    next s23 = w46
    next s24 = w47
    next s25 = w48
    next s26 = w49
    next s27 = w50
    next s28 = w51
    next s29 = w52
    next s30 = w53
  }
  Build Array(s23) -> w54
  Build Cluster([1], w54) -> w55
  Add(s16, s24) -> w56
  Build Array(w56) -> w57
  Build Cluster([1], w57) -> w58
  Build Array(s17) -> w59
  Build Cluster([2], w59) -> w60
  Build Array(s25) -> w61
  Build Cluster([2], w61) -> w62
  Add(s18, s26) -> w63
  Build Array(w63) -> w64
  Build Cluster([2], w64) -> w65
  Build Array(s19) -> w66
  Build Cluster([3], w66) -> w67
  Build Array(s27) -> w68
  Build Cluster([3], w68) -> w69
  Add(s20, s28) -> w70
  Build Array(w70) -> w71
  Build Cluster([3], w71) -> w72
  Build Array(s21) -> w73
  Build Cluster([4], w73) -> w74
  Build Array(s29) -> w75
  Build Cluster([4], w75) -> w76
  Add(s22, s30) -> w77
  Build Array(w77) -> w78
  Build Cluster([4], w78) -> w79
  Build Array(w43, w55, w58, w60, w62, w65, w67, w69, w72, w74, w76, w79) -> w80
  $"Cleaning graphic" <- w80
  $"Cooking process" <- s1
  $Timestamp <- w2
  $"Cleaning programme with descaling process" <- s2
  $"\"Cleaning programme without descaling process\"" <- s3
  Insert Into Array(inArray=u64[] [], new=s4, new=s5, new=s6, new=s10) -> w81
  w82 = ["Cooking processes", "Cleaning programme with descaling process", "Cleaning programme without descaling process", "Total days", "", ""]
  for {
    w83 = each element of w82
    w84 = each element of w81
    Number To Decimal String(number=w84) -> (decimal integer string=w86)
    w87 = cluster{"Process": string, "quantity": string} {all zero or empty}  # Cluster Constant
    Property Node(instance in=w87, "Process"=w83, "quantity"=w86) -> (instance out=w88)
    append w88 to w85
  }
  $Statistics <- w85
  $Output <- w14
  $"all cleaning programms" <- s7
  $"Cleaning programme without descaling process" <- s12
  $"Cleaning programme with descaling process_2" <- s11
  Insert Into Array(inArray=u64[] [], new=s23, new=s25, new=s27, new=s29) -> w89
  Insert Into Array(inArray=u64[] [], new=s15, new=s17, new=s19, new=s21) -> w90
  Insert Into Array(inArray=u64[] [], new=w56, new=w63, new=w70, new=w77) -> w91
  for {
    w92 = each element of w90
    w93 = each element of w89
    w94 = each element of w91
    w95 = each element of ["Rinse without tabs", "Light", "Medium", "Strong"]
    Property Node(instance in=T4 {all zero or empty}, "Cleaning name"=w95, "Without descaling process"=w92, "With descaling process"=w93, "Aborted cleaning"=w94) -> (instance out=w97)
    append w97 to w96
  }
  $"Cleaning statistics" <- w96
  $"Status with" <- s13
  $"Status without" <- s14
