vi "Display_all_programm_in_graph_iCP_V2.gviweb"   [G Web Development Software 22.3.0]
inputs:
  "Error input": error
outputs:
  "Curve": T1[]
  "Error Output": error
  "Statistics": cluster{"Process": string, "quantity": string}[]
panel controls:
  "Charge infos": T2[]
panel indicators:
  "Cooking process": f64[]
  "Emergency Clean": f64[]
  "IPM": f64[]
  "Service": f64[]
  "Cleaning": f64[]
  "Timestamp": timestamp[]
  "All Cleaning programms include aboted programm": string[]
  "Couter eco with SG descaling": i32
  "Couter eco without SG descaling": i32
  "Couter after enmergency": i32
  "Couter standard without SG descaling": i32
  "Couter standard with SG descaling": i32
  "Output": error
  "all cleaning programms": string[]
  "Cleaning name": string[]
  "Kategorie": string[]
  "Eco": i32[]
types:
  T1 = cluster{"Element 1": timestamp[], "Element 2": f64[]}
  T2 = cluster{"selected": bool, "Charge Nr.": string, "Process name": string, "Programme name": string, "Date and time": string, "Duration": string, "Status": string, "Average temp.": string}
uses:
  WebApp::Organize all recipes.gviweb
  WebApp::Find_Emergency_clean.gviweb
  WebApp::Strong_Cleaning_Type_Counter.gviweb
diagram:
  disable {
    frame Enabled { }
    frame Disabled {
      case (_) {
        frame "False", Default { }
        frame "{CBA589DD-96CD-402A-96AC-5BFF7D114EBA}" { }
        frame "{66C96C8E-B391-417B-A6C9-DA20EDCCFAEA}" { }
        frame "{25BD9CAA-E37F-44C2-87C2-56C327C622FD}" { }
        frame "{332078E2-D710-4D65-A529-2175C4359A6F}" { }
        frame "{738E0E75-020D-49D1-9852-54C9DCF67051}" { }
        frame "{DACC4655-7A92-41E0-96A7-A283E5BD1AEE}" { }
        frame "{82CEFD0A-43C8-4F39-BA40-CD7BB0232FA4}" { }
        frame "{DBC24574-DDCC-4FC3-A778-2AB93AF8AFEA}" { }
        frame "{887397A1-94D5-4B95-B1F8-EA161F861245}" { }
        frame "{B5275CEB-3D2C-4919-A6E8-45317A409630}" { }
        frame "{203FE8F6-9995-40DE-BDAB-6D5CB377BF6A}" { }
        frame "{315B87B6-C01A-4D6D-B8C2-0527ED177727}" { }
        frame "{65E2919B-5C42-4820-BC98-33F63AFDD3F0}" { }
        frame "{D29BE15A-B3B6-4244-8E0E-44A7DFD9B520}" { }
        frame "{3C95817D-14FB-4BAD-A002-DB4D22F0E0AA}" { }
        frame "{F96FB4D2-17FC-4704-848B-4AABE8F8C820}" { }
        frame "{B72345AA-C872-403A-B567-E1ADF63A5081}" {
          w1 = "Without drying phase Light without steam generator descaling"
        }
        frame "{C18D2A4A-4547-4E43-865A-3FC6E833092C}" { }
        frame "{492F451C-0B93-47C3-BC36-AFCB8A228D7C}" {
          w2 = "Without drying phase strong without steam generator descaling"
        }
        frame "{724E55F3-E6D1-4D29-8B39-625418C3CCA8}" { }
        frame "{99C7BB81-A9DC-48CB-A479-9A9980AA71FA}" { }
        frame "{1C2F9924-D80E-4CA8-A56B-78642B236FAF}" {
          w3 = "Without drying phase strong eco without steam generator descaling"
        }
        frame "{5B6F3441-978A-489D-AE9B-5B3699863351}" {
          w4 = "Without drying phase strong eco with steam generator descaling"
        }
        frame "{7473F324-AC8E-4C8C-A738-1E07FDA8E109}" { }
        frame "{0A0807EE-C625-4815-80F7-A4B4AE974899}" { }
        frame "{38739E20-1D61-4BDC-BCDA-1AA25A40F2FE}" {
          w5 = "Interim cleaning without steam generator descaling (auto dose)"
        }
        frame "{B5DCEC69-E9DF-4C25-A8FF-8496D332501C}" { }
        frame "{12712E54-B744-46B8-A141-0A81B64D7011}" { }
        frame "{025AA6D1-C3F2-4E90-A4D6-F1917D171C6E}" { }
        frame "{F7624E50-66B4-4421-80C7-46480577468E}" { }
        frame "{EE769139-367E-4C52-8814-3C9C61866BF7}" { }
        frame "{29F8F17A-F2E8-4143-BE93-B4A6018D43E5}" { }
        frame "{5FE207E0-2372-4082-BD08-AB9AA60799E7}" { }
        frame "{43F7F290-F5CA-4E32-8D7F-205CEAC7ED7E}" { }
        frame "{4E9B4379-26D1-43CB-A99B-8FF396892B4D}" { }
        frame "{B9BFE4E2-E953-46C2-9FD7-AE4A8E11CD13}" { }
        frame "{57D3BF39-11B3-4760-8300-3ADE7944D77D}" { }
        frame "{E30D7068-41F6-40A7-A10F-A2B3644B2FE3}" {
          w6 = "Interim cleaning without steam generator descaling (auto dose)"
        }
        frame "{6671DBEB-BB70-48F9-A93C-CAE76BA47A87}" { }
        frame "{B4CD2665-EE21-4E45-881E-CD434890B0A2}" { }
        frame "{318D64C3-C5DA-4D03-9BB6-0479A6F40CCC}" { }
        frame "{574CCD29-FFFD-4003-83C9-8AC080532669}" { }
        frame "{FE4CB1DD-2B30-4295-A957-128BC69272F0}" { }
        frame "{F1DBF74B-F189-423B-A0EF-4BE4F8B88896}" { }
        frame "{FC5886DA-E94D-4FED-B001-430247AE11C1}" { }
        frame "{C3157636-9CB5-4153-8B02-D9BC6D63F4D2}" { }
        frame "{2A43CD70-B0C1-41A7-959B-99EFD232E764}" { }
        frame "{D1C7A2CE-5708-4454-889B-C1125FD83297}" { }
        frame "{42A6A575-6469-4043-9241-D5FA45B7DF87}" {
          w7 = "Without drying phase strong eco with steam generator descaling (auto dose)"
        }
        frame "{AFF7E7C1-FE23-46DF-B537-182E5AC4E2EA}" {
          w8 = "Without drying phase strong eco without steam generator descaling (auto dose)"
        }
        frame "{44B79862-E680-462F-897C-3BA26E314C79}" {
          w9 = "Without drying phase strong with steam generator descaling (auto dose)"
        }
        frame "{8F9272A2-7BC0-46A4-8A8C-CFB81E294D88}" {
          w10 = "Without drying phase strong without steam generator descaling (auto dose)"
        }
        frame "{AB1098CC-4227-411B-BF9D-017D11705A06}" {
          w11 = "Without drying phase light with steam generator descaling (auto dose)"
        }
        frame "{5D09A017-0BAC-4CFC-8ABA-BEA1BF918B49}" {
          w12 = "Without drying phase light without steam generator descaling (auto dose)"
        }
        frame "{F41A1B99-DA3B-4760-9EC1-451A0417D29F}" { }
        frame "{1B085774-3E4F-4FE8-8149-1FD7C2C5786A}" {
          w13 = "Light Express without steam generator descaling (auto dose)"
        }
        frame "{224F9D8B-6031-4194-8209-90E725DA55D1}" { }
        frame "{F3F5C49B-0873-48F9-884E-6375C9FA875B}" {
          w14 = "Thermo oxidative cleaning without steam generator descaling"
        }
        frame "{CB225C78-3F87-4E9F-9822-A3CB2671AA6C}" { }
        frame "{7A2304A9-6CF1-44F1-B9CA-C835D12420B1}" { }
      }
    }
  }
  call "Organize all recipes.gviweb"(Charge infos=$"Charge infos", Array Constant=string[] [], array=f64[] [], String Constant="", Numeric Constant=0, Error input=$"Error input") -> (Output=w15, element {0}=w16, Cooking process=w17, IPM=w18, Cleaning=w19, Emergency Clean=w20, Service=w21, new element/subarray_2=w22, new element/subarray_4=w23, new element/subarray_5=w24, new element/subarray_6=w25, new element/subarray_3=w26, new element/subarray=w27, Output_2=w28)
  $"all cleaning programms" <- w15
  $Timestamp <- w16
  $"Cooking process" <- w17
  Build Cluster(w16, w17) -> w29
  Build Cluster(w16, w18) -> w30
  Build Cluster(w16, w19) -> w31
  Build Cluster(w16, w20) -> w32
  Build Cluster(w16, w21) -> w33
  Build Array(w29, w30, w31, w32, w33) -> w34
  $Curve <- w34
  $IPM <- w18
  $Cleaning <- w19
  $"Emergency Clean" <- w20
  $Service <- w21
  for {
    w35 = each element of w15
    case (w35) {
      frame "False", Default {
        w39 = 0
        w40 = w35
      }
      frame "Emergency clean" {
        w39 = 0
        w40 = w35
      }
      frame "Light without steam generator descaling" {
        w39 = 0
        w40 = w35
      }
      frame "Light with steam generator descaling" {
        w39 = 0
        w40 = w35
      }
      frame "Light eco without steam generator descaling" {
        w39 = 1
        w40 = w35
      }
      frame "Light eco with steam generator descaling" {
        w39 = 1
        w40 = w35
      }
      frame "Medium without steam generator descaling" {
        w39 = 0
        w40 = w35
      }
      frame "Medium with steam generator descaling" {
        w39 = 0
        w40 = w35
      }
      frame "Medium eco without steam generator descaling" {
        w39 = 1
        w40 = w35
      }
      frame "Medium eco with steam generator descaling" {
        w39 = 1
        w40 = w35
      }
      frame "Strong without steam generator descaling" {
        w39 = 0
        w40 = w35
      }
      frame "Strong with steam generator descaling" {
        w39 = 0
        w40 = w35
      }
      frame "Strong eco without steam generator descaling" {
        w39 = 1
        w40 = w35
      }
      frame "Strong eco with steam generator descaling" {
        w39 = 1
        w40 = w35
      }
      frame "Interim cleaning without steam generator descaling" {
        w39 = 0
        w40 = w35
      }
      frame "Rinse without steam generator descaling" {
        w39 = 0
        w40 = w35
      }
      frame "Rinse with steam generator descaling (auto dose)" {
        w39 = 0
        w40 = w35
      }
      frame "Rinse without tabs (auto dose)" {
        w39 = 0
        w40 = w35
      }
      frame "Without drying phase Light without steam generator descaling" {
        w39 = 0
        w40 = w35
      }
      frame "Without drying phase Light with steam generator descaling" {
        w39 = 0
        w40 = w35
      }
      frame "Without drying phase strong without steam generator descaling" {
        w39 = 0
        w40 = w35
      }
      frame "Without drying phase strong with steam generator descaling" {
        w39 = 0
        w40 = w35
      }
      frame "NDG interim cleaning without steam generator descaling" {
        w39 = 0
        w40 = w35
      }
      frame "Without drying phase strong eco without steam generator descaling" {
        w39 = 1
        w40 = w35
      }
      frame "Without drying phase strong eco with steam generator descaling" {
        w39 = 1
        w40 = w35
      }
      frame "NDG strong with steam generator descaling" {
        w39 = 0
        w40 = w35
      }
      frame "NDG strong without steam generator descaling" {
        w39 = 0
        w40 = w35
      }
      frame "Interim cleaning without steam generator descaling (auto dose)" {
        w39 = 0
        w40 = w35
      }
      frame "Light without steam generator descaling (Baking)" {
        w39 = 0
        w40 = w35
      }
      frame "Light with steam generator descaling (Baking)" {
        w39 = 0
        w40 = w35
      }
      frame "Light eco without steam generator descaling (Baking)" {
        w39 = 1
        w40 = w35
      }
      frame "Light eco with steam generator descaling (Baking)" {
        w39 = 1
        w40 = w35
      }
      frame "Light Express without steam generator descaling" {
        w39 = 0
        w40 = w35
      }
      frame "Light Express with steam generator descaling" {
        w39 = 0
        w40 = w35
      }
      frame "Light without steam generator descaling (auto dose)" {
        w39 = 0
        w40 = w35
      }
      frame "Light with steam generator descaling (auto dose)" {
        w39 = 0
        w40 = w35
      }
      frame "Rinse with steam generator descaling" {
        w39 = 0
        w40 = w35
      }
      frame "Rinse without steam generator descaling (auto dose)" {
        w39 = 0
        w40 = w35
      }
      frame "Rinse without tabs" {
        w39 = 0
        w40 = w35
      }
      frame "Strong eco with steam generator descaling (auto dose)" {
        w39 = 1
        w40 = w35
      }
      frame "Strong eco without steam generator descaling (auto dose)" {
        w39 = 1
        w40 = w35
      }
      frame "Strong with steam generator descaling (auto dose)" {
        w39 = 0
        w40 = w35
      }
      frame "Strong without steam generator descaling (auto dose)" {
        w39 = 0
        w40 = w35
      }
      frame "Medium eco with steam generator descaling (auto dose)" {
        w39 = 1
        w40 = w35
      }
      frame "Medium eco without steam generator descaling (auto dose)" {
        w39 = 1
        w40 = w35
      }
      frame "Medium with steam generator descaling (auto dose)" {
        w39 = 0
        w40 = w35
      }
      frame "Medium without steam generator descaling (auto dose)" {
        w39 = 0
        w40 = w35
      }
      frame "Light eco with steam generator descaling (auto dose)" {
        w39 = 1
        w40 = w35
      }
      frame "Light eco without steam generator descaling (auto dose)" {
        w39 = 1
        w40 = w35
      }
      frame "Without drying phase strong eco with steam generator descaling (auto dose)" {
        w39 = 1
        w40 = w35
      }
      frame "Without drying phase strong eco without steam generator descaling (auto dose)" {
        w39 = 1
        w40 = w35
      }
      frame "Without drying phase strong with steam generator descaling (auto dose)" {
        w39 = 0
        w40 = w35
      }
      frame "Without drying phase strong without steam generator descaling (auto dose)" {
        w39 = 0
        w40 = w35
      }
      frame "Without drying phase light with steam generator descaling (auto dose)" {
        w39 = 0
        w40 = w35
      }
      frame "Without drying phase light without steam generator descaling (auto dose)" {
        w39 = 0
        w40 = w35
      }
      frame "Light Express with steam generator descaling (auto dose)" {
        w39 = 0
        w40 = w35
      }
      frame "Light Express without steam generator descaling (auto dose)" {
        w39 = 0
        w40 = w35
      }
      frame "Medium Express" {
        w39 = 0
        w40 = w35
      }
      frame "Thermo oxidative cleaning without steam generator descaling" {
        w39 = 0
        w40 = w35
      }
      frame "Thermo oxidative cleaning with steam generator descaling" {
        w39 = 0
        w40 = w35
      }
      frame "Test Reciepe: Strong eco without SG-descaling." {
        w39 = 1
        w40 = w35
      }
    }
    append w40 to w36
    append w39 to w37
    append w40 to w38
  }
  $Eco <- w37
  $"Cleaning name" <- w38
  $Kategorie <- w36
  Insert Into Array(inArray=u64[] [], new=w22, new=w23, new=w24, new=w25, new=w26, new=w27) -> w41
  w42 = ["Cooking processes", "IPMs", "Cleanings", "Emergency cleans", "Service programmes", "Total days"]
  # 1. Cooking process
  # 2. IPM
  # 3. Cleaning
  # 4. Emergency Clean
  # 4. Service
  for {
    w43 = each element of w42
    w44 = each element of w41
    Number To Decimal String(number=w44) -> (decimal integer string=w46)
    w47 = cluster{"Process": string, "quantity": string} {all zero or empty}  # Cluster Constant
    Property Node(instance in=w47, "Process"=w43, "quantity"=w46) -> (instance out=w48)
    append w48 to w45
  }
  $Statistics <- w45
  call "Find_Emergency_clean.gviweb"(Kategorie_in=w36, Error input=w28) -> (adapted array=w49, Error Output=w50)
  $"All Cleaning programms include aboted programm" <- w49
  call "Strong_Cleaning_Type_Counter.gviweb"(adapted array=w49, Cleaning naming="Strong", Error Input=w50) -> (Couter standard with SG descaling=w51, Couter standard without SG descaling=w52, Couter after enmergency=w53, Couter eco without SG descaling=w54, Couter eco with SG descaling=w55, Output=w56)
  $"Couter standard with SG descaling" <- w51
  $"Error Output" <- w28
  $"Couter standard without SG descaling" <- w52
  $"Couter after enmergency" <- w53
  $"Couter eco without SG descaling" <- w54
  $"Couter eco with SG descaling" <- w55
  $Output <- w56
