vi "Display_all_programm_in_graph_iCombi_Pro.gviweb"   [G Web Development Software 22.3.0]
inputs:
  "Charge infos output": T4[]
  "Error input": error
outputs:
  "Curve": T1[]
  "Error Output": error
  "Cleaning statistics": T3[]
  "Statistics": cluster{"Process": string, "quantity": string}[]
  "Cleaning graphic": cluster{"Element 1": f64[], "Element 2": i32[]}[]
panel controls:
  "Charge infos": T2[] = [{"selected"=TRUE, "Charge Nr."="922", "Process name"="Service", "Programme name"="Selftest", "Date and time"="2026.06.19 09:32:48", "Duration"="000:03:37", "Status"="Cancelled/aborted", "Average temp."="28.33"}, {"selected"=FALSE, "Charge Nr."="923", "Process name"="Cleaning", "Programme name"="Strong eco without steam generator descaling", "Date and time"="2026.06.19 09:42:29", "Duration"="000:00:05", "Status"="Cancelled/aborted", "Average temp."="28.00"}, {"selected"=FALSE, "Charge Nr."="924", "Process name"="Cleaning", "Programme name"="Emergency clean", "Date and time"="2026.06.19 09:42:35", "Duration"="000:01:39", "Status"="Completed", "Average temp."="28.00"}, {"selected"=FALSE, "Charge Nr."="925", "Process name"="Cleaning", "Programme name"="Strong eco without steam generator descaling", "Date and time"="2026.06.19 09:44:29", "Duration"="004:26:41", "Status"="Cancelled/aborted", "Average temp."="56.91"}, {"selected"=FALSE, "Charge Nr."="926", "Process name"="Cleaning", "Programme name"="Emergency clean", "Date and time"="2026.06.19 14:11:11", "Duration"="000:00:03", "Status"="Cancelled/aborted", "Average temp."="57.50"}, {"selected"=FALSE, "Charge Nr."="927", "Process name"="Cleaning", "Programme name"="Interim cleaning without steam generator descaling", "Date and time"="2026.06.19 14:14:00", "Duration"="000:15:58", "Status"="Cancelled/aborted", "Average temp."="70.62"}, {"selected"=FALSE, "Charge Nr."="928", "Process name"="Cleaning", "Programme name"="Emergency cle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
panel indicators:
  "Cooking process": f64[]
  "Emergency Clean": f64[]
  "IPM": f64[]
  "Service": f64[]
  "Cleaning": f64[]
  "Timestamp": timestamp[]
  "Eco ?": string[]
  "With SG ?": string[]
  "Output": string[]
  "Aborted ?": string[]
  "Count Light aborted": i32
  "Count medium aborted": i32
  "Count Strong aborted": i32
  "Count Express aborted": i32
  "Count Rinse without tab aborted": i32
  "Count Rinse aborted": i32
  "Count medium nicht aborted eco without SG": i32
  "Count medium nicht aborted eco with SG": i32
  "Count medium nicht aborted standard without SG": i32
  "Count medium nicht aborted standard with SG": i32
  "Count Light nicht aborted eco without SG": i32
  "Count Light nicht aborted eco with SG": i32
  "Count Light nicht aborted standard without SG": i32
  "Count Light nicht aborted standard with SG": i32
  "Count Strong nicht aborted eco without SG": i32
  "Count Strong nicht aborted eco with SG": i32
  "Count Strong nicht aborted standard without SG": i32
  "Count Strong nicht aborted standard with SG": i32
  "Count Rinse nicht aborted eco with SG": i32
  "Count Rinse nicht aborted standard without SG": i32
  "Count Rinse without tabs nicht aborted eco without SG": i32
  "Count Rinse without tabs nicht aborted eco with SG": i32
  "Count Rinse without tabs nicht aborted standard with SG": i32
  "Count Express nicht aborted eco without SG": i32
  "Count Express nicht aborted eco with SG": i32
  "Count Express nicht aborted standard without SG": i32
  "Count Express nicht aborted standard with SG": i32
  "Light": cluster{"Element 1": f64[], "Element 2": i32[]}
  "medium": cluster{"Element 1": f64[], "Element 2": i32[]}
  "Strong": cluster{"Element 1": f64[], "Element 2": i32[]}
  "Rinse": cluster{"Element 1": f64[], "Element 2": i32[]}
  "Rinse without tab": cluster{"Element 1": f64[], "Element 2": i32[]}
  "Express": cluster{"Element 1": f64[], "Element 2": i32[]}
  "all cleaning programms": string[]
  "Cleaning name": string[]
  "Kategorie": string[]
  "Count Rinse nicht aborted eco without SG": i32
  "Count Rinse nicht aborted standard with SG": i32
  "Count Rinse without tabs nicht aborted standard without SG": i32
types:
  T1 = cluster{"Element 1": timestamp[], "Element 2": f64[]}
  T2 = cluster{"selected": bool, "Charge Nr.": string, "Process name": string, "Programme name": string, "Date and time": string, "Duration": string, "Status": string, "Average temp.": string}
  T3 = cluster{"Cleaning name": string, "Eco with SG": i32, "Standard with SG": i32, "Eco without SG": i32, "Standard without SG": i32, "Aborted": i32}
  T4 = cluster{"selected": bool, "Charge Nr.": string, "Process name": string, "Programme name": string, "Date and time": string, "Duration": string, "Status": string, "Average temp.": string, "counter Door closed": string, "counter Door opened": string}
uses:
  WebApp::Add_offset_time_txt.gviweb
  NI::G Core::Strings::Trim Whitespace.gvi
  WebApp::Cleaning_meduim_Count.gviweb
  WebApp::Cleaning_Light_Count.gviweb
  WebApp::Cleaning_Strong_Count.gviweb
  WebApp::Cleaning_Rinse_Count.gviweb
  WebApp::Cleaning_Rinse_Without_tab_Count.gviweb
  WebApp::Cleaning_Express_Count.gviweb
diagram:
  # Aborted
  # eco with sg
  # 1. Cooking process
  # 2. IPM
  # 3. Cleaning
  # 4. Emergency Clean
  # 4. Service
  # Without_SG
  # With_SG
  # Standard
  # Eco
  s1 = f64[] []  # shift register
  s2 = f64[] []  # shift register
  s3 = f64[] []  # shift register
  s4 = f64[] []  # shift register
  s5 = f64[] []  # shift register
  s6 = 0  # shift register
  s7 = 0  # shift register
  s8 = 0  # shift register
  s9 = 0  # shift register
  s10 = 0  # shift register
  s11 = ""  # shift register
  s12 = 0  # shift register
  s13 = string[] []  # shift register
  for {
    w1 = each element of $"Charge infos output"
    # s6: Cooking Prozess
    # s8: IPM
    # s9: Cleaning
    # s7: Service
    Property Node(instance in=w1) -> ("Process name"=w3, "Programme name"=w4, "Date and time"=w5)
    String Subset(length (rest)=10, string=w5) -> w6
    Is Equal(x=s11, y=w6) -> w7
    case (w7) {
      frame False, Default {
        Increment(x=s12) -> w8
      }
      frame True {
        w8 = s12
      }
    }
    # s10: Emergency Clean
    case (w3) {
      frame "False", Default {
        Insert Into Array(inArray=s1, new=0) -> w9
        Insert Into Array(inArray=s3, new=0) -> w11
        Insert Into Array(inArray=s5, new=0) -> w13
        Insert Into Array(inArray=s2, new=0) -> w10
        Insert Into Array(inArray=s4, new=0) -> w12
        w14 = s6
        w15 = s7
        w16 = s8
        w17 = s9
        w18 = s10
        w19 = s13
      }
      frame "Service" {
        Increment(x=s7) -> w15
        Insert Into Array(inArray=s1, new=0) -> w9
        Insert Into Array(inArray=s3, new=0) -> w11
        Insert Into Array(inArray=s5, new=0) -> w13
        Insert Into Array(inArray=s2, new=0) -> w10
        Insert Into Array(inArray=s4, new=1) -> w12
        w14 = s6
        w16 = s8
        w17 = s9
        w18 = s10
        w19 = s13
      }
      frame "IPM" {
        Increment(x=s8) -> w16
        Insert Into Array(inArray=s1, new=0) -> w9
        Insert Into Array(inArray=s3, new=1) -> w11
        Insert Into Array(inArray=s5, new=0) -> w13
        Insert Into Array(inArray=s2, new=0) -> w10
        Insert Into Array(inArray=s4, new=0) -> w12
        w14 = s6
        w15 = s7
        w17 = s9
        w18 = s10
        w19 = s13
      }
      frame "Cleaning" {
        Insert Into Array(inArray=s1, new=0) -> w9
        Insert Into Array(inArray=s3, new=0) -> w11
        case (w4) {
          frame "False", Default {
            Increment(x=s9) -> w17
            Insert Into Array(inArray=s5, new=1) -> w13
            Insert Into Array(inArray=s2, new=0) -> w10
            Insert Into Array(inArray=s13, new=w4) -> w19
            w18 = s10
          }
          frame "Emergency clean" {
            Increment(x=s10) -> w18
            Insert Into Array(inArray=s5, new=0) -> w13
            Insert Into Array(inArray=s2, new=1) -> w10
            Insert Into Array(inArray=s13, new=w4) -> w19
            w17 = s9
          }
        }
        Insert Into Array(inArray=s4, new=0) -> w12
        w14 = s6
        w15 = s7
        w16 = s8
      }
      frame "Cooking process" {
        Increment(x=s6) -> w14
        Insert Into Array(inArray=s1, new=1) -> w9
        Insert Into Array(inArray=s3, new=0) -> w11
        Insert Into Array(inArray=s5, new=0) -> w13
        Insert Into Array(inArray=s2, new=0) -> w10
        Insert Into Array(inArray=s4, new=0) -> w12
        w15 = s7
        w16 = s8
        w17 = s9
        w18 = s10
        w19 = s13
      }
    }
    call "Add_offset_time_txt.gviweb"(Start date and time=w5, Error input=$"Error input") -> (timestamp=w20, Output Error=w21)
    append w20 to w2
    next s1 = w9
    next s2 = w10
    next s3 = w11
    next s4 = w12
    next s5 = w13
    next s6 = w14
    next s7 = w15
    next s8 = w16
    next s9 = w17
    next s10 = w18
    next s11 = w6
    next s12 = w8
    next s13 = w19
  }
  $Service <- s4
  # standard with sg
  s14 = string[] []  # shift register
  s15 = ""  # shift register
  for (iteration -> i1) {
    w22 = each element of s13
    case (w22) {
      frame "False", Default {
        Insert Into Array(inArray=s14, new=w22) -> w23
        w24 = w22
      }
      frame "Emergency clean" {
        Decrement(x=i1) -> w25
        Concatenate Strings("Aborted ", s15) -> w26
        Replace Array Subset(inArray=s14, index=w25, new=w26) -> w27
        Insert Into Array(inArray=w27, new=w22) -> w23
        w24 = w22
      }
    }
    next s14 = w23
    next s15 = w24
  }
  for {
    w28 = each element of s14
    Match Pattern(regular expression="Aborted", string=w28) -> (after substring=w34, match substring=w35)
    call "Trim Whitespace.gvi"(string=w35, location="start of string"(1)) -> (trimmed string=w36)
    call "Trim Whitespace.gvi"(string=w34) -> (trimmed string=w37)
    case (w36) {
      frame "False", Default {
        case (w28) {
          frame "False", Default {
            w38 = "Unknown"
            w41 = w28
            w39 = "Standard"
            w40 = "Without_SG"
          }
          frame "Emergency clean" {
            w38 = "Emergency clean"
            w41 = w28
            w39 = "Standard"
            w40 = "Without_SG"
          }
          frame "Light without steam generator descaling" {
            w38 = "Light"
            w41 = w28
            w39 = "Standard"
            w40 = "Without_SG"
          }
          frame "Light with steam generator descaling" {
            w38 = "Light"
            w41 = w28
            w39 = "Standard"
            w40 = "With_SG"
          }
          frame "Light eco without steam generator descaling" {
            w38 = "Light"
            w41 = w28
            w39 = "Eco"
            w40 = "Without_SG"
          }
          frame "Light eco with steam generator descaling" {
            w38 = "Light"
            w41 = w28
            w39 = "Eco"
            w40 = "With_SG"
          }
          frame "Medium without steam generator descaling" {
            w38 = "Medium"
            w41 = w28
            w39 = "Standard"
            w40 = "Without_SG"
          }
          frame "Medium with steam generator descaling" {
            w38 = "Medium"
            w41 = w28
            w39 = "Standard"
            w40 = "With_SG"
          }
          frame "Medium eco without steam generator descaling" {
            w38 = "Medium"
            w41 = w28
            w39 = "Eco"
            w40 = "Without_SG"
          }
          frame "Medium eco with steam generator descaling" {
            w38 = "Medium"
            w41 = w28
            w39 = "Eco"
            w40 = "With_SG"
          }
          frame "Strong without steam generator descaling" {
            w38 = "Strong"
            w41 = w28
            w39 = "Standard"
            w40 = "Without_SG"
          }
          frame "Strong with steam generator descaling" {
            w38 = "Strong"
            w41 = w28
            w39 = "Standard"
            w40 = "With_SG"
          }
          frame "Strong eco without steam generator descaling" {
            w38 = "Strong"
            w41 = w28
            w39 = "Eco"
            w40 = "Without_SG"
          }
          frame "Strong eco with steam generator descaling" {
            w38 = "Strong"
            w41 = w28
            w39 = "Eco"
            w40 = "With_SG"
          }
          frame "Interim cleaning without steam generator descaling" {
            w38 = "Express"
            w41 = w28
            w39 = "Standard"
            w40 = "Without_SG"
          }
          frame "Rinse without steam generator descaling" {
            w38 = "Rinse"
            w41 = w28
            w39 = "Standard"
            w40 = "Without_SG"
          }
          frame "Rinse with steam generator descaling (auto dose)" {
            w38 = "Rinse"
            w41 = w28
            w39 = "Standard"
            w40 = "With_SG"
          }
          frame "Rinse without tabs (auto dose)" {
            w38 = "Rinse without tabs"
            w41 = w28
            w39 = "Standard"
            w40 = "Without_SG"
          }
          frame "Without drying phase Light without steam generator descaling" {
            w38 = "Light"
            w41 = w28
            w39 = "Standard"
            w40 = "Without_SG\n"
          }
          frame "Without drying phase Light with steam generator descaling" {
            w38 = "Light"
            w41 = w28
            w39 = "Standard"
            w40 = "With_SG"
          }
          frame "Without drying phase strong without steam generator descaling" {
            w38 = "strong"
            w41 = w28
            w39 = "Standard"
            w40 = "Without_SG"
          }
          frame "Without drying phase strong with steam generator descaling" {
            w38 = "strong"
            w41 = w28
            w39 = "Standard"
            w40 = "With_SG"
          }
          frame "NDG interim cleaning without steam generator descaling" {
            w38 = "Express"
            w41 = w28
            w39 = "Standard"
            w40 = "Without_SG"
          }
          frame "Without drying phase strong eco without steam generator descaling" {
            w38 = "strong"
            w41 = w28
            w39 = "Eco"
            w40 = "Without_SG"
          }
          frame "Without drying phase strong eco with steam generator descaling" {
            w38 = "strong"
            w41 = w28
            w39 = "Eco"
            w40 = "With_SG"
          }
          frame "NDG strong with steam generator descaling" {
            w38 = "strong"
            w41 = w28
            w39 = "Standard"
            w40 = "With_SG"
          }
          frame "NDG strong without steam generator descaling" {
            w38 = "strong"
            w41 = w28
            w39 = "Standard"
            w40 = "Without_SG"
          }
          frame "Interim cleaning without steam generator descaling (auto dose)" {
            w38 = "Express"
            w41 = w28
            w39 = "Standard"
            w40 = "Without_SG"
          }
          frame "Light without steam generator descaling (Baking)" {
            w38 = "Light"
            w41 = w28
            w39 = "Standard"
            w40 = "Without_SG"
          }
          frame "Light with steam generator descaling (Baking)" {
            w38 = "Light"
            w41 = w28
            w39 = "Standard"
            w40 = "With_SG"
          }
          frame "Light eco without steam generator descaling (Baking)" {
            w38 = "Light"
            w41 = w28
            w39 = "Eco"
            w40 = "Without_SG"
          }
          frame "Light eco with steam generator descaling (Baking)" {
            w38 = "Light"
            w41 = w28
            w39 = "Eco"
            w40 = "With_SG"
          }
          frame "Light Express without steam generator descaling" {
            w38 = "Light"
            w41 = w28
            w39 = "Standard"
            w40 = "Without_SG"
          }
          frame "Light Express with steam generator descaling" {
            w38 = "Light"
            w41 = w28
            w39 = "Standard"
            w40 = "With_SG"
          }
          frame "Light without steam generator descaling (auto dose)" {
            w38 = "Light"
            w41 = w28
            w39 = "Standard"
            w40 = "Without_SG"
          }
          frame "Light with steam generator descaling (auto dose)" {
            w38 = "Light"
            w41 = w28
            w39 = "Standard"
            w40 = "With_SG"
          }
          frame "Rinse with steam generator descaling" {
            w38 = "Express"
            w41 = w28
            w39 = "Standard"
            w40 = "With_SG"
          }
          frame "Rinse without steam generator descaling (auto dose)" {
            w38 = "Express"
            w41 = w28
            w39 = "Standard"
            w40 = "Without_SG"
          }
          frame "Rinse without tabs" {
            w38 = "Express"
            w41 = w28
            w39 = "Standard"
            w40 = "Without_SG"
          }
          frame "Strong eco with steam generator descaling (auto dose)" {
            w38 = "Strong"
            w41 = w28
            w39 = "Eco"
            w40 = "With_SG"
          }
          frame "Strong eco without steam generator descaling (auto dose)" {
            w38 = "Strong"
            w41 = w28
            w39 = "Eco"
            w40 = "Without_SG"
          }
          frame "Strong with steam generator descaling (auto dose)" {
            w38 = "Strong"
            w41 = w28
            w39 = "Standard"
            w40 = "With_SG"
          }
          frame "Strong without steam generator descaling (auto dose)" {
            w38 = "Strong"
            w41 = w28
            w39 = "Standard"
            w40 = "Without_SG"
          }
          frame "Medium eco with steam generator descaling (auto dose)" {
            w38 = "Medium"
            w41 = w28
            w39 = "Eco"
            w40 = "With_SG"
          }
          frame "Medium eco without steam generator descaling (auto dose)" {
            w38 = "Medium"
            w41 = w28
            w39 = "Eco"
            w40 = "Without_SG"
          }
          frame "Medium with steam generator descaling (auto dose)" {
            w38 = "Medium"
            w41 = w28
            w39 = "Standard"
            w40 = "With_SG"
          }
          frame "Medium without steam generator descaling (auto dose)" {
            w38 = "Medium"
            w41 = w28
            w39 = "Standard"
            w40 = "Without_SG"
          }
          frame "Light eco with steam generator descaling (auto dose)" {
            w38 = "Light"
            w41 = w28
            w39 = "Eco"
            w40 = "With_SG"
          }
          frame "Light eco without steam generator descaling (auto dose)" {
            w38 = "Light"
            w41 = w28
            w39 = "Eco"
            w40 = "Without_SG"
          }
          frame "Without drying phase strong eco with steam generator descaling (auto dose)" {
            w38 = "Strong"
            w41 = w28
            w39 = "Eco"
            w40 = "With_SG"
          }
          frame "Without drying phase strong eco without steam generator descaling (auto dose)" {
            w38 = "Strong"
            w41 = w28
            w39 = "Eco"
            w40 = "Without_SG"
          }
          frame "Without drying phase strong with steam generator descaling (auto dose)" {
            w38 = "Strong"
            w41 = w28
            w39 = "Standard"
            w40 = "With_SG"
          }
          frame "Without drying phase strong without steam generator descaling (auto dose)" {
            w38 = "Strong"
            w41 = w28
            w39 = "Standard"
            w40 = "Without_SG"
          }
          frame "Without drying phase light with steam generator descaling (auto dose)" {
            w38 = "Light"
            w41 = w28
            w39 = "Standard"
            w40 = "With_SG"
          }
          frame "Without drying phase light without steam generator descaling (auto dose)" {
            w38 = "Light"
            w41 = w28
            w39 = "Standard"
            w40 = "Without_SG"
          }
          frame "Light Express with steam generator descaling (auto dose)" {
            w38 = "Light"
            w41 = w28
            w39 = "Standard"
            w40 = "With_SG"
          }
          frame "Light Express without steam generator descaling (auto dose)" {
            w38 = "Light"
            w41 = w28
            w39 = "Standard"
            w40 = "Without_SG"
          }
          frame "Medium Express" {
            w38 = "Medium"
            w41 = w28
            w39 = "Standard"
            w40 = "Without_SG"
          }
          frame "Thermo oxidative cleaning without steam generator descaling" {
            w38 = "Strong"
            w41 = w28
            w39 = "Standard"
            w40 = "Without_SG"
          }
          frame "Thermo oxidative cleaning with steam generator descaling" {
            w38 = "Strong"
            w41 = w28
            w39 = "Standard"
            w40 = "Without_SG"
          }
          frame "Test Reciepe: Strong eco without SG-descaling." {
            w38 = "Strong"
            w41 = w28
            w39 = "Eco"
            w40 = "Without_SG"
          }
        }
        w42 = w21
        w43 = "nicht Aborted"
      }
      frame "Aborted" {
        case (w37) {
          frame "False", Default {
            w38 = "Unknown"
            w41 = w37
            w39 = "Standard"
            w40 = "Without_SG"
          }
          frame "Emergency clean" {
            w38 = "Emergency clean"
            w41 = w37
            w39 = "Standard"
            w40 = "Without_SG"
          }
          frame "Light without steam generator descaling" {
            w38 = "Light"
            w41 = w37
            w39 = "Standard"
            w40 = "Without_SG"
          }
          frame "Light with steam generator descaling" {
            w38 = "Light"
            w41 = w37
            w39 = "Standard"
            w40 = "With_SG"
          }
          frame "Light eco without steam generator descaling" {
            w38 = "Light"
            w41 = w37
            w39 = "Eco"
            w40 = "Without_SG"
          }
          frame "Light eco with steam generator descaling" {
            w38 = "Light"
            w41 = w37
            w39 = "Eco"
            w40 = "With_SG"
          }
          frame "Medium without steam generator descaling" {
            w38 = "Medium"
            w41 = w37
            w39 = "Standard"
            w40 = "Without_SG"
          }
          frame "Medium with steam generator descaling" {
            w38 = "Medium"
            w41 = w37
            w39 = "Standard"
            w40 = "With_SG"
          }
          frame "Medium eco without steam generator descaling" {
            w38 = "Medium"
            w41 = w37
            w39 = "Eco"
            w40 = "Without_SG"
          }
          frame "Medium eco with steam generator descaling" {
            w38 = "Medium"
            w41 = w37
            w39 = "Eco"
            w40 = "With_SG"
          }
          frame "Strong without steam generator descaling" {
            w38 = "Strong"
            w41 = w37
            w39 = "Standard"
            w40 = "Without_SG"
          }
          frame "Strong with steam generator descaling" {
            w38 = "Strong"
            w41 = w37
            w39 = "Standard"
            w40 = "With_SG"
          }
          frame "Strong eco without steam generator descaling" {
            w38 = "Strong"
            w41 = w37
            w39 = "Eco"
            w40 = "Without_SG"
          }
          frame "Strong eco with steam generator descaling" {
            w38 = "Strong"
            w41 = w37
            w39 = "Eco"
            w40 = "With_SG"
          }
          frame "Interim cleaning without steam generator descaling" {
            w38 = "Express"
            w41 = w37
            w39 = "Standard"
            w40 = "Without_SG"
          }
          frame "Rinse without steam generator descaling" {
            w38 = "Rinse"
            w41 = w37
            w39 = "Standard"
            w40 = "Without_SG"
          }
          frame "Rinse with steam generator descaling (auto dose)" {
            w38 = "Rinse"
            w41 = w37
            w39 = "Standard"
            w40 = "With_SG"
          }
          frame "Rinse without tabs (auto dose)" {
            w38 = "Rinse without tab"
            w41 = w37
            w39 = "Standard"
            w40 = "Without_SG"
          }
          frame "Without drying phase Light without steam generator descaling" {
            w38 = "Light"
            w41 = w37
            w39 = "Standard"
            w40 = "Without_SG\n"
          }
          frame "Without drying phase Light with steam generator descaling" {
            w38 = "Light"
            w41 = w37
            w39 = "Standard"
            w40 = "With_SG"
          }
          frame "Without drying phase strong without steam generator descaling" {
            w38 = "strong"
            w41 = w37
            w39 = "Standard"
            w40 = "Without_SG"
          }
          frame "Without drying phase strong with steam generator descaling" {
            w38 = "strong"
            w41 = w37
            w39 = "Standard"
            w40 = "With_SG"
          }
          frame "NDG interim cleaning without steam generator descaling" {
            w38 = "Express"
            w41 = w37
            w39 = "Standard"
            w40 = "Without_SG"
          }
          frame "Without drying phase strong eco without steam generator descaling" {
            w38 = "strong"
            w41 = w37
            w39 = "Eco"
            w40 = "Without_SG"
          }
          frame "Without drying phase strong eco with steam generator descaling" {
            w38 = "strong"
            w41 = w37
            w39 = "Eco"
            w40 = "With_SG"
          }
          frame "NDG strong with steam generator descaling" {
            w38 = "strong"
            w41 = w37
            w39 = "Standard"
            w40 = "With_SG"
          }
          frame "NDG strong without steam generator descaling" {
            w38 = "strong"
            w41 = w37
            w39 = "Standard"
            w40 = "Without_SG"
          }
          frame "Interim cleaning without steam generator descaling (auto dose)" {
            w38 = "Express"
            w41 = w37
            w39 = "Standard"
            w40 = "Without_SG"
          }
          frame "Light without steam generator descaling (Baking)" {
            w38 = "Light"
            w41 = w37
            w39 = "Standard"
            w40 = "Without_SG"
          }
          frame "Light with steam generator descaling (Baking)" {
            w38 = "Light"
            w41 = w37
            w39 = "Standard"
            w40 = "With_SG"
          }
          frame "Light eco without steam generator descaling (Baking)" {
            w38 = "Light"
            w41 = w37
            w39 = "Eco"
            w40 = "Without_SG"
          }
          frame "Light eco with steam generator descaling (Baking)" {
            w38 = "Light"
            w41 = w37
            w39 = "Eco"
            w40 = "With_SG"
          }
          frame "Light Express without steam generator descaling" {
            w38 = "Light"
            w41 = w37
            w39 = "Standard"
            w40 = "Without_SG"
          }
          frame "Light Express with steam generator descaling" {
            w38 = "Light"
            w41 = w37
            w39 = "Standard"
            w40 = "With_SG"
          }
          frame "Light without steam generator descaling (auto dose)" {
            w38 = "Light"
            w41 = w37
            w39 = "Standard"
            w40 = "Without_SG"
          }
          frame "Light with steam generator descaling (auto dose)" {
            w38 = "Light"
            w41 = w37
            w39 = "Standard"
            w40 = "With_SG"
          }
          frame "Rinse with steam generator descaling" {
            w38 = "Express"
            w41 = w37
            w39 = "Standard"
            w40 = "With_SG"
          }
          frame "Rinse without steam generator descaling (auto dose)" {
            w38 = "Express"
            w41 = w37
            w39 = "Standard"
            w40 = "Without_SG"
          }
          frame "Rinse without tabs" {
            w38 = "Express"
            w41 = w37
            w39 = "Standard"
            w40 = "Without_SG"
          }
          frame "Strong eco with steam generator descaling (auto dose)" {
            w38 = "Strong"
            w41 = w37
            w39 = "Eco"
            w40 = "With_SG"
          }
          frame "Strong eco without steam generator descaling (auto dose)" {
            w38 = "Strong"
            w41 = w37
            w39 = "Eco"
            w40 = "Without_SG"
          }
          frame "Strong with steam generator descaling (auto dose)" {
            w38 = "Strong"
            w41 = w37
            w39 = "Standard"
            w40 = "With_SG"
          }
          frame "Strong without steam generator descaling (auto dose)" {
            w38 = "Strong"
            w41 = w37
            w39 = "Standard"
            w40 = "Without_SG"
          }
          frame "Medium eco with steam generator descaling (auto dose)" {
            w38 = "Medium"
            w41 = w37
            w39 = "Eco"
            w40 = "With_SG"
          }
          frame "Medium eco without steam generator descaling (auto dose)" {
            w38 = "Medium"
            w41 = w37
            w39 = "Eco"
            w40 = "Without_SG"
          }
          frame "Medium with steam generator descaling (auto dose)" {
            w38 = "Medium"
            w41 = w37
            w39 = "Standard"
            w40 = "With_SG"
          }
          frame "Medium without steam generator descaling (auto dose)" {
            w38 = "Medium"
            w41 = w37
            w39 = "Standard"
            w40 = "Without_SG"
          }
          frame "Light eco with steam generator descaling (auto dose)" {
            w38 = "Light"
            w41 = w37
            w39 = "Eco"
            w40 = "With_SG"
          }
          frame "Light eco without steam generator descaling (auto dose)" {
            w38 = "Light"
            w41 = w37
            w39 = "Eco"
            w40 = "Without_SG"
          }
          frame "Without drying phase strong eco with steam generator descaling (auto dose)" {
            w38 = "Strong"
            w41 = w37
            w39 = "Eco"
            w40 = "With_SG"
          }
          frame "Without drying phase strong eco without steam generator descaling (auto dose)" {
            w38 = "Strong"
            w41 = w37
            w39 = "Eco"
            w40 = "Without_SG"
          }
          frame "Without drying phase strong with steam generator descaling (auto dose)" {
            w38 = "Strong"
            w41 = w37
            w39 = "Standard"
            w40 = "With_SG"
          }
          frame "Without drying phase strong without steam generator descaling (auto dose)" {
            w38 = "Strong"
            w41 = w37
            w39 = "Standard"
            w40 = "Without_SG"
          }
          frame "Without drying phase light with steam generator descaling (auto dose)" {
            w38 = "Light"
            w41 = w37
            w39 = "Standard"
            w40 = "With_SG"
          }
          frame "Without drying phase light without steam generator descaling (auto dose)" {
            w38 = "Light"
            w41 = w37
            w39 = "Standard"
            w40 = "Without_SG"
          }
          frame "Light Express with steam generator descaling (auto dose)" {
            w38 = "Light"
            w41 = w37
            w39 = "Standard"
            w40 = "With_SG"
          }
          frame "Light Express without steam generator descaling (auto dose)" {
            w38 = "Light"
            w41 = w37
            w39 = "Standard"
            w40 = "Without_SG"
          }
          frame "Medium Express" {
            w38 = "Medium"
            w41 = w37
            w39 = "Standard"
            w40 = "Without_SG"
          }
          frame "Thermo oxidative cleaning without steam generator descaling" {
            w38 = "Strong"
            w41 = w37
            w39 = "Standard"
            w40 = "Without_SG"
          }
          frame "Thermo oxidative cleaning with steam generator descaling" {
            w38 = "Strong"
            w41 = w37
            w39 = "Standard"
            w40 = "Without_SG"
          }
          frame "Test Reciepe: Strong eco without SG-descaling." {
            w38 = "Strong"
            w41 = w37
            w39 = "Eco"
            w40 = "Without_SG"
          }
        }
        w42 = w21
        w43 = "Aborted"
      }
    }
    append w38 to w29
    append w41 to w30
    append w39 to w31
    append w40 to w32
    append w43 to w33
  }
  $"Aborted ?" <- w33
  call "Cleaning_meduim_Count.gviweb"(Aborted=w33, Eco ?=w31, With SG ?=w32, Kategorie ?=w29, Input error=w42) -> (Output=w44, Count Light aborted=w45, Count medium aborted=w46, Count Strong aborted=w47, Count Express aborted=w48, Count Rinse without tab aborted=w49, Count Rinse aborted=w50, Count medium nicht aborted eco without SG=w51, Count medium nicht aborted eco with SG=w52, Count medium nicht aborted standard without SG=w53, Count medium nicht aborted standard with SG=w54)
  $"Count Light aborted" <- w45
  call "Cleaning_Light_Count.gviweb"(Aborted=w33, Eco ?=w31, With SG ?=w32, Kategorie ?=w29, Input error=w44) -> (Output=w55, Count Light nicht aborted eco without SG=w56, Count Light nicht aborted eco with SG=w57, Count Light nicht aborted standard without SG=w58, Count Light nicht aborted standard with SG=w59)
  $"Count Light nicht aborted eco without SG" <- w56
  Build Array(w52, w54, w51, w53, w46) -> w60
  Build Cluster([2, 2, 2, 2, 2], w60) -> w61
  $medium <- w61
  $"Cleaning name" <- w30
  $"Count medium aborted" <- w46
  $"Count Light nicht aborted eco with SG" <- w57
  call "Cleaning_Strong_Count.gviweb"(Aborted=w33, Eco ?=w31, With SG ?=w32, Kategorie ?=w29, Input error=w55) -> (Output=w62, Count Strong nicht aborted eco without SG=w63, Count Strong nicht aborted eco with SG=w64, Count Strong nicht aborted standard without SG=w65, Count Strong nicht aborted standard with SG=w66)
  $"Count Strong nicht aborted eco without SG" <- w63
  $"Eco ?" <- w31
  $"Count Strong aborted" <- w47
  $"Count Light nicht aborted standard without SG" <- w58
  $"Count Strong nicht aborted eco with SG" <- w64
  $Timestamp <- w2
  Build Array(w57, w59, w56, w58, w45) -> w67
  Build Cluster([1, 1, 1, 1, 1], w67) -> w68
  $Light <- w68
  Build Array(w64, w66, w63, w65, w47) -> w69
  Build Cluster([3, 3, 3, 3, 3], w69) -> w70
  $Strong <- w70
  $"With SG ?" <- w32
  $"Count Express aborted" <- w48
  $"Count Light nicht aborted standard with SG" <- w59
  $"Count Strong nicht aborted standard without SG" <- w65
  $Cleaning <- s5
  call "Cleaning_Rinse_Count.gviweb"(Aborted=w33, Eco ?=w31, With SG ?=w32, Kategorie ?=w29, Input error=w62) -> (Output=w71, Count Rinse nicht aborted eco without SG=w72, Count Rinse nicht aborted eco with SG=w73, Count Rinse nicht aborted standard without SG=w74, Count Rinse nicht aborted standard with SG=w75)
  $"Count Rinse nicht aborted eco without SG" <- w72
  call "Cleaning_Rinse_Without_tab_Count.gviweb"(Aborted=w33, Eco ?=w31, With SG ?=w32, Kategorie ?=w29, Input error=w71) -> (Output=w76, Count Rinse without tab nicht aborted eco without SG=w77, Count Rinse without tab nicht aborted eco with SG=w78, Count Rinse without tab nicht aborted standard without SG=w79, Count Rinse without tab nicht aborted standard with SG=w80)
  $"Count Rinse without tabs nicht aborted eco without SG" <- w77
  $Kategorie <- w29
  $"Count Rinse without tab aborted" <- w49
  $"Count Strong nicht aborted standard with SG" <- w66
  $"Count Rinse nicht aborted eco with SG" <- w73
  $"Count Rinse without tabs nicht aborted eco with SG" <- w78
  Add(s6, s8, s9, s10, s7) -> w81
  Insert Into Array(inArray=u64[] [], new=s6, new=s8, new=s9, new=s10, new=s7, new=s12, new=w81) -> w82
  w83 = ["Cooking processes", "IPMs", "Cleanings", "Emergency cleans", "Service programmes", "Total days", "Total of all charges"]
  for {
    w84 = each element of w83
    w85 = each element of w82
    Number To Decimal String(number=w85) -> (decimal integer string=w87)
    w88 = cluster{"Process": string, "quantity": string} {all zero or empty}  # Cluster Constant
    Property Node(instance in=w88, "Process"=w84, "quantity"=w87) -> (instance out=w89)
    append w89 to w86
  }
  $Statistics <- w86
  $"Count Rinse aborted" <- w50
  $"Cooking process" <- s1
  $"Count Rinse nicht aborted standard without SG" <- w74
  $"Count Rinse without tabs nicht aborted standard without SG" <- w79
  $"Count medium nicht aborted eco without SG" <- w51
  $"all cleaning programms" <- s13
  $"Count Rinse nicht aborted standard with SG" <- w75
  $"Count Rinse without tabs nicht aborted standard with SG" <- w80
  $"Count medium nicht aborted eco with SG" <- w52
  $IPM <- s3
  Build Array(w73, w75, w72, w74, w50) -> w90
  Build Cluster([5, 5, 5, 5, 5], w90) -> w91
  $Rinse <- w91
  $"Count medium nicht aborted standard without SG" <- w53
  call "Cleaning_Express_Count.gviweb"(Aborted=w33, Eco ?=w31, With SG ?=w32, Kategorie ?=w29, Input error=w76) -> (Count Express nicht aborted eco without SG=w92, Count Express nicht aborted eco with SG=w93, Count Express nicht aborted standard without SG=w94, Count Express nicht aborted standard with SG=w95)
  $"Count Express nicht aborted eco without SG" <- w92
  $"Count medium nicht aborted standard with SG" <- w54
  $"Emergency Clean" <- s2
  $"Count Express nicht aborted eco with SG" <- w93
  $"Count Express nicht aborted standard without SG" <- w94
  $"Count Express nicht aborted standard with SG" <- w95
  Build Cluster(w2, s1) -> w96
  Build Cluster(w2, s3) -> w97
  Build Cluster(w2, s5) -> w98
  Build Cluster(w2, s2) -> w99
  Build Cluster(w2, s4) -> w100
  Build Array(w96, w97, w98, w99, w100) -> w101
  $Curve <- w101
  Build Array(w78, w80, w77, w79, w49) -> w102
  Build Cluster([6, 6, 6, 6, 6], w102) -> w103
  Build Array(w93, w95, w92, w94, w48) -> w104
  Build Cluster([4, 4, 4, 4, 4], w104) -> w105
  Build Array(w68, w61, w70, w105, w91, w103) -> w106
  $"Cleaning graphic" <- w106
  $Express <- w105
  $Output <- s14
  Insert Into Array(inArray=i32[] [], new=w45, new=w46, new=w47, new=w48, new=w50, new=w49) -> w107
  Insert Into Array(inArray=i32[] [], new=w57, new=w52, new=w64, new=w93, new=w73, new=w78) -> w108
  Insert Into Array(inArray=i32[] [], new=w59, new=w54, new=w66, new=w95, new=w75, new=w80) -> w109
  Insert Into Array(inArray=i32[] [], new=w56, new=w51, new=w63, new=w92, new=w72, new=w77) -> w110
  Insert Into Array(inArray=i32[] [], new=w58, new=w53, new=w65, new=w94, new=w75, new=w80) -> w111
  w112 = ["Light", "Medium", "Strong", "Express", "Rinse", "Rinse without tabs"]
  for {
    w113 = each element of w112
    w114 = each element of w107
    w115 = each element of w108
    w116 = each element of w109
    w117 = each element of w110
    w118 = each element of w111
    Property Node(instance in=T3 {all zero or empty}, "Cleaning name"=w113, "Eco with SG"=w115, "Standard with SG"=w116, "Eco without SG"=w117, "Standard without SG"=w118, "Aborted"=w114) -> (instance out=w120)
    append w120 to w119
  }
  $"Cleaning statistics" <- w119
  $"Rinse without tab" <- w103
  # eco without sg
  # standard without sg
  $"Error Output" <- w21
