vi "Get_Betriebsmodus.gviweb"   [G Web Development Software 22.3.0]
inputs:
  "Input all Parts": string[]
  "Error input": error
outputs:
  "Betriebsmodus": string[]
  "Output Error": error
uses:
  NI::G Core::Strings::Trim Whitespace.gvi
diagram:
  for {
    w1 = each element of $"Input all Parts"
    s1 = ""  # shift register
    s2 = string[] []  # shift register
    while (iteration -> i1) {
      case (i1) {
        frame 0 {
          Match Pattern(regular expression="\n", string=w1) -> (after substring=w2, before substring=w3)
        }
        frame 1, Default {
          Match Pattern(regular expression="\n", string=s1) -> (after substring=w2, before substring=w3)
        }
      }
      Insert Into Array(inArray=s2, new=w3) -> w4
      Is Empty String Or Path(string/path=w2) -> w5
      next s1 = w2
      next s2 = w4
      stop if w5
    }
    s3 = string[] []  # shift register
    for {
      w6 = each element of s2
      call "Trim Whitespace.gvi"(string=w6) -> (trimmed string=w7)
      String Length(string=w7) -> (length=w8)
      Is Less Or Equal(x=w8, y=1) -> w9
      case (w9) {
        frame True {
          w10 = s3
        }
        frame False {
          Match Pattern(regular expression="Mode", string=w7) -> (after substring=w11, match substring=w12)
          Match Pattern(regular expression="/", string=w11) -> (before substring=w13)
          case (w12) {
            frame "false", Default {
              w10 = s3
            }
            frame "Mode" {
              Insert Into Array(inArray=s3, new=w13) -> w10
            }
          }
        }
      }
      next s3 = w10
    }
  }
  $"Output Error" <- $"Error input"
  $Betriebsmodus <- s3
