vi "Get_Cleaning_Processes.gviweb"   [G Web Development Software 22.3.0]
inputs:
  "Charge infos input": T1[]
  "Error in": error
outputs:
  "Only cleaning": T1[]
  "Error out": error
  "First Process": string
types:
  T1 = cluster{"selected": bool, "Charge Nr.": string, "Process name": string, "Programme name": string, "Date and time": string, "Duration": string, "Status": string, "Average temp.": string, "counter Door closed": string, "counter Door opened": string}
diagram:
  s1 = T1[] []  # shift register
  for {
    w1 = each element of $"Charge infos input"
    Property Node(instance in=w1) -> ("Process name"=w2)
    case (w2) {
      frame "False", Default {
        w3 = s1
      }
      frame "Cleaning", "Cleaning programme with descaling process", "Cleaning programme without descaling process" {
        Insert Into Array(inArray=s1, new=w1) -> w3
      }
    }
    next s1 = w3
  }
  for (iteration -> i1) {
    w4 = each element of s1
    Property Node(instance in=w4) -> ("Charge Nr."=w6, instance out=w7)
    case (i1) {
      frame 0 {
        $"First Process" <- w6
        w8 = TRUE
      }
      frame 1, Default {
        w8 = FALSE
      }
    }
    Property Node(instance in=w7, "selected"=w8) -> (instance out=w9)
    append w9 to w5
  }
  $"Error out" <- $"Error in"
  $"Only cleaning" <- w5
