vi "Get_Details_selected_programme_iCC.gviweb"   [G Web Development Software 22.3.0]
inputs:
  "Get all charge": string[]
  "Charge Name": string[]
  "Error in": error
  "Charge infos": T3[]
outputs:
  "Details of the selected programme:": cluster{"Entry": string, "Information": string}[]
  "Error out": error
  "Curve singel": T2[]
  "Details of selected infos": T1[]
  "Curve double": cluster{"Element 1": f64[], "Element 2": i32[]}[]
  "Cleaning error found?": bool
panel controls:
  "String": string = " CLEAN STEP 001\t\t02.04.25 / 11:52:28"
panel indicators:
  "First charge": string
  "before substring": string
  "Output_5": string
  "Date and time": string[]
  "Mode Event": string[]
  "cabinet temp. target": string[]
  "cabinet temp.": string[]
  "core temp.": string[]
  "Einheit": string[]
  "core temp. target": string[]
  "Cabinet temp. array (1)": i32[]
  "Cabinet temp. target array (2)": i32[]
  "Core temp.target array (4)": i32[]
  "Core temp. array (3)": i32[]
  "timestamp": timestamp[]
  "Details in line": string[]
types:
  T1 = cluster{"Mode/ Event": string, "cabinet temp. target": string, "cabinet temp.": string, "core temp. target": string, "core temp.": string, "Date and time": string}
  T2 = cluster{"Element 1": timestamp[], "Element 2": i32[]}
  T3 = cluster{"selected": bool, "Charge Nr.": string, "Process name": string, "Programme name": string, "Date and time": string, "Duration": string, "Status": string, "Average temp.": string, "door closed": string, "door opened": string}
  T4 = cluster{"selected": bool, "Charge Nr.": string, "Process name": string, "Programme name": string, "Date and time": string, "Duration": string, "Status": string, "Average temp.": string}
uses:
  NI::G Core::Strings::Trim Whitespace.gvi
  NI::G Core::Strings::Search and Replace Pattern.gvi
  WebApp::Get_Duration_iCC.gviweb
  WebApp::Get_Process_and_Prgramme_name_iCC.gviweb
  WebApp::Get_Duration_If_Stop_Missing.gviweb
  WebApp::Calculate_duration_for_iCC.gviweb
diagram:
  Array Index(array=$"Charge Name") -> (out0[0]=w1)
  Match Pattern(regular expression="Charge Nr:", string=w1) -> (after substring=w2)
  call "Trim Whitespace.gvi"(string=w2) -> (trimmed string=w3)
  s1 = FALSE  # shift register
  for {
    w4 = each element of $"Get all charge"
    Match Pattern(regular expression="ERROR", string=w4) -> (match substring=w5)
    case (w5) {
      frame "False", Default {
        w6 = s1
      }
      frame "ERROR" {
        w6 = TRUE
      }
    }
    Decimal String To Number(string=w3) -> (number=w7)
    Match Pattern(regular expression="Ch-nr.", string=w4) -> (after substring=w8)
    Match Pattern(regular expression="<<", string=w8) -> (before substring=w9)
    call "Search and Replace Pattern.gvi"(string=w9, pattern=">>") -> (result string=w10)
    call "Trim Whitespace.gvi"(string=w10) -> (trimmed string=w11)
    Decimal String To Number(string=w11) -> (number=w12)
    Is Equal(x=w7, y=w12) -> w13
    next s1 = w6
    stop if w13
  }
  Insert Into Array(inArray=string[] [], new=w4) -> w14
  for {
    w15 = each element of $"Charge infos"
    Property Node(instance in=w15) -> ("Charge Nr."=w16, "Average temp."=w17)
    Decimal String To Number(string=w16) -> (number=w18)
    Decimal String To Number(string=w11) -> (number=w19)
    Is Equal(x=w19, y=w18) -> w20
    stop if w20
  }
  for (iteration -> i1) {
    w21 = each element of w14
    Match Pattern(regular expression="end", string=w21) -> (match substring=w22)
    case (w22) {
      frame "end" {
        w23 = "Completed"
      }
      frame "ABORT" {
        w23 = "Aborted"
      }
      frame "false", Default {
        w23 = "Aborted/ Canceled"
      }
    }
    Match Pattern(regular expression="Ch-nr.", string=w21) -> (after substring=w24)
    Match Pattern(regular expression="<<", string=w24) -> (before substring=w25)
    call "Search and Replace Pattern.gvi"(string=w25, pattern=">>") -> (result string=w26)
    call "Trim Whitespace.gvi"(string=w26) -> (trimmed string=w27)
    case (i1) {
      frame 0 {
        $"First charge" <- w27
        w28 = TRUE
      }
      frame 1, Default {
        w28 = FALSE
      }
    }
    call "Trim Whitespace.gvi"(string=w21) -> (trimmed string=w29)
    call "Get_Duration_iCC.gviweb"(Charge infos=w21, Error Input=$"Error in") -> (Start Date and Time=w30, Output Error=w31)
    call "Get_Process_and_Prgramme_name_iCC.gviweb"(Charge infos=w29, Input=w31) -> (Process name=w32, Programme name=w33, Output=w34)
    call "Trim Whitespace.gvi"(string=w30) -> (trimmed string=w35)
    call "Get_Duration_If_Stop_Missing.gviweb"(Charge infos=w21, Error input=w34) -> (Last date and time=w36, Error ouput=w37)
    call "Calculate_duration_for_iCC.gviweb"(Start date and time=w30, Last date and time=w36, Error input=w37) -> (Duration=w38, Output Error=w39)
    Property Node(instance in=T4 {all zero or empty}, "selected"=w28, "Charge Nr."=w27, "Process name"=w32, "Programme name"=w33, "Date and time"=w35, "Duration"=w38, "Status"=w23, "Average temp."=w17) -> (instance out=w40)
  }
  Property Node(instance in=w40) -> ("Charge Nr."=w41, "Process name"=w42, "Programme name"=w43, "Date and time"=w44, "Duration"=w45, "Status"=w46, "Average temp."=w47)
  Insert Into Array(inArray=string[] [], new=w41, new=w42, new=w43, new=w44, new=w45, new=w46, new=w47) -> w48
  w49 = ["Charge Nr.:", "Process name", "Programme name", "Start date and time:", "Duration: ", "Status:", "Average temperature:"]
  for {
    w50 = each element of w49
    w51 = each element of w48
    w53 = cluster{"Entry": string, "Information": string} {all zero or empty}
    Property Node(instance in=w53, "Entry"=w50, "Information"=w51) -> (instance out=w54)
    append w54 to w52
  }
  s2 = ""  # shift register
  s3 = string[] []  # shift register
  while (iteration -> i2) {
    Match Pattern(regular expression="Handshower", string=w21) -> (after substring=w55)
    case (i2) {
      frame 0 {
        Match Pattern(regular expression="\n", string=w55) -> (after substring=w56)
        w57 = s3
      }
      frame 1, Default {
        Match Pattern(regular expression=";", string=s2) -> (after substring=w56, before substring=w58, match substring=w59)
        Concatenate Strings(w59, w58) -> w60
        call "Trim Whitespace.gvi"(string=w60) -> (trimmed string=w61)
        Insert Into Array(inArray=s3, new=w61) -> w57
      }
    }
    Is Empty String Or Path(string/path=w56) -> w62
    next s2 = w56
    next s3 = w57
    stop if w62
  }
  $"Details in line" <- s3
  s4 = string[] []  # shift register
  for {
    w63 = each element of s3
    Match Pattern(regular expression=";", string=w63) -> (after substring=w64, match substring=w65)
    case (w65) {
      frame "False", Default {
        w66 = s4
      }
      frame ";" {
        Is Empty String Or Path(string/path=w64) -> w67
        case (w67) {
          frame False, Default {
            s5 = ""  # shift register
            s6 = s4  # shift register
            while (iteration -> i3) {
              $Output_5 <- w64
              case (i3) {
                frame 0 {
                  Match Pattern(regular expression="/", string=w64) -> (after substring=w70, before substring=w71, match substring=w72)
                  Match Pattern(regular expression="\n", string=w70) -> (after substring=w68, before substring=w73)
                  Match Pattern(regular expression="/", string=w73) -> (before substring=w74)
                  Concatenate Strings(w71, w72, w74) -> w75
                  Insert Into Array(inArray=s6, new=w75) -> w69
                  $"before substring" <- w68
                }
                frame 1, Default {
                  Match Pattern(regular expression="/", string=s5) -> (after substring=w76, before substring=w77, match substring=w78)
                  Match Pattern(regular expression="\n", string=w76) -> (after substring=w68, before substring=w79)
                  Match Pattern(regular expression="/", string=w79) -> (before substring=w80)
                  Concatenate Strings(w77, w78, w80) -> w81
                  Insert Into Array(inArray=s6, new=w81) -> w69
                }
              }
              Is Empty String Or Path(string/path=w68) -> w82
              next s5 = w68
              next s6 = w69
              stop if w82
            }
            w66 = s6
          }
          frame True {
            w66 = s4
          }
        }
      }
    }
    next s4 = w66
  }
  s7 = string[] []  # shift register
  s8 = ""  # shift register
  s9 = string[] []  # shift register
  s10 = ""  # shift register
  s11 = string[] []  # shift register
  s12 = "---"  # shift register
  s13 = string[] []  # shift register
  s14 = "---"  # shift register
  s15 = string[] []  # shift register
  s16 = "---"  # shift register
  s17 = string[] []  # shift register
  s18 = "---"  # shift register
  s19 = string[] []  # shift register
  s20 = "---"  # shift register
  for {
    w83 = each element of s4
    Match Pattern(regular expression="/", string=w83) -> (after substring=w84, before substring=w85, match substring=w86)
    Match Pattern(regular expression="\t", string=w85) -> (after substring=w87, before substring=w88)
    Scan From String(formatString="%s", inputString=w85, startLoc=0) -> (out0=w89)
    Decimal String To Number(string=w89) -> (number=w90)
    Is Greater Than 0(x=w90) -> w91
    case (w91) {
      frame False, Default {
        Match Pattern(regular expression="end", string=w88) -> (match substring=w94)
        case (w94) {
          frame "end" {
            Insert Into Array(inArray=s7, new=w94) -> w92
            call "Trim Whitespace.gvi"(string=w88) -> (trimmed string=w93)
          }
          frame "False", Default {
            call "Trim Whitespace.gvi"(string=w88) -> (trimmed string=w93)
            Insert Into Array(inArray=s7, new=w93) -> w92
          }
        }
      }
      frame True {
        call "Trim Whitespace.gvi"(string=s8) -> (trimmed string=w93)
        Insert Into Array(inArray=s7, new=w93) -> w92
      }
    }
    String Subset(length (rest)=9, string=w84) -> w95
    Concatenate Strings(w87, w86, w95) -> w96
    call "Trim Whitespace.gvi"(string=w96) -> (trimmed string=w97)
    String Length(string=w97) -> (length=w98)
    Is Greater(x=w98, y=25) -> w99
    case (w99) {
      frame True {
        Match Pattern(regular expression="/", string=w97) -> (after substring=w112, before substring=w113, match substring=w114)
        call "Trim Whitespace.gvi"(string=w113) -> (trimmed string=w115)
        String Subset(length (rest)=3, string=w115) -> w103
        Insert Into Array(inArray=s11, new=w103) -> w102
        call "Search and Replace Pattern.gvi"(string=w115, pattern="\t", replace all=FALSE) -> (result string=w116)
        call "Trim Whitespace.gvi"(string=w116) -> (trimmed string=w117)
        String Subset(length (rest)=4, offset (0)=3, string=w117) -> w118
        call "Search and Replace Pattern.gvi"(string=w118, pattern="\t", replace all=TRUE) -> (result string=w105)
        Insert Into Array(inArray=s13, new=w105) -> w104
        Reverse String(string=w113) -> (reversed=w119)
        String Subset(length (rest)=4, offset (0)=13, string=w119) -> w120
        Reverse String(string=w120) -> (reversed=w111)
        call "Trim Whitespace.gvi"(string=w111, location="both"(0)) -> (trimmed string=w121)
        call "Search and Replace Pattern.gvi"(string=w121, pattern="\t", replace all=TRUE) -> (result string=w122)
        Insert Into Array(inArray=s19, new=w122) -> w110
        call "Trim Whitespace.gvi"(string=w112) -> (trimmed string=w123)
        String Subset(length (rest)=2, offset (0)=9, string=w123) -> w109
        Insert Into Array(inArray=s17, new=w109) -> w108
        String Subset(length (rest)=4, offset (0)=9, string=w119) -> w124
        Reverse String(string=w124) -> (reversed=w107)
        call "Search and Replace Pattern.gvi"(string=w107, pattern="\t", replace all=TRUE) -> (result string=w125)
        Insert Into Array(inArray=s15, new=w125) -> w106
        String Subset(length (rest)=9, string=w112) -> w126
        String Subset(length (rest)=9, string=w119) -> w127
        Reverse String(string=w127) -> (reversed=w128)
        Concatenate Strings(w128, w114, w126) -> w129
        Insert Into Array(inArray=s9, new=w129) -> w100
        w101 = s10
      }
      frame False {
        Insert Into Array(inArray=s11, new=s12) -> w102
        Insert Into Array(inArray=s13, new=s14) -> w104
        Insert Into Array(inArray=s19, new=s20) -> w110
        Insert Into Array(inArray=s15, new=s16) -> w106
        Insert Into Array(inArray=s17, new=s18) -> w108
        String Length(string=w97) -> (length=w130)
        Is Greater(x=w130, y=13) -> w131
        case (w131) {
          frame True {
            Insert Into Array(inArray=s9, new=w97) -> w100
            w101 = w97
          }
          frame False {
            Insert Into Array(inArray=s9, new=w97) -> w100
            w101 = w97
          }
        }
        w103 = s12
        w105 = s14
        w107 = s16
        w109 = s18
        w111 = s20
      }
    }
    next s7 = w92
    next s8 = w93
    next s9 = w100
    next s10 = w101
    next s11 = w102
    next s12 = w103
    next s13 = w104
    next s14 = w105
    next s15 = w106
    next s16 = w107
    next s17 = w108
    next s18 = w109
    next s19 = w110
    next s20 = w111
  }
  s21 = string[] []  # shift register
  s22 = ""  # shift register
  for {
    w132 = each element of s9
    String Length(string=w132) -> (length=w133)
    Is Greater(x=w133, y=13) -> w134
    case (w134) {
      frame True {
        Insert Into Array(inArray=s21, new=w132) -> w135
        w136 = w132
      }
      frame False {
        Insert Into Array(inArray=s21, new=s22) -> w135
        w136 = s22
      }
    }
    next s21 = w135
    next s22 = w136
  }
  s23 = ""  # shift register
  s24 = u64[] []  # shift register
  s25 = 0  # shift register
  s26 = 0  # shift register
  for {
    w137 = each element of s21
    w138 = each element of s7
    w139 = each element of s11
    w140 = each element of s13
    w141 = each element of s19
    w142 = each element of s15
    w143 = each element of s17
    Is Empty String Or Path(string/path=w137) -> w145
    case (w145) {
      frame False, Default {
        Concatenate Strings(w137, " ", w143) -> w146
      }
      frame True {
        w146 = s23
      }
    }
    Decimal String To Number(string=w140) -> (number=w147)
    Number To Decimal String(number=w147) -> (decimal integer string=w148)
    case (w148) {
      frame "False", Default {
        Concatenate Strings(w148, " ", w143) -> w149
      }
      frame "0" {
        w149 = "---"
      }
    }
    Decimal String To Number(string=w141) -> (number=w150)
    Number To Decimal String(number=w150) -> (decimal integer string=w151)
    case (w151) {
      frame "False", Default {
        Concatenate Strings(w151, " ", w143) -> w152
      }
      frame "0" {
        w152 = "---"
      }
    }
    Decimal String To Number(string=w142) -> (number=w153)
    Number To Decimal String(number=w153) -> (decimal integer string=w154)
    case (w154) {
      frame "False", Default {
        Concatenate Strings(w154, " ", w143) -> w155
      }
      frame "0" {
        w155 = "---"
      }
    }
    call "Search and Replace Pattern.gvi"(string=w139, pattern="\t", replace all=TRUE) -> (result string=w156)
    Concatenate Strings(w156, " ", w143) -> w157
    Property Node(instance in=T1 {all zero or empty}, "Mode/ Event"=w138, "cabinet temp. target"=w157, "cabinet temp."=w149, "core temp. target"=w152, "core temp."=w155, "Date and time"=w146) -> (instance out=w158)
    case (w138) {
      frame "False", Default {
        Insert Into Array(inArray=s24, new=s25) -> w159
        w160 = s25
      }
      frame "Door opened" {
        Insert Into Array(inArray=s24, new=1) -> w159
        w160 = 1
      }
      frame "Door closed" {
        Insert Into Array(inArray=s24, new=0) -> w159
        w160 = 0
      }
    }
    Is Greater(x=w147, y=s26) -> w161
    case (w161) {
      frame False, Default {
        w162 = s26
      }
      frame True {
        w162 = w147
      }
    }
    append w158 to w144
    next s23 = w146
    next s24 = w159
    next s25 = w160
    next s26 = w162
  }
  s27 = i32[] []  # shift register
  s28 = i32[] []  # shift register
  s29 = i32[] []  # shift register
  s30 = i32[] []  # shift register
  s31 = timestamp[] []  # shift register
  s32 = i32[] []  # shift register
  s33 = f64[] []  # shift register
  for {
    w163 = each element of w144
    w164 = each element of s24
    Multiply(w164, s26) -> w165
    Property Node(instance in=w163) -> ("cabinet temp. target"=w166, "cabinet temp."=w167, "core temp. target"=w168, "core temp."=w169, "Date and time"=w170)
    Decimal String To Number(string=w168) -> (number=w171)
    Decimal String To Number(string=w169) -> (number=w172)
    Decimal String To Number(string=w167) -> (number=w173)
    Match Pattern(regular expression="/", string=w170) -> (after substring=w174)
    Decimal String To Number(string=w166) -> (number=w175)
    call "Search and Replace Pattern.gvi"(string=w170, pattern="-", replace all=TRUE) -> (result string=w176)
    call "Calculate_duration_for_iCC.gviweb"(Start date and time=w44, Last date and time=w176, Error input=w39) -> (TimeStamp=w177, Duration time=w178, Output Error=w179)
    Is Equal To 0(x=w173) -> w180
    case (w180) {
      frame True {
        w181 = s27
        w182 = s28
        w183 = s29
        w184 = s30
        w185 = s31
        w186 = s32
        w187 = w179
        w188 = s33
      }
      frame False {
        Insert Into Array(inArray=s27, new=w173) -> w181
        Insert Into Array(inArray=s28, new=w175) -> w182
        Insert Into Array(inArray=s31, new=w177) -> w185
        Insert Into Array(inArray=s33, new=w178) -> w188
        Insert Into Array(inArray=s30, new=w172) -> w184
        Insert Into Array(inArray=s29, new=w171) -> w183
        Insert Into Array(inArray=s32, new=w165) -> w186
        w187 = w179
      }
    }
    next s27 = w181
    next s28 = w182
    next s29 = w183
    next s30 = w184
    next s31 = w185
    next s32 = w186
    next s33 = w188
  }
  $"Error out" <- w187
  $"Cleaning error found?" <- s1
  Build Cluster(s31, s27) -> w189
  Build Cluster(s31, s28) -> w190
  Build Cluster(s31, s30) -> w191
  Build Cluster(s31, s29) -> w192
  Build Cluster(s31, s32) -> w193
  Build Array(w189, w190, w191, w192, w193) -> w194
  $"Curve singel" <- w194
  $timestamp <- s31
  $"Details of selected infos" <- w144
  $"Cabinet temp. array (1)" <- s27
  $"Cabinet temp. target array (2)" <- s28
  $"Mode Event" <- s7
  $"Date and time" <- s21
  $"Details of the selected programme:" <- w52
  $"Core temp. array (3)" <- s30
  $"cabinet temp. target" <- s11
  $"Core temp.target array (4)" <- s29
  $"cabinet temp." <- s13
  $Einheit <- s17
  Build Cluster(s33, s27) -> w195
  Build Cluster(s33, s28) -> w196
  Build Cluster(s33, s30) -> w197
  Build Cluster(s33, s29) -> w198
  Build Cluster(s33, s32) -> w199
  Build Array(w195, w196, w197, w198, w199) -> w200
  $"Curve double" <- w200
  $"core temp. target" <- s19
  $"core temp." <- s15
