vi "Get_Door_Cycles.gviweb"   [G Web Development Software 22.3.0]
inputs:
  "Input all Parts": string[]
  "Error input": error
outputs:
  "Count door closed": string[]
  "Output Error": error
  "Count door opened": string[]
uses:
  NI::G Core::Strings::Trim Whitespace.gvi
diagram:
  for {
    w1 = each element of $"Input all Parts"
    s1 = ""  # shift register
    s2 = string[] []  # shift register
    while (iteration -> i1) {
      case (i1) {
        frame 0 {
          Match Pattern(regular expression="\n", string=w1) -> (after substring=w4, before substring=w5)
        }
        frame 1, Default {
          Match Pattern(regular expression="\n", string=s1) -> (after substring=w4, before substring=w5)
        }
      }
      Insert Into Array(inArray=s2, new=w5) -> w6
      Is Empty String Or Path(string/path=w4) -> w7
      next s1 = w4
      next s2 = w6
      stop if w7
    }
    s3 = string[] []  # shift register
    for {
      w8 = each element of s2
      call "Trim Whitespace.gvi"(string=w8) -> (trimmed string=w9)
      String Length(string=w9) -> (length=w10)
      Is Less Or Equal(x=w10, y=1) -> w11
      case (w11) {
        frame True {
          w12 = s3
        }
        frame False {
          Match Pattern(regular expression="Door closed", string=w9) -> (match substring=w13)
          case (w13) {
            frame "false", Default {
              w12 = s3
            }
            frame "Door closed" {
              Insert Into Array(inArray=s3, new=w9) -> w12
            }
          }
        }
      }
      next s3 = w12
    }
    Array Size(array=s3) -> (size(s)=w14)
    Number To Decimal String(number=w14) -> (decimal integer string=w15)
    s4 = string[] []  # shift register
    for {
      w16 = each element of s2
      call "Trim Whitespace.gvi"(string=w16) -> (trimmed string=w17)
      String Length(string=w17) -> (length=w18)
      Is Less Or Equal(x=w18, y=1) -> w19
      case (w19) {
        frame True {
          w20 = s4
        }
        frame False {
          Match Pattern(regular expression="Door opened", string=w17) -> (match substring=w21)
          case (w21) {
            frame "false", Default {
              w20 = s4
            }
            frame "Door opened" {
              Insert Into Array(inArray=s4, new=w17) -> w20
            }
          }
        }
      }
      next s4 = w20
    }
    Array Size(array=s4) -> (size(s)=w22)
    Number To Decimal String(number=w22) -> (decimal integer string=w23)
    append w15 to w2
    append w23 to w3
  }
  $"Output Error" <- $"Error input"
  $"Count door closed" <- w2
  $"Count door opened" <- w3
