vi "Get_Restart_Power.gviweb"   [G Web Development Software 22.3.0]
inputs:
  "Input all Parts": string[]
  "Error input": error
outputs:
  "Restart Power": string[]
  "Output Error": error
panel controls:
  "Get all charge": string[]
panel indicators:
  "size(s)": i32
uses:
  NI::G Core::Strings::Trim Whitespace.gvi
diagram:
  for {
    w1 = each element of $"Input all Parts"
    s1 = ""  # shift register
    s2 = string[] []  # shift register
    while (iteration -> i1) {
      case (i1) {
        frame 0 {
          Match Pattern(regular expression="\n", string=w1) -> (after substring=w3, before substring=w4)
        }
        frame 1, Default {
          Match Pattern(regular expression="\n", string=s1) -> (after substring=w3, before substring=w4)
        }
      }
      Insert Into Array(inArray=s2, new=w4) -> w5
      Is Empty String Or Path(string/path=w3) -> w6
      next s1 = w3
      next s2 = w5
      stop if w6
    }
    s3 = string[] []  # shift register
    for {
      w7 = each element of s2
      call "Trim Whitespace.gvi"(string=w7) -> (trimmed string=w8)
      String Length(string=w8) -> (length=w9)
      Is Less Or Equal(x=w9, y=1) -> w10
      case (w10) {
        frame True {
          w11 = s3
        }
        frame False {
          Match Pattern(regular expression=";", string=w8) -> (match substring=w12)
          case (w12) {
            frame "False", Default {
              w11 = s3
            }
            frame ";" {
              Match Pattern(regular expression="restart (POWER)", string=w8) -> (after substring=w13, match substring=w14)
              case (w14) {
                frame "False", Default {
                  w11 = s3
                }
                frame "restart (POWER)" {
                  Insert Into Array(inArray=s3, new="YES") -> w11
                }
              }
            }
          }
        }
      }
      next s3 = w11
    }
    Sort 1D Array(array=s3) -> (sorted array=w15)
    s4 = ""  # shift register
    s5 = uninitialised  # shift register
    for (iteration -> i2) {
      w16 = each element of w15
      case (i2) {
        frame Default {
          Is Equal(x=w16, y=s4) -> w19
          case (w19) {
            frame False, Default {
              Build Array(s5, w16) -> w18
              w17 = w16
            }
            frame True {
              Concatenate Strings(w16, "+") -> w20
              Build Array(s5, w20) -> w18
              w17 = s4
            }
          }
        }
        frame 0 {
          Build Array(w16) -> w18
          w17 = w16
        }
      }
      next s4 = w17
      next s5 = w18
    }
    s6 = s5  # shift register
    s7 = string[] []  # shift register
    for {
      w21 = each element of s3
      s8 = s7  # shift register
      for {
        w22 = each element of s6
        Is Equal(x=w21, y=w22) -> w24
        case (w24) {
          frame False, Default {
            w25 = s8
            w26 = w22
          }
          frame True {
            Concatenate Strings(w22, "=") -> w26
            Build Array(s8, w21) -> w25
          }
        }
        append w26 to w23
        next s8 = w25
      }
      next s6 = w23
      next s7 = s8
    }
    Array Size(array=s7) -> (size(s)=w27)
    Is Greater(x=w27, y=1) -> w28
    case (w28) {
      frame False, Default {
        for {
          w29 = each element of s7
        }
      }
      frame True {
        s9 = ""  # shift register
        for {
          w30 = each element of s7
          Concatenate Strings(s9, "; ", w30) -> w31
          next s9 = w31
        }
        w29 = s9
      }
    }
    $"size(s)" <- w27
    append w29 to w2
  }
  $"Output Error" <- $"Error input"
  $"Restart Power" <- w2
