vi "Measurements_Txt_iCC.gviweb"   [G Web Development Software 22.3.0]
inputs:
  "Get all charge": string[]
  "Error in": error
outputs:
  "Charge infos Output": T1[]
  "First charge": string
  "Error out": error
types:
  T1 = cluster{"selected": bool, "Charge Nr.": string, "Process name": string, "Programme name": string, "Date and time": string, "Duration": string, "Status": string, "Average temp.": string, "Door closed": string, "Door opened": string}
uses:
  WebApp::Get_Average_Temp_iCC.gviweb
  WebApp::Get_Door_Cycles.gviweb
  NI::G Core::Strings::Search and Replace Pattern.gvi
  NI::G Core::Strings::Trim Whitespace.gvi
  WebApp::Get_Duration_iCC.gviweb
  WebApp::Get_Process_and_Prgramme_name_iCC.gviweb
  WebApp::Get_Duration_If_Stop_Missing.gviweb
  WebApp::Calculate_duration_for_iCC.gviweb
diagram:
  call "Get_Average_Temp_iCC.gviweb"(Input all Parts=$"Get all charge", Error input=$"Error in") -> (Average temp.=w1, Output Error=w2)
  call "Get_Door_Cycles.gviweb"(Input all Parts=$"Get all charge", Error input=w2) -> (Count door closed=w3, Count door opened=w4, Output Error=w5)
  for (iteration -> i1) {
    w6 = each element of $"Get all charge"
    w7 = each element of w1
    w8 = each element of w3
    w9 = each element of w4
    Match Pattern(regular expression="end", string=w6) -> (match substring=w11)
    case (w11) {
      frame "end" {
        w12 = "Completed"
      }
      frame "ABORT" {
        w12 = "Aborted"
      }
      frame "false", Default {
        w12 = "Aborted/ Canceled"
      }
    }
    Match Pattern(regular expression="Ch-nr.", string=w6) -> (after substring=w13)
    Match Pattern(regular expression="<<", string=w13) -> (before substring=w14)
    call "Search and Replace Pattern.gvi"(string=w14, pattern=">>") -> (result string=w15)
    call "Trim Whitespace.gvi"(string=w15) -> (trimmed string=w16)
    case (i1) {
      frame 0 {
        $"First charge" <- w16
        w17 = TRUE
      }
      frame 1, Default {
        w17 = FALSE
      }
    }
    call "Get_Duration_iCC.gviweb"(Charge infos=w6, Error Input=w5) -> (Start Date and Time=w18, Output Error=w19)
    call "Trim Whitespace.gvi"(string=w18) -> (trimmed string=w20)
    call "Trim Whitespace.gvi"(string=w6) -> (trimmed string=w21)
    call "Get_Process_and_Prgramme_name_iCC.gviweb"(Charge infos=w21, Input=w19) -> (Process name=w22, Programme name=w23, Output=w24)
    call "Get_Duration_If_Stop_Missing.gviweb"(Charge infos=w6, Error input=w24) -> (Last date and time=w25, Error ouput=w26)
    call "Calculate_duration_for_iCC.gviweb"(Start date and time=w18, Last date and time=w25, Error input=w26) -> (Duration=w27, Output Error=w28)
    Property Node(instance in=T1 {all zero or empty}, "selected"=w17, "Charge Nr."=w16, "Process name"=w22, "Programme name"=w23, "Date and time"=w20, "Duration"=w27, "Status"=w12, "Average temp."=w7, "Door closed"=w8, "Door opened"=w9) -> (instance out=w29)
    append w29 to w10
  }
  $"Charge infos Output" <- w10
  $"Error out" <- w28
