vi "Measurements_Txt_iCombiPro.gviweb"   [G Web Development Software 22.3.0]
inputs:
  "Get all charge": string[]
  "Error in": error
outputs:
  "Charge infos output": T2[]
  "Error out": error
  "First charge": string
  "Charge infos with OM": T2[]
panel indicators:
  "Charge infos": T1[]
types:
  T1 = cluster{"selected": bool, "Charge Nr.": string, "Process name": string, "Programme name": string, "Date and time": string, "Duration": string, "Status": string, "Average temp.": string}
  T2 = cluster{"selected": bool, "Charge Nr.": string, "Process name": string, "Programme name": string, "Date and time": string, "Duration": string, "Status": string, "Average temp.": string, "counter Door closed": string, "counter Door opened": string}
  T3 = cluster{"selected": bool, "Charge Nr.": string, "Process name": string, "Programme name": string, "Date and time": string, "Duration": string, "Status": string, "Average temp.": string, "counter Door closed/ opened": string, "Restart power": string}
uses:
  WebApp::Get_Average_Temp.gviweb
  WebApp::Get_Door_Cycles.gviweb
  WebApp::Get_Operation_Mode.gviweb
  WebApp::Get_Restart_Power.gviweb
  NI::G Core::Strings::Search and Replace Pattern.gvi
  NI::G Core::Strings::Trim Whitespace.gvi
  WebApp::Get_recipe_name_process_icombi_pro.gviweb
  WebApp::Get_Duration_If_Stop_Missing.gviweb
diagram:
  call "Get_Average_Temp.gviweb"(Input all Parts=$"Get all charge", Error input=$"Error in") -> (Average temp.=w1, Output Error=w2)
  call "Get_Door_Cycles.gviweb"(Input all Parts=$"Get all charge", Error input=w2) -> (Count door closed=w3, Count door opened=w4, Output Error=w5)
  call "Get_Operation_Mode.gviweb"(Input all Parts=$"Get all charge", Error input=w5) -> (Operating Mode=w6, Output Error=w7)
  call "Get_Restart_Power.gviweb"(Input all Parts=$"Get all charge", Error input=w7) -> (Restart Power=w8, Output Error=w9)
  for (iteration -> i1) {
    w10 = each element of $"Get all charge"
    w11 = each element of w1
    w12 = each element of w3
    w13 = each element of w4
    w14 = each element of w6
    w15 = each element of w8
    Concatenate Strings(w12, " / ", w13) -> w18
    Match Pattern(regular expression="Ch-nr.", string=w10) -> (after substring=w19)
    Match Pattern(regular expression="<<", string=w19) -> (before substring=w20)
    call "Search and Replace Pattern.gvi"(string=w20, pattern=">>") -> (result string=w21)
    call "Trim Whitespace.gvi"(string=w21) -> (trimmed string=w22)
    Match Pattern(regular expression="Progr.", string=w10) -> (after substring=w23)
    Match Pattern(regular expression=")", string=w23) -> (before substring=w24)
    Match Pattern(regular expression="(", string=w24) -> (after substring=w25)
    call "Trim Whitespace.gvi"(string=w25) -> (trimmed string=w26)
    Match Pattern(regular expression="Pr-GUID", string=w10) -> (after substring=w27)
    Match Pattern(regular expression="<<", string=w27) -> (before substring=w28)
    call "Search and Replace Pattern.gvi"(string=w28, pattern=">>") -> (result string=w29)
    call "Trim Whitespace.gvi"(string=w29) -> (trimmed string=w30)
    call "Get_recipe_name_process_icombi_pro.gviweb"(Programm Id=w26, GUID=w30, Input=w9) -> (Process name=w31, Programme name=w32, Output=w33)
    Match Pattern(regular expression="stop", string=w10) -> (after substring=w34)
    Match Pattern(regular expression=")", string=w34) -> (before substring=w35)
    Match Pattern(regular expression="(", string=w35) -> (after substring=w36)
    call "Trim Whitespace.gvi"(string=w36) -> (trimmed string=w37)
    Match Pattern(regular expression="end (", string=w10) -> (after substring=w38)
    Match Pattern(regular expression=")", string=w38) -> (after substring=w39, before substring=w40)
    call "Trim Whitespace.gvi"(string=w40) -> (trimmed string=w41)
    case (w37) {
      frame "RETURN" {
        w42 = "Completed"
      }
      frame "false", Default {
        case (w41) {
          frame "RETURN" {
            w42 = "Completed"
          }
          frame "ABORT" {
            w42 = "Cancelled/aborted"
          }
          frame "false", Default {
            w42 = "Selected only"
          }
        }
      }
      frame "ABORT" {
        w42 = "Cancelled/aborted"
      }
      frame "24H" {
        w42 = "Operation over 24H"
      }
    }
    case (w31) {
      frame "False", Default {
        w43 = w32
      }
      frame "Cooking process" {
        Is Empty String Or Path(string/path=w14) -> w44
        case (w44) {
          frame True {
            w43 = w32
          }
          frame False {
            Concatenate Strings(w32, " [", w14, " ]") -> w43
          }
        }
      }
    }
    case (i1) {
      frame 0 {
        $"First charge" <- w22
        w45 = TRUE
      }
      frame 1, Default {
        w45 = FALSE
      }
    }
    Match Pattern(regular expression=";", string=w39) -> (before substring=w46)
    call "Trim Whitespace.gvi"(string=w46) -> (trimmed string=w47)
    Is Empty String Or Path(string/path=w47) -> w48
    case (w48) {
      frame False, Default {
        w49 = w47
        w50 = w33
      }
      frame True {
        call "Get_Duration_If_Stop_Missing.gviweb"(Charge infos=w10, Error input=w33) -> (Duration=w49, Error ouput=w50)
      }
    }
    Match Pattern(regular expression="Time", string=w10) -> (after substring=w51)
    Match Pattern(regular expression="<<", string=w51) -> (before substring=w52)
    call "Search and Replace Pattern.gvi"(string=w52, pattern=">>") -> (result string=w53)
    call "Trim Whitespace.gvi"(string=w53) -> (trimmed string=w54)
    Property Node(instance in=T3 {all zero or empty}, "selected"=w45, "Charge Nr."=w22, "Process name"=w31, "Programme name"=w43, "Date and time"=w54, "Duration"=w49, "Status"=w42, "Average temp."=w11, "counter Door closed/ opened"=w18, "Restart power"=w15) -> (instance out=w55)
    Concatenate Strings(w12, "/  ", w13) -> w56
    Property Node(instance in=T3 {all zero or empty}, "selected"=w45, "Charge Nr."=w22, "Process name"=w31, "Programme name"=w32, "Date and time"=w54, "Duration"=w49, "Status"=w42, "Average temp."=w11, "counter Door closed/ opened"=w56, "Restart power"=w15) -> (instance out=w57)
    append w57 to w16
    append w55 to w17
  }
  $"Charge infos with OM" <- w17
  $"Charge infos output" <- w16
  $"Error out" <- w50
