vi "Measurements_Txt_iVario.gviweb"   [G Web Development Software 22.3.0]
inputs:
  "Get all charge": string[]
  "Error in": error
  "Device type": string
outputs:
  "Charge infos": T1[]
  "Error out": error
  "First charge": string
types:
  T1 = cluster{"selected": bool, "Charge Nr.": string, "Operating mode": string, "Programme name": string, "Date and time": string, "Duration": string, "Status": string, "Average temp.": string, "Device side": string, "HE actives": string, "IZC activ": string}
uses:
  WebApp::Get_Average_Temp.gviweb
  WebApp::Get_Operation_Mode.gviweb
  NI::G Core::Strings::Trim Whitespace.gvi
  NI::G Core::Strings::Search and Replace Pattern.gvi
  WebApp::Get_recipe_name_process_iVario.gviweb
  WebApp::Get_Duration_If_Stop_Missing.gviweb
diagram:
  call "Get_Average_Temp.gviweb"(Input all Parts=$"Get all charge", Error input=$"Error in") -> (Average temp.=w1, Output Error=w2)
  call "Get_Operation_Mode.gviweb"(Input all Parts=$"Get all charge", Error input=w2) -> (Operating Mode=w3, Output Error=w4)
  for (iteration -> i1) {
    w5 = each element of $"Get all charge"
    w6 = each element of w1
    w7 = each element of w3
    Match Pattern(regular expression="HE actives", string=w5) -> (after substring=w9)
    Match Pattern(regular expression="(", string=w9) -> (after substring=w10)
    Match Pattern(regular expression=")", string=w10) -> (before substring=w11)
    call "Trim Whitespace.gvi"(string=w11) -> (trimmed string=w12)
    Match Pattern(regular expression="stop", string=w5) -> (after substring=w13)
    Match Pattern(regular expression=")", string=w13) -> (before substring=w14)
    Match Pattern(regular expression="(", string=w14) -> (after substring=w15)
    call "Trim Whitespace.gvi"(string=w15) -> (trimmed string=w16)
    Match Pattern(regular expression="end", string=w5) -> (after substring=w17)
    Match Pattern(regular expression="(", string=w17) -> (before substring=w18)
    Match Pattern(regular expression=")", string=w18) -> (after substring=w19)
    call "Trim Whitespace.gvi"(string=w19) -> (trimmed string=w20)
    case (w16) {
      frame "RETURN" {
        w21 = "Selected only"
      }
      frame "24H" {
        w21 = "Operation over 24H"
      }
      frame "END" {
        w21 = "Completed"
      }
      frame "false", Default {
        case (w20) {
          frame "False", Default {
            w21 = "Selected only"
          }
          frame "RETURN" {
            w21 = "Completed"
          }
        }
      }
      frame "ABORT" {
        w21 = "Cancelled/aborted"
      }
    }
    Match Pattern(regular expression="Progr.", string=w5) -> (after substring=w22)
    Match Pattern(regular expression=")", string=w22) -> (before substring=w23)
    Match Pattern(regular expression="(", string=w23) -> (after substring=w24)
    call "Trim Whitespace.gvi"(string=w24) -> (trimmed string=w25)
    Match Pattern(regular expression="Pr-GUID", string=w5) -> (after substring=w26)
    Match Pattern(regular expression="<<", string=w26) -> (before substring=w27)
    call "Search and Replace Pattern.gvi"(string=w27, pattern=">>") -> (result string=w28)
    call "Trim Whitespace.gvi"(string=w28) -> (trimmed string=w29)
    call "Get_recipe_name_process_iVario.gviweb"(Programm Id=w25, GUID=w29, Input=w4) -> (Programme name=w30, Output=w31)
    case ($"Device type") {
      frame "False", Default {
        w32 = "NO"
      }
      frame "2-XS" {
        case (w12) {
          frame "False", Default {
            w32 = "YES"
          }
          frame "1;2;3;4", "5;6;7;8" {
            w32 = "NO"
          }
        }
      }
      frame "2-S" {
        case (w12) {
          frame "False", Default {
            w32 = "YES"
          }
          frame "1;2;3;4;5;6", "7;8;9;10;11;12" {
            w32 = "NO"
          }
        }
      }
      frame "L", "L P" {
        case (w12) {
          frame "False", Default {
            w32 = "YES"
          }
          frame "1;2;3;4;5;6;7;8;9;10;11;12" {
            w32 = "NO"
          }
        }
      }
      frame "XL", "XL P" {
        case (w12) {
          frame "False", Default {
            w32 = "YES"
          }
          frame "1;2;3;4;5;6;7;8;9;10;11;12;13;14;15;16;17;18" {
            w32 = "NO"
          }
        }
      }
    }
    Match Pattern(regular expression="Ch-nr.", string=w5) -> (after substring=w33)
    Match Pattern(regular expression="<<", string=w33) -> (before substring=w34)
    call "Search and Replace Pattern.gvi"(string=w34, pattern=">>") -> (result string=w35)
    call "Trim Whitespace.gvi"(string=w35) -> (trimmed string=w36)
    Match Pattern(regular expression=";", string=w19) -> (before substring=w37)
    call "Trim Whitespace.gvi"(string=w37) -> (trimmed string=w38)
    Is Empty String Or Path(string/path=w38) -> w39
    case (w39) {
      frame False, Default {
        w40 = w38
        w41 = w31
      }
      frame True {
        call "Get_Duration_If_Stop_Missing.gviweb"(Charge infos=w5, Error input=w31) -> (Duration=w40, Error ouput=w41)
      }
    }
    case (i1) {
      frame 0 {
        $"First charge" <- w36
        w42 = TRUE
      }
      frame 1, Default {
        w42 = FALSE
      }
    }
    Match Pattern(regular expression="Time", string=w5) -> (after substring=w43)
    Match Pattern(regular expression="<<", string=w43) -> (before substring=w44)
    call "Search and Replace Pattern.gvi"(string=w44, pattern=">>") -> (result string=w45)
    call "Trim Whitespace.gvi"(string=w45) -> (trimmed string=w46)
    Match Pattern(regular expression="Dev-Side", string=w5) -> (after substring=w47)
    Match Pattern(regular expression="<<", string=w47) -> (before substring=w48)
    call "Search and Replace Pattern.gvi"(string=w48, pattern=">>") -> (result string=w49)
    call "Trim Whitespace.gvi"(string=w49) -> (trimmed string=w50)
    Property Node(instance in=T1 {all zero or empty}, "selected"=w42, "Charge Nr."=w36, "Operating mode"=w7, "Programme name"=w30, "Date and time"=w46, "Duration"=w40, "Status"=w21, "Average temp."=w6, "Device side"=w50, "HE actives"=w12, "IZC activ"=w32) -> (instance out=w51)
    append w51 to w8
  }
  $"Charge infos" <- w8
  $"Error out" <- w41
