vi "Organize all recipes.gviweb"   [G Web Development Software 22.3.0]
inputs:
  "Charge infos": T1[]
  "Array Constant": string[]
  "array": f64[]
  "String Constant": string
  "Numeric Constant": u64
  "Error input": error
outputs:
  "Output": string[]
  "element {0}": timestamp[]
  "Cooking process": f64[]
  "IPM": f64[]
  "Cleaning": f64[]
  "Emergency Clean": f64[]
  "Service": f64[]
  "new element/subarray_2": u64
  "new element/subarray_4": u64
  "new element/subarray_5": u64
  "new element/subarray_6": u64
  "new element/subarray_3": u64
  "new element/subarray": u64
  "Output_2": error
types:
  T1 = cluster{"selected": bool, "Charge Nr.": string, "Process name": string, "Programme name": string, "Date and time": string, "Duration": string, "Status": string, "Average temp.": string}
uses:
  WebApp::Add_offset_time_txt.gviweb
diagram:
  s1 = $array  # shift register
  s2 = $array  # shift register
  s3 = $array  # shift register
  s4 = $array  # shift register
  s5 = $array  # shift register
  s6 = $"Numeric Constant"  # shift register
  s7 = $"Numeric Constant"  # shift register
  s8 = $"Numeric Constant"  # shift register
  s9 = $"Numeric Constant"  # shift register
  s10 = $"Numeric Constant"  # shift register
  s11 = $"String Constant"  # shift register
  s12 = $"Numeric Constant"  # shift register
  s13 = $"Array Constant"  # shift register
  for {
    w1 = each element of $"Charge infos"
    # s10: Emergency Clean
    # s6: Cooking Prozess
    # s8: IPM
    # s9: Cleaning
    Property Node(instance in=w1) -> ("Process name"=w3, "Programme name"=w4, "Date and time"=w5)
    call "Add_offset_time_txt.gviweb"(Start date and time=w5, Error input=$"Error input") -> (timestamp=w6, Output Error=w7)
    String Subset(length (rest)=10, string=w5) -> w8
    Is Equal(x=s11, y=w8) -> w9
    case (w9) {
      frame False, Default {
        Increment(x=s12) -> w10
      }
      frame True {
        w10 = s12
      }
    }
    # s7: Service
    case (w3) {
      frame "False", Default {
        Insert Into Array(inArray=s1, new=0) -> w11
        Insert Into Array(inArray=s3, new=0) -> w13
        Insert Into Array(inArray=s4, new=0) -> w14
        Insert Into Array(inArray=s5, new=0) -> w15
        Insert Into Array(inArray=s2, new=0) -> w12
        w16 = s6
        w17 = s7
        w18 = s8
        w19 = s9
        w20 = s10
        w21 = s13
      }
      frame "Service" {
        Insert Into Array(inArray=s1, new=0) -> w11
        Insert Into Array(inArray=s3, new=0) -> w13
        Insert Into Array(inArray=s4, new=1) -> w14
        Insert Into Array(inArray=s5, new=0) -> w15
        Insert Into Array(inArray=s2, new=0) -> w12
        Increment(x=s7) -> w17
        w16 = s6
        w18 = s8
        w19 = s9
        w20 = s10
        w21 = s13
      }
      frame "IPM" {
        Insert Into Array(inArray=s1, new=0) -> w11
        Insert Into Array(inArray=s3, new=1) -> w13
        Insert Into Array(inArray=s4, new=0) -> w14
        Insert Into Array(inArray=s5, new=0) -> w15
        Insert Into Array(inArray=s2, new=0) -> w12
        Increment(x=s8) -> w18
        w16 = s6
        w17 = s7
        w19 = s9
        w20 = s10
        w21 = s13
      }
      frame "Cleaning" {
        Insert Into Array(inArray=s1, new=0) -> w11
        Insert Into Array(inArray=s3, new=0) -> w13
        Insert Into Array(inArray=s4, new=0) -> w14
        case (w4) {
          frame "False", Default {
            Insert Into Array(inArray=s13, new=w4) -> w21
            Insert Into Array(inArray=s5, new=1) -> w15
            Insert Into Array(inArray=s2, new=0) -> w12
            Increment(x=s9) -> w19
            w20 = s10
          }
          frame "Emergency clean" {
            Insert Into Array(inArray=s13, new=w4) -> w21
            Insert Into Array(inArray=s5, new=0) -> w15
            Insert Into Array(inArray=s2, new=1) -> w12
            Increment(x=s10) -> w20
            w19 = s9
          }
        }
        w16 = s6
        w17 = s7
        w18 = s8
      }
      frame "Cooking process" {
        Insert Into Array(inArray=s1, new=1) -> w11
        Insert Into Array(inArray=s3, new=0) -> w13
        Insert Into Array(inArray=s4, new=0) -> w14
        Insert Into Array(inArray=s5, new=0) -> w15
        Insert Into Array(inArray=s2, new=0) -> w12
        Increment(x=s6) -> w16
        w17 = s7
        w18 = s8
        w19 = s9
        w20 = s10
        w21 = s13
      }
    }
    append w6 to w2
    next s1 = w11
    next s2 = w12
    next s3 = w13
    next s4 = w14
    next s5 = w15
    next s6 = w16
    next s7 = w17
    next s8 = w18
    next s9 = w19
    next s10 = w20
    next s11 = w8
    next s12 = w10
    next s13 = w21
  }
  $Output <- s13
  $"element {0}" <- w2
  $Output_2 <- w7
  $"Cooking process" <- s1
  $IPM <- s3
  $Cleaning <- s5
  $"Emergency Clean" <- s2
  $Service <- s4
  $"new element/subarray_2" <- s6
  $"new element/subarray_4" <- s8
  $"new element/subarray_5" <- s9
  $"new element/subarray_6" <- s10
  $"new element/subarray_3" <- s7
  $"new element/subarray" <- s12
