vi "Select_more_than_Cleaning_process.gviweb"   [G Web Development Software 22.3.0]
inputs:
  "Cleaning process old": T1[]
  "Cleaning process new": T1[]
  "Error input": error
outputs:
  "Infos output": T1[]
  "Error Output": error
  "Selected Charge Nr.": string
  "same reciepe name": bool
types:
  T1 = cluster{"Selected": bool, "Charge Nr.": string, "Process name": string, "Programme name": string, "Date and time ⌚": string, "Duration": string, "Status": string, "Average temp. (°C/°F)": string, "String": string, "String_2": string}
uses:
  NI::G Core::Strings::Search and Replace Pattern.gvi
diagram:
  s1 = bool[] []  # shift register
  for {
    w1 = each element of $"Cleaning process old"
    w2 = each element of $"Cleaning process new"
    Property Node(instance in=w2) -> ("Selected"=w4)
    case (w4) {
      frame False, Default {
        w5 = s1
        w6 = $"Error input"
      }
      frame True {
        Insert Into Array(inArray=s1, new=w4) -> w5
        w6 = $"Error input"
      }
    }
    append w1 to w3
    next s1 = w5
  }
  Array Size(array=s1) -> (size(s)=w7)
  Is Greater(x=w7, y=2) -> w8
  case (w8) {
    frame False, Default {
      w9 = $"Cleaning process new"
      w10 = w6
    }
    frame True {
      One Button Dialog(message="You cannot select more than two programmes!")
      for {
        w11 = each element of $"Cleaning process new"
        w12 = each element of w3
        Property Node(instance in=w12) -> ("Selected"=w13)
        Property Node(instance in=w11, "Selected"=w13) -> (instance out=w14)
        append w14 to w9
      }
      w10 = w6
    }
  }
  s2 = ""  # shift register
  for {
    w15 = each element of w9
    Property Node(instance in=w15) -> ("Selected"=w16, "Charge Nr."=w17)
    case (w16) {
      frame False, Default {
        w18 = s2
      }
      frame True {
        Concatenate Strings(s2, "; ", w17) -> w18
      }
    }
    next s2 = w18
  }
  call "Search and Replace Pattern.gvi"(string=s2, pattern="; ") -> (result string=w19)
  $"Selected Charge Nr." <- w19
  $"Error Output" <- w10
  $"Infos output" <- w9
  s3 = ""  # shift register
  s4 = FALSE  # shift register
  for {
    w20 = each element of w9
    Property Node(instance in=w20) -> ("Selected"=w21, "Programme name"=w22)
    case (w21) {
      frame False, Default {
        w23 = s3
        w24 = s4
      }
      frame True {
        Is Equal(x=s3, y=w22) -> w24
        w23 = w22
      }
    }
    next s3 = w23
    next s4 = w24
  }
  $"same reciepe name" <- s4
