vi "Sort_table.gviweb"   [G Web Development Software 22.3.0]
inputs:
  "Sort Process name": bool
  "Error Cluster input": error
  "Imput infos": T1[]
outputs:
  "Output infos": T2[]
  "Error Output": error
types:
  T1 = cluster{"Selected": bool, "Charge Nr.": string, "Process name": string, "Programme name": string, "Date and time ⌚": string, "Duration": string, "Status": string, "Average temp. (°C/°F)": string, "closed": string, "opened": string}
  T2 = cluster{"Selected": bool, "Charge Nr.": string, "Process name": string, "Programme name": string, "Date and time ⌚": string, "Duration": string, "Status": string, "Average temp. (°C/°F)": string, "String": string, "String_2": string}
diagram:
  for {
    w1 = each element of $"Imput infos"
    Property Node(instance in=w1, "Selected"=FALSE) -> ("Charge Nr."=w3, "Process name"=w4, instance out=w5)
    Property Node(instance in=w5, "Process name"=w3, "Charge Nr."=w4) -> (instance out=w6)
    append w6 to w2
  }
  Sort 1D Array(array=w2) -> (sorted array=w7)
  case ($"Sort Process name") {
    frame True {
      w8 = w7
    }
    frame False {
      Reverse 1D Array(array=w7) -> (reversed array=w8)
    }
  }
  for {
    w9 = each element of w8
    Property Node(instance in=w9) -> ("Charge Nr."=w11, "Process name"=w12, instance out=w13)
    Property Node(instance in=w13, "Process name"=w11, "Charge Nr."=w12) -> (instance out=w14)
    append w14 to w10
  }
  $"Output infos" <- w10
  $"Error Output" <- $"Error Cluster input"
