vi "Specifications_txt.gviweb"   [G Web Development Software 22.3.0]
inputs:
  "Get all charge": string[]
  "Error input": error
outputs:
  "Error Output": error
  "General information": cluster{"Entry": string, "Information": string}[]
  "Device Type": string
uses:
  NI::G Core::Strings::Search and Replace Pattern.gvi
  NI::G Core::Strings::Trim Whitespace.gvi
diagram:
  s1 = string[] []  # shift register
  for {
    w1 = each element of $"Get all charge"
    Is Empty String Or Path(string/path=w1) -> w2
    case (w2) {
      frame True {
        w3 = s1
      }
      frame False {
        Insert Into Array(inArray=s1, new=w1) -> w3
      }
    }
    next s1 = w3
  }
  Array Subset(array=s1, index0=0, length0=1) -> w4
  for {
    w5 = each element of w4
    Match Pattern(regular expression="Version", string=w5) -> (after substring=w6)
    Match Pattern(regular expression="<<", string=w6) -> (before substring=w7)
    call "Search and Replace Pattern.gvi"(string=w7, pattern=">>") -> (result string=w8)
    call "Trim Whitespace.gvi"(string=w8) -> (trimmed string=w9)
    Match Pattern(regular expression="Time", string=w5) -> (after substring=w10)
    Match Pattern(regular expression="<<", string=w10) -> (before substring=w11)
    call "Search and Replace Pattern.gvi"(string=w11, pattern=">>") -> (result string=w12)
    call "Trim Whitespace.gvi"(string=w12) -> (trimmed string=w13)
    Match Pattern(regular expression="Dev-Typ", string=w5) -> (after substring=w14)
    Match Pattern(regular expression="<<", string=w14) -> (before substring=w15)
    call "Search and Replace Pattern.gvi"(string=w15, pattern=">>") -> (result string=w16)
    call "Trim Whitespace.gvi"(string=w16) -> (trimmed string=w17)
    case (w17) {
      frame "False", Default {
        w18 = w17
      }
      frame "623" {
        w18 = "XS Elektro"
      }
    }
    Match Pattern(regular expression="S/N", string=w5) -> (after substring=w19)
    Match Pattern(regular expression="<<", string=w19) -> (before substring=w20)
    call "Search and Replace Pattern.gvi"(string=w20, pattern=">>") -> (result string=w21)
    call "Trim Whitespace.gvi"(string=w21) -> (trimmed string=w22)
  }
  $"Device Type" <- w18
  Array Size(array=s1) -> (size(s)=w23)
  Decrement(x=w23) -> w24
  Array Subset(array=s1, index0=w24, length0=1) -> w25
  for {
    w26 = each element of w25
    Match Pattern(regular expression="Version", string=w26) -> (after substring=w27)
    Match Pattern(regular expression="<<", string=w27) -> (before substring=w28)
    call "Search and Replace Pattern.gvi"(string=w28, pattern=">>") -> (result string=w29)
    call "Trim Whitespace.gvi"(string=w29) -> (trimmed string=w30)
    Match Pattern(regular expression="Time", string=w26) -> (after substring=w31)
    Match Pattern(regular expression="<<", string=w31) -> (before substring=w32)
    call "Search and Replace Pattern.gvi"(string=w32, pattern=">>") -> (result string=w33)
    call "Trim Whitespace.gvi"(string=w33) -> (trimmed string=w34)
  }
  Concatenate Strings(w13, " / ", w34) -> w35
  for {
    w36 = each element of s1
    Match Pattern(regular expression="Version", string=w36) -> (after substring=w37)
    Match Pattern(regular expression="<<", string=w37) -> (before substring=w38)
    call "Search and Replace Pattern.gvi"(string=w38, pattern=">>") -> (result string=w39)
    call "Trim Whitespace.gvi"(string=w39) -> (trimmed string=w40)
    Match Pattern(regular expression="Ch-nr.", string=w36) -> (after substring=w41)
    Match Pattern(regular expression="<<", string=w41) -> (before substring=w42)
    call "Search and Replace Pattern.gvi"(string=w42, pattern=">>") -> (result string=w43)
    call "Trim Whitespace.gvi"(string=w43) -> (trimmed string=w44)
    Is Equal(x=w9, y=w40) -> w45
    case (w45) {
      frame False, Default {
        w46 = w40
        w47 = TRUE
        w48 = w44
        w49 = " ( From charge Nr. "
        w50 = ")."
      }
      frame True {
        w46 = w9
        w47 = FALSE
        w48 = ""
        w49 = ""
        w50 = ""
      }
    }
    stop if w47
  }
  Concatenate Strings(w46, w49, w48, w50) -> w51
  call "Trim Whitespace.gvi"(string=w51) -> (trimmed string=w52)
  Concatenate Strings("[", w9, "]", " / ", "[", w52, "]") -> w53
  Insert Into Array(inArray=string[] [], new=w18, new=w22, new=w53, new=w35) -> w54
  w55 = ["Device type", "Serial number", "Software versions (from/till)", "Timeline (from/till)"]
  for {
    w56 = each element of w55
    w57 = each element of w54
    w59 = cluster{"Entry": string, "Information": string} {all zero or empty}
    Property Node(instance in=w59, "Entry"=w56, "Information"=w57) -> (instance out=w60)
    append w60 to w58
  }
  $"General information" <- w58
  $"Error Output" <- $"Error input"
