vi "Strong_Cleaning_Type_Counter.gviweb"   [G Web Development Software 22.3.0]
inputs:
  "adapted array": string[]
  "Cleaning naming": string = "Strong"
  "Error Input": error
outputs:
  "Couter standard with SG descaling": i32
  "Couter standard without SG descaling": i32
  "Couter after enmergency": i32
  "Couter eco without SG descaling": i32
  "Couter eco with SG descaling": i32
  "Output": error
diagram:
  s1 = ""(0)  # shift register
  s2 = ""(0)  # shift register
  s3 = ""(0)  # shift register
  s4 = ""(0)  # shift register
  s5 = ""(0)  # shift register
  for {
    w1 = each element of $"adapted array"
    Match Pattern(regular expression=$"Cleaning naming", string=w1) -> (match substring=w2)
    case (w2) {
      frame "False", Default {
        w3 = s1
        w4 = s2
        w5 = s3
        w6 = s4
        w7 = s5
      }
      frame "Strong" {
        Match Pattern(regular expression="eco", string=w1) -> (match substring=w8)
        case (w8) {
          frame "False", Default {
            Match Pattern(regular expression="with steam generator descaling", string=w1) -> (match substring=w9)
            case (w9) {
              frame "False", Default {
                Match Pattern(regular expression="after Emergency", string=w1) -> (match substring=w10)
                case (w10) {
                  frame "False", Default {
                    Increment(x=s5) -> w7
                    w5 = s3
                  }
                  frame "after Emergency" {
                    Increment(x=s3) -> w5
                    w7 = s5
                  }
                }
                w6 = s4
              }
              frame "with steam generator descaling" {
                Match Pattern(regular expression="after Emergency", string=w1) -> (match substring=w11)
                case (w11) {
                  frame "after Emergency" {
                    Increment(x=s3) -> w5
                    w6 = s4
                  }
                  frame "False", Default {
                    w5 = s3
                    w6 = s4
                  }
                }
                w7 = s5
              }
            }
            w3 = s1
            w4 = s2
          }
          frame "eco" {
            Match Pattern(regular expression="with steam generator descaling", string=w1) -> (match substring=w12)
            case (w12) {
              frame "False", Default {
                Match Pattern(regular expression="after Emergency", string=w1) -> (match substring=w13)
                case (w13) {
                  frame "False", Default {
                    Increment(x=s2) -> w4
                    w5 = s3
                  }
                  frame "after Emergency" {
                    Increment(x=s3) -> w5
                    w4 = s2
                  }
                }
                w3 = s1
              }
              frame "with steam generator descaling" {
                Match Pattern(regular expression="after Emergency", string=w1) -> (match substring=w14)
                case (w14) {
                  frame "after Emergency" {
                    Increment(x=s3) -> w5
                    w3 = s1
                  }
                  frame "False", Default {
                    w5 = s3
                    w3 = s1
                  }
                }
                w4 = s2
              }
            }
            w6 = s4
            w7 = s5
          }
        }
      }
    }
    next s1 = w3
    next s2 = w4
    next s3 = w5
    next s4 = w6
    next s5 = w7
  }
  $Output <- $"Error Input"
  $"Couter standard with SG descaling" <- s5
  $"Couter standard without SG descaling" <- s4
  $"Couter after enmergency" <- s3
  $"Couter eco without SG descaling" <- s2
  $"Couter eco with SG descaling" <- s1
