vi "iCombi-Classic.gviweb"   [G Web Development Software 22.3.0]
panel controls:
  "Analyse": bool  # Press the button “Analyse” and select a service report xml file.
  "icombi pro xml": i32 = 1
  "common_icombi_classic": T4[]
  "i Combi Classic txt": i32
  "Press the button to display details:": bool
  "Engine Link": string = "index.html"
  "Sort Process name": bool
  "Press the button to display the graphic of the two selected cleaning processes": bool
  "Default View": bool = TRUE
  "common_icombi_pro_2": T9[]
panel indicators:
  "common": T1[]
  "Graph Display": T2[]
  "Specifications": T3
  "URL-Grafik": string
  "Specifications:": T5[]
  "Details of the selected programme:": cluster{"Information": string, "Detail": string}[]
  "Programme details": T6[]
  "Graph Display_txt": T7[]
  "Curve": T2[]
  "General statistics:": cluster{"Process": string, "quantity": string}[]
  "Cleaning graphic:": cluster{"Element 1": f64[], "Element 2": f64[]}[]
  "Cleaning statistics:": T8[]
  "URL-cleaming_graphic": string
  "Max temperature (C°/°F):": f64
  "Average temperature (C°/°F):": f64
  "Please wait...": f64
  "Details of the programme:": cluster{"Information": string, "Detail": string}[]
  "Programme details_2": T1[]
  "Cleaning process table": T4[]
  "Graph Display multiple": cluster{"Element 1": f64[], "Element 2": i32[]}[]
  "same programme type ?": bool
  "banner": string
  "HACCP File Content:": string
  "Cleaning error found?": bool
types:
  T1 = cluster{"Mode/Event": string, "Cooking cabinet temp.": string, "Core probe Setpoint temp.": string, "Core sensor actual temp.": string, "Date and Time ⌚": string}
  T2 = cluster{"Element 1": timestamp[], "Element 2": f64[]}
  T3 = cluster{"Device type:": string, "Serial number:": string, "Software version:": string, "Start date:": string, "Charge number:": string, "Prozess-Typ:": string, "Cooking programme name:": string, "Energy consumption:": string}
  T4 = cluster{"Selected": bool, "Charge Nr.": string, "Process name": string, "Programme name": string, "Start time ⌚": string, "Duration": string, "Status": string, "Average temp. (°C/°F)": string, "Count Door closed": string, "Count Door opened": string}
  T5 = cluster{"Information": string, "Details": string}
  T6 = cluster{"Mode/Event": string, "Cabinet temp. target (°C/ °F)": string, "Cabinet temp. (°C/ °F)": string, "Core temp. target (°C/ °F)": string, "Core temp. (°C/ °F)": string, "Date and Time ⌚": string}
  T7 = cluster{"Element 1": timestamp[], "Element 2": i32[]}
  T8 = cluster{"Cleaning name": string, "With descaling process": f64, "Without descaling process": f64, "Aborted cleaning": f64}
  T9 = cluster{"Selected": bool, "Charge Nr.": string, "Process name": string, "Programme name": string, "Date and time ⌚": string, "Duration": string, "Status": string, "Average temp. (°C/°F)": string, "String": string, "String_2": string}
  T10 = cluster{"Device type:": string, "Serial number:": string, "Software version:": string, "Start date:": string, "Charge number:": string, "Prozess-Typ:": string, "Cooking programme name": string, "Energy consumption:": string}
  T11 = cluster{"selected": bool, "Charge Nr.": string, "Process name": string, "Programme name": string, "Date and time": string, "Duration": string, "Status": string, "Average temp.": string, "Door closed": string, "Door opened": string}
  T12 = cluster{"Cleaning name": string, "Without descaling process": f64, "With descaling process": f64, "Aborted cleaning": f64}
  T13 = cluster{"Mode/Event": string, "Cabinet temp. target": string, "Cabinet temp.": string, "Core temp. target": string, "Core temp.": string, "Date and Time ⌚": string}
uses:
  FileTasks::Read File Text.gvi
  WebApp::Check_content_iCC.gviweb
  WebApp::Read_XML_Part.gviweb
  WebApp::Specifications_haccp.gviweb
  WebApp::Get_All_Part_Txt.gviweb
  WebApp::Specification_iCC.gviweb
  WebApp::Add_Parts.gviweb
  WebApp::Measurements.gviweb
  WebApp::Measurements_Txt_iCC.gviweb
  WebApp::Get_Cleaning_Processes.gviweb
  WebApp::Display_all_programm_in_graph_iCC.gviweb
  ControlExtensions::Data Grid - String Column - Create Background Color Style.gvi
  WebApp::Get_Details_selected_programme_iCC.gviweb
  WebApp::Display_Details.gviweb
  WebApp::Sort_table.gviweb
  WebApp::Select_more_than_Cleaning_process.gviweb
diagram:
  w1 = "Init"  # State
  s1 = w1  # shift register
  s2 = ""  # shift register
  s3 = ""  # shift register
  s4 = ""  # shift register
  s5 = T10 {all zero or empty}  # shift register
  s6 = T11[] []  # shift register
  s7 = string[] []  # shift register
  s8 = ""  # shift register
  while {
    # s4: Energieverbrauch
    # s3: Start time & date
    # s5: Specifications
    # s2: Inhalt txt/XML
    # s6: General information txt
    # s7: Selected Charge nr
    case (s1) {
      frame "Init", Default {
        w11 = "Wait For Interaction"  # State
        Property Node(instance in=reference to "Please wait...", "Visible"=FALSE, error in=no error) -> (error out=w12, instance out=w13)
        Close Reference(error in=w12, reference=w13) -> (error out=w14)
        Property Node(instance in=reference to "common", "Visible"=FALSE, error in=w14) -> (error out=w15, instance out=w16)
        Close Reference(error in=w15, reference=w16) -> (error out=w17)
        Property Node(instance in=reference to "Specifications", "Visible"=FALSE, error in=w17) -> (error out=w18, instance out=w19)
        Close Reference(error in=w18, reference=w19) -> (error out=w20)
        Property Node(instance in=reference to "icombi pro xml", "Visible"=FALSE, error in=w20) -> (error out=w21, instance out=w22)
        Close Reference(error in=w21, reference=w22) -> (error out=w23)
        Property Node(instance in=reference to "i Combi Classic txt", "Visible"=TRUE, error in=w23) -> (error out=w24, instance out=w25)
        Close Reference(error in=w24, reference=w25) -> (error out=w26)
        Property Node(instance in=reference to "Press the button to display details:", "Disabled"=TRUE, error in=w26) -> (error out=w27, instance out=w28)
        Close Reference(error in=w27, reference=w28) -> (error out=w29)
        Property Node(instance in=reference to "Sort Process name", "Disabled"=TRUE, error in=w29) -> (error out=w30, instance out=w31)
        Close Reference(error in=w30, reference=w31) -> (error out=w32)
        Property Node(instance in=reference to "Default View", "Disabled"=TRUE, error in=w32) -> (error out=w33, instance out=w34)
        Close Reference(error in=w33, reference=w34) -> (error out=w2)
        $"URL-Grafik" <- "Rational_logo.jpg"
        $"URL-cleaming_graphic" <- "Legende_iCC_Cleanings.JPG"
        w3 = w11
        w4 = s2
        w5 = s3
        w6 = s4
        w7 = s5
        w8 = s6
        w9 = s7
        w10 = s8
      }
      frame "Read XML File" {
        call "Read File Text.gvi"(allowed file types=[".txt"], error in=no error) -> (file content=w35, file name=w36, error out=w37)
        Concatenate Strings(w35, ";") -> w4
        Match Pattern(regular expression=".txt", string=w36) -> (match substring=w38)
        case (w38) {
          frame ".txt" {
            call "Check_content_iCC.gviweb"(Inhalt Haccp=w35, Error input=w37) -> (HACCP File Content=w39, i Combi Classic?=w40, Error Output=w41)
            case (w40) {
              frame False, Default {
                w2 = w41
                w3 = "Wait For Interaction"
              }
              frame True {
                w42 = "Specifications TXT"  # State
                Property Node(instance in=reference to "i Combi Classic txt", "Visible"=TRUE, error in=w41) -> (error out=w43, instance out=w44)
                Close Reference(error in=w43, reference=w44) -> (error out=w45)
                Property Node(instance in=reference to "icombi pro xml", "Visible"=FALSE, error in=w45) -> (error out=w46, instance out=w47)
                Close Reference(error in=w46, reference=w47) -> (error out=w48)
                Property Node(instance in=reference to "Specifications:", "Value"=T5[] [], error in=w48) -> (error out=w49, instance out=w50)
                Close Reference(error in=w49, reference=w50) -> (error out=w51)
                Property Node(instance in=reference to "common_icombi_classic", "Value"=T11[] [], error in=w51) -> (error out=w52, instance out=w53)
                Close Reference(error in=w52, reference=w53) -> (error out=w2)
                w3 = w42
              }
            }
          }
          frame "False", Default {
            case (w38) {
              frame "" {
                w54 = "Wait For Interaction"  # State
                w39 = ""
                w2 = w37
                w3 = w54
              }
              frame "False", Default {
                w55 = "Wait For Interaction"  # State
                call "Check_content_iCC.gviweb"(Inhalt Haccp=w35, Error input=w37) -> (HACCP File Content=w39, Error Output=w2)
                w3 = w55
              }
            }
          }
        }
        $"HACCP File Content:" <- w39
        w5 = s3
        w6 = s4
        w7 = s5
        w8 = s6
        w9 = s7
        w10 = s8
      }
      frame "Specifications XML" {
        w56 = "Get Events from XML"  # State
        Property Node(instance in=reference to "Details of the programme:", "Visible"=FALSE, error in=no error) -> (error out=w57, instance out=w58)
        Close Reference(error in=w57, reference=w58) -> (error out=w59)
        Property Node(instance in=reference to "Programme details_2", "Visible"=FALSE, error in=w59) -> (error out=w60, instance out=w61)
        Close Reference(error in=w60, reference=w61) -> (error out=w62)
        call "Read_XML_Part.gviweb"(Input XML=s2, Start XML Part="<_1>", End XML Part="</_1>", Error in=w62) -> (Output XML array=w63, Error out=w64)
        call "Specifications_haccp.gviweb"(Output XML array=w63, Energy consumption:=s4, Error in=w64) -> (Specifications=w7, Unit temp.=w10, Start date=w5, Error out=w2)
        w3 = w56
        w4 = s2
        w6 = s4
        w8 = s6
        w9 = s7
      }
      frame "Specifications TXT" {
        call "Get_All_Part_Txt.gviweb"(Happ_file=s2, Error input=no error) -> (Get all charge=w65, Error Output=w66)
        Array Size(array=w65) -> (size(s)=w67)
        Is Greater(x=w67, y=1) -> w68
        case (w68) {
          frame False, Default {
            Property Node(instance in=reference to "Details of the programme:", "Visible"=TRUE, error in=w66) -> (error out=w69, instance out=w70)
            Close Reference(error in=w69, reference=w70) -> (error out=w71)
            Property Node(instance in=reference to "Programme details_2", "Visible"=TRUE, error in=w71) -> (error out=w72, instance out=w73)
            Close Reference(error in=w72, reference=w73) -> (error out=w74)
            Property Node(instance in=reference to "common", "Visible"=FALSE, error in=w74) -> (error out=w75, instance out=w76)
            Close Reference(error in=w75, reference=w76) -> (error out=w77)
            Property Node(instance in=reference to "Specifications", "Visible"=FALSE, error in=w77) -> (error out=w78, instance out=w79)
            Close Reference(error in=w78, reference=w79) -> (error out=w80)
            Property Node(instance in=reference to "icombi pro xml", "Visible"=TRUE, "ActiveTab"=0, "Value"=0, error in=w80) -> ("Tab"=w81, instance out=w82)
            Property Node(instance in=w81, "Visible"=TRUE) -> (error out=w83, instance out=w84)
            Close Reference(error in=w83, reference=w84) -> (error out=w85)
            Close Reference(error in=w85, reference=w82) -> (error out=w86)
            Property Node(instance in=reference to "i Combi Classic txt", "Visible"=FALSE, error in=w86) -> (error out=w87, instance out=w88)
            Close Reference(error in=w87, reference=w88) -> (error out=w2)
            w89 = "Get  Event from one TXT"  # State
            w3 = w89
          }
          frame True {
            w90 = "Get Events from TXT"  # State
            Property Node(instance in=reference to "common", "Visible"=FALSE, error in=w66) -> (error out=w91, instance out=w92)
            Close Reference(error in=w91, reference=w92) -> (error out=w93)
            Property Node(instance in=reference to "Specifications", "Visible"=FALSE, error in=w93) -> (error out=w94, instance out=w95)
            Close Reference(error in=w94, reference=w95) -> (error out=w96)
            Property Node(instance in=reference to "icombi pro xml", "Visible"=FALSE, error in=w96) -> (error out=w97, instance out=w98)
            Close Reference(error in=w97, reference=w98) -> (error out=w99)
            call "Specification_iCC.gviweb"(Get all charge=w65, Error input=w99) -> (General information=w100, Error Output=w2)
            $"Specifications:" <- w100
            w3 = w90
          }
        }
        w4 = s2
        w5 = s3
        w6 = s4
        w7 = s5
        w8 = s6
        w9 = s7
        w10 = s8
      }
      frame "Get Events from XML" {
        Property Node(instance in=reference to "common", "Visible"=TRUE, error in=no error) -> (error out=w101, instance out=w102)
        Close Reference(error in=w101, reference=w102) -> (error out=w103)
        Property Node(instance in=reference to "Specifications", "Visible"=TRUE, error in=w103) -> (error out=w104, instance out=w105)
        Close Reference(error in=w104, reference=w105) -> (error out=w106)
        call "Add_Parts.gviweb"(Imput XML=s2, Error input=w106) -> (Output all Parts=w107, Output=w108)
        call "Measurements.gviweb"(Output all Parts=w107, Start date and time=s3, Unit Temp=s8, Error input=w108) -> (average temp.=w109, max value=w110, General information=w111, Observed Data and Fitted Curve=w112, Energieverbrauch=w6, Output Error=w113)
        $common <- w111
        Property Node(instance in=s5, "Energy consumption:"=w6) -> (instance out=w7)
        $Specifications <- w7
        w114 = "Wait For Interaction"  # State
        Property Node(instance in=reference to "Please wait...", "Visible"=FALSE, error in=w113) -> (error out=w115, instance out=w116)
        Close Reference(error in=w115, reference=w116) -> (error out=w2)
        $"Graph Display" <- w112
        $"Max temperature (C°/°F):" <- w110
        $"Average temperature (C°/°F):" <- w109
        w3 = w114
        w4 = s2
        w5 = s3
        w8 = s6
        w9 = s7
        w10 = s8
      }
      frame "Get Events from TXT" {
        call "Get_All_Part_Txt.gviweb"(Happ_file=s2, Error input=no error) -> (Get all charge=w117, Error Output=w118)
        call "Measurements_Txt_iCC.gviweb"(Get all charge=w117, Error in=w118) -> (Charge infos Output=w8, First charge=w119, Error out=w120)
        call "Get_Cleaning_Processes.gviweb"(Charge infos input=w8, Error in=w120) -> (Only cleaning=w121, First Process=w122, Error out=w123)
        Property Node(instance in=reference to "Please wait...", "Visible"=FALSE, error in=w123) -> (error out=w124, instance out=w125)
        Close Reference(error in=w124, reference=w125) -> (error out=w126)
        call "Display_all_programm_in_graph_iCC.gviweb"(Charge infos=w8, Error input=w126) -> (Output=w127, Curve=w128, Statistics=w129, Cleaning statistics=w130, Cleaning graphic=w131)
        $Curve <- w128
        w132 = "Wait For Interaction"  # State
        $"General statistics:" <- w129
        $"Cleaning statistics:" <- w130
        w133 = reference to "Press the button to display the graphic of the two selected cleaning processes"
        Concatenate Strings("Charge Nr: ", w119) -> w134
        Build Array(w134) -> w9
        Property Node(instance in=reference to "Press the button to display details:", "Text"=w9, error in=w127) -> (error out=w135, instance out=w136)
        Close Reference(error in=w135, reference=w136) -> (error out=w137)
        Concatenate Strings("Charge Nr: ", w122) -> w138
        Build Array(w138) -> w139
        Property Node(instance in=w133, "Text"=w139, error in=w137) -> (error out=w140, instance out=w141)
        Close Reference(error in=w140, reference=w141) -> (error out=w142)
        call "Data Grid - String Column - Create Background Color Style.gvi"(reference in=reference to "common_icombi_classic", column index=6, color=4294965402, error in=w142, match operator="contains", match text="aborted") -> (reference out=w143, error out=w144)
        Close Reference(error in=w144, reference=w143) -> (error out=w145)
        call "Data Grid - String Column - Create Background Color Style.gvi"(reference in=reference to "Cleaning process table", column index=6, color=4294965402, error in=w145, match operator="contains", match text="aborted") -> (reference out=w146, error out=w147)
        Close Reference(error in=w147, reference=w146) -> (error out=w148)
        Property Node(instance in=reference to "Press the button to display details:", "Disabled"=FALSE, error in=w148) -> (error out=w149, instance out=w150)
        Close Reference(error in=w149, reference=w150) -> (error out=w151)
        Property Node(instance in=reference to "Sort Process name", "Disabled"=FALSE, error in=w151) -> (error out=w152, instance out=w153)
        Close Reference(error in=w152, reference=w153) -> (error out=w154)
        Property Node(instance in=reference to "Default View", "Disabled"=FALSE, error in=w154) -> (error out=w155, instance out=w156)
        Close Reference(error in=w155, reference=w156) -> (error out=w2)
        $"Cleaning graphic:" <- w131
        $"Cleaning process table" <- w121
        $common_icombi_pro_2 <- w8
        $common_icombi_classic <- w8
        w3 = w132
        w4 = s2
        w5 = s3
        w6 = s4
        w7 = s5
        w10 = s8
      }
      frame "Details of selected charge" {
        Property Node(instance in=reference to "Please wait...", "Visible"=TRUE, error in=no error) -> (error out=w157, instance out=w158)
        Close Reference(error in=w157, reference=w158) -> (error out=w159)
        call "Get_All_Part_Txt.gviweb"(Happ_file=s2, Error input=w159) -> (Get all charge=w160, Error Output=w161)
        call "Get_Details_selected_programme_iCC.gviweb"(Get all charge=w160, Charge Name=s7, Charge infos=s6, Error in=w161) -> (Details of the selected programme:=w162, Curve singel=w163, Details of selected infos=w164, Error out=w165, Cleaning error found?=w166)
        $"Cleaning error found?" <- w166
        $"Details of the selected programme:" <- w162
        w167 = "Wait For Interaction"  # State
        $"Graph Display_txt" <- w163
        call "Data Grid - String Column - Create Background Color Style.gvi"(reference in=reference to "Programme details", column index=0, color=4294142798, error in=w165, match operator="contains", match text="ERROR ") -> (error out=w168)
        Property Node(instance in=reference to "Please wait...", "Visible"=FALSE, error in=w168) -> (error out=w169, instance out=w170)
        Close Reference(error in=w169, reference=w170) -> (error out=w2)
        $"Programme details" <- w164
        w3 = w167
        w4 = s2
        w5 = s3
        w6 = s4
        w7 = s5
        w8 = s6
        w9 = s7
        w10 = s8
      }
      frame "Details of multiple charges" {
        Property Node(instance in=reference to "Please wait...", "Visible"=TRUE, error in=no error) -> (error out=w171, instance out=w172)
        Close Reference(error in=w171, reference=w172) -> (error out=w173)
        call "Get_All_Part_Txt.gviweb"(Happ_file=s2, Error input=w173) -> (Get all charge=w174, Error Output=w175)
        Array Index(array=s7) -> (out0[0]=w176)
        Match Pattern(regular expression=";", string=w176) -> (after substring=w177, before substring=w178, match substring=w179)
        case (w179) {
          frame ";" {
            Build Array(w178) -> w182
            call "Get_Details_selected_programme_iCC.gviweb"(Get all charge=w174, Charge Name=w182, Error in=w175) -> (Curve double=w183, Error out=w184)
            Concatenate Strings("Charge Nr:", w177) -> w185
            Build Array(w185) -> w186
            call "Get_Details_selected_programme_iCC.gviweb"(Get all charge=w174, Charge Name=w186, Error in=w184) -> (Curve double=w187, Error out=w181)
            Insert Into Array(inArray=w183, new=w187) -> w180
          }
          frame "False", Default {
            call "Display_Details.gviweb"(Get all charge=w174, Charge Name=s7, all in txt ?=TRUE, Error input=w175) -> (Error Output=w181)
            w180 = default
          }
        }
        Property Node(instance in=reference to "Please wait...", "Visible"=FALSE, error in=w181) -> (error out=w188, instance out=w189)
        Close Reference(error in=w188, reference=w189) -> (error out=w2)
        w190 = "Wait For Interaction"  # State
        $"Graph Display multiple" <- w180
        w3 = w190
        w4 = s2
        w5 = s3
        w6 = s4
        w7 = s5
        w8 = s6
        w9 = s7
        w10 = s8
      }
      frame "Get  Event from one TXT" {
        call "Get_All_Part_Txt.gviweb"(Happ_file=s2, Error input=no error) -> (Get all charge=w191, Error Output=w192)
        call "Display_Details.gviweb"(Get all charge=w191, Charge Name=s7, all in txt ?=TRUE, Error input=w192) -> (Details of the selected programme:=w193, Programme Details=w194, Curve=w195, Error Output=w2, Average temp.=w196, max value=w197)
        $"Average temperature (C°/°F):" <- w196
        $"Max temperature (C°/°F):" <- w197
        $"Details of the programme:" <- w193
        $"Programme details_2" <- w194
        w198 = "Wait For Interaction"  # State
        $"Graph Display" <- w195
        w3 = w198
        w4 = s2
        w5 = s3
        w6 = s4
        w7 = s5
        w8 = s6
        w9 = s7
        w10 = s8
      }
      frame "Wait For Interaction" {
        Property Node(instance in=reference to "Please wait...", "Visible"=FALSE, error in=no error) -> (error out=w199, instance out=w200)
        Close Reference(error in=w199, reference=w200) -> (error out=w201)
        event {
          on "Analyse" Value changed {
            w202 = "Read XML File"  # State
            $"Cleaning error found?" <- FALSE
            $"same programme type ?" <- FALSE
            Property Node(instance in=reference to "Please wait...", "Visible"=TRUE, error in=w201) -> (error out=w203, instance out=w204)
            Close Reference(error in=w203, reference=w204) -> (error out=w205)
            Property Node(instance in=reference to "i Combi Classic txt", "Value"=0, error in=w205) -> (error out=w206, instance out=w207)
            Close Reference(error in=w206, reference=w207) -> (error out=w208)
            Property Node(instance in=reference to "Cleaning graphic:", "Value"=cluster{"Element 1": f64[], "Element 2": f64[]}[] [], error in=w208) -> (error out=w209, instance out=w210)
            Close Reference(error in=w209, reference=w210) -> (error out=w211)
            Property Node(instance in=reference to "Average temperature (C°/°F):", "Value"=0, error in=w211) -> (error out=w212, instance out=w213)
            Close Reference(error in=w212, reference=w213) -> (error out=w214)
            Property Node(instance in=reference to "Max temperature (C°/°F):", "Value"=0, error in=w214) -> (error out=w215, instance out=w216)
            Close Reference(error in=w215, reference=w216) -> (error out=w217)
            Property Node(instance in=reference to "Details of the programme:", "Value"=cluster{"Information": string, "Detail": string}[] [], error in=w217) -> (error out=w218, instance out=w219)
            Close Reference(error in=w218, reference=w219) -> (error out=w220)
            Property Node(instance in=reference to "Specifications:", "Value"=T5[] [], error in=w220) -> (error out=w221, instance out=w222)
            Close Reference(error in=w221, reference=w222) -> (error out=w223)
            Property Node(instance in=reference to "Graph Display", "Value"=T2[] [], error in=w223) -> (error out=w224, instance out=w225)
            Close Reference(error in=w224, reference=w225) -> (error out=w226)
            Property Node(instance in=reference to "common_icombi_classic", "Value"=T11[] [], error in=w226) -> (error out=w227, instance out=w228)
            Close Reference(error in=w227, reference=w228) -> (error out=w229)
            Property Node(instance in=reference to "Graph Display_txt", "Value"=T7[] [], error in=w229) -> (error out=w230, instance out=w231)
            Close Reference(error in=w230, reference=w231) -> (error out=w232)
            Property Node(instance in=reference to "Programme details", "Value"=T13[] [], error in=w232) -> (error out=w233, instance out=w234)
            Close Reference(error in=w233, reference=w234) -> (error out=w235)
            Property Node(instance in=reference to "Details of the selected programme:", "Value"=cluster{"Information": string, "Detail": string}[] [], error in=w235) -> (error out=w236, instance out=w237)
            Close Reference(error in=w236, reference=w237) -> (error out=w238)
            Property Node(instance in=reference to "common", "Value"=T1[] [], error in=w238) -> (error out=w239, instance out=w240)
            Close Reference(error in=w239, reference=w240) -> (error out=w241)
            Property Node(instance in=reference to "Specifications", "Value"=T3 {all zero or empty}, error in=w241) -> (error out=w242, instance out=w243)
            Close Reference(error in=w242, reference=w243) -> (error out=w244)
            Property Node(instance in=reference to "Programme details_2", "Value"=T1[] [], error in=w244) -> (instance out=w245)
            Close Reference(reference=w245) -> (error out=w246)
            Property Node(instance in=reference to "Graph Display multiple", "Value"=cluster{"Element 1": f64[], "Element 2": i32[]}[] [], error in=w246) -> (error out=w247, instance out=w248)
            Close Reference(error in=w247, reference=w248) -> (error out=w249)
            Property Node(instance in=reference to "Press the button to display details:", "Disabled"=TRUE, "Text"=["No charge is selected"], error in=w249) -> (error out=w250, instance out=w251)
            Close Reference(error in=w250, reference=w251) -> (error out=w252)
            Property Node(instance in=reference to "Sort Process name", "Disabled"=TRUE, "Text"=["Sort Process name"], "Value"=FALSE, error in=w252) -> (error out=w253, instance out=w254)
            Close Reference(error in=w253, reference=w254) -> (error out=w255)
            Property Node(instance in=reference to "Default View", "Disabled"=TRUE, "Value"=TRUE, error in=w255) -> (error out=w256)
            Property Node(instance in=reference to "Curve", "Value"=T2[] [], error in=w256) -> (error out=w257, instance out=w258)
            Close Reference(error in=w257, reference=w258) -> (error out=w259)
            Property Node(instance in=reference to "General statistics:", "Value"=cluster{"Process": string, "quantity": string}[] [], error in=w259) -> (error out=w260, instance out=w261)
            Close Reference(error in=w260, reference=w261) -> (error out=w262)
            Property Node(instance in=reference to "Cleaning statistics:", "Value"=T12[] [], error in=w262) -> (error out=w263, instance out=w264)
            Close Reference(error in=w263, reference=w264) -> (error out=w265)
            Property Node(instance in=reference to "Graph Display", "Value"=T2[] [], error in=w265) -> (error out=w266, instance out=w267)
            Close Reference(error in=w266, reference=w267) -> (error out=w268)
            Property Node(instance in=reference to "i Combi Classic txt", "Value"=0, error in=w268) -> (error out=w269, instance out=w270)
            Close Reference(error in=w269, reference=w270) -> (error out=w2)
            w3 = w202
            w9 = s7
          }
          on "Sort Process name" Value changed {
            w271 = "Wait For Interaction"  # State
            Event Data() -> ("Old Value"=w272, "New Value"=w273)
            Not(x=w272) -> w274
            case (w273) {
              frame False, Default {
                Property Node(instance in=reference to "Sort Process name", "Text"=["Sort Process name ▼ "], error in=w201) -> (error out=w275, instance out=w276)
              }
              frame True {
                Property Node(instance in=reference to "Sort Process name", "Text"=["Sort Process name ▲"], error in=w201) -> (error out=w275, instance out=w276)
              }
            }
            Close Reference(error in=w275, reference=w276) -> (error out=w277)
            Property Node(instance in=reference to "Default View", "Value"=FALSE, error in=w277) -> (error out=w278)
            call "Sort_table.gviweb"(Sort Process name=w274, Imput infos=$common_icombi_classic, Error Cluster input=w278) -> (Output infos=w279, Error Output=w2)
            $common_icombi_classic <- w279
            w3 = w271
            w9 = s7
          }
          on "Default View" Value changed {
            w280 = "Wait For Interaction"  # State
            case ($"Default View") {
              frame False, Default {
                w2 = w201
              }
              frame True {
                $common_icombi_classic <- $common_icombi_pro_2
                Property Node(instance in=reference to "Sort Process name", "Text"=["Sort Process name"], "Value"=FALSE, error in=w201) -> (error out=w281, instance out=w282)
                Close Reference(error in=w281, reference=w282) -> (error out=w2)
              }
            }
            w3 = w280
            w9 = s7
          }
          on "common_icombi_classic" Value changed {
            w283 = "Wait For Interaction"  # State
            Event Data() -> ("Old Value"=w284, "New Value"=w285)
            for {
              w286 = each element of w284
              w287 = each element of w285
              Property Node(instance in=w286) -> ("Selected"=w289)
              case (w289) {
                frame False, Default {
                  Property Node(instance in=w287) -> ("Selected"=w290, "Charge Nr."=w291)
                  case (w290) {
                    frame False, Default {
                      w9 = s7
                    }
                    frame True {
                      Concatenate Strings("Charge Nr: ", w291) -> w292
                      Build Array(w292) -> w9
                      Property Node(instance in=reference to "Press the button to display details:", "Text"=w9) -> (error out=w293, instance out=w294)
                      Close Reference(error in=w293, reference=w294)
                    }
                  }
                }
                frame True {
                  Not(x=w289) -> w290
                  w9 = s7
                }
              }
              Property Node(instance in=w287, "Selected"=w290) -> (instance out=w295)
              append w295 to w288
            }
            $common_icombi_classic <- w288
            w2 = w201
            w3 = w283
          }
          on "Cleaning process table" Value changed {
            w296 = "Wait For Interaction"  # State
            Event Data() -> ("Old Value"=w297, "New Value"=w298)
            call "Select_more_than_Cleaning_process.gviweb"(Cleaning process old=w297, Cleaning process new=w298, Error input=w201) -> (Infos output=w299, Selected Charge Nr.=w300, same reciepe name=w301, Error Output=w302)
            $"same programme type ?" <- w301
            w303 = reference to "Press the button to display the graphic of the two selected cleaning processes"
            Concatenate Strings("Charge Nr: ", w300) -> w304
            Build Array(w304) -> w305
            Property Node(instance in=w303, "Text"=w305, error in=w302) -> (error out=w306, instance out=w307)
            Close Reference(error in=w306, reference=w307) -> (error out=w2)
            $"Cleaning process table" <- w299
            w3 = w296
            w9 = s7
          }
          on "Press the button to display details:" Value changed {
            Property Node(instance in=reference to "Press the button to display details:", error in=w201) -> ("Text"=w9, error out=w308)
            for {
              w309 = each element of w9
              case (w309) {
                frame "No charge is selected" {
                  w310 = "Please select a programme after opening a haccp file \nand click the button again to display the details!"
                  One Button Dialog(message=w310)
                  w2 = w308
                }
                frame "False", Default {
                  Property Node(instance in=reference to "i Combi Classic txt", "Value"=2, error in=w308) -> (error out=w311, instance out=w312)
                  Close Reference(error in=w311, reference=w312) -> (error out=w2)
                }
              }
            }
            w313 = "Details of selected charge"  # State
            w3 = w313
          }
          on "Press the button to display the graphic of the two selected cleaning processes" Value changed {
            w314 = "Details of multiple charges"  # State
            w315 = reference to "Press the button to display the graphic of the two selected cleaning processes"
            Property Node(instance in=w315, error in=w201) -> ("Text"=w9, error out=w316)
            case ($"same programme type ?") {
              frame False {
                w317 = "Please select two cleaning programmes of the same type and click on the button again to display the details!"
                One Button Dialog(message=w317)
                w2 = w316
              }
              frame True {
                Property Node(instance in=reference to "i Combi Classic txt", "Value"=5, error in=w316) -> (error out=w318, instance out=w319)
                Close Reference(error in=w318, reference=w319) -> (error out=w2)
              }
            }
            w3 = w314
          }
        }
        w4 = s2
        w5 = s3
        w6 = s4
        w7 = s5
        w8 = s6
        w10 = s8
      }
    }
    next s1 = w3
    next s2 = w4
    next s3 = w5
    next s4 = w6
    next s5 = w7
    next s6 = w8
    next s7 = w9
    next s8 = w10
    stop if FALSE
  }
