vi "iCombi-Pro.gviweb"   [G Web Development Software 22.3.0]
panel controls:
  "Analyse": bool  # Press the button “Analyse” and select a service report xml file.
  "icombi pro xml": i32 = 1
  "common_icombi_pro": T4[]
  "i Combi Pro txt": i32
  "Press the button to display details:": bool
  "Engine Link": string = "index.html"
  "Sort Process name": bool
  "Press the button to display the graphic of the two selected cleaning processes": bool
  "Default View": bool = TRUE
  "common_icombi_pro_2": T6[]
panel indicators:
  "common": T1[]
  "Graph Display": T2[]
  "Specifications": T3
  "URL-Grafik": string
  "Specifications:": T5[]
  "Details of the selected programme:": cluster{"Information": string, "Detail": string}[]
  "Graph Display_txt": T2[]
  "Curve": T2[]
  "General statistics:": cluster{"Process": string, "quantity": string}[]
  "Cleaning graphic:": cluster{"Element 1": f64[], "Element 2": i32[]}[]
  "Max temperature (C°/°F):": f64
  "Average temperature (C°/°F):": f64
  "Please wait...": f64
  "Details of the programme:": cluster{"Information": string, "Detail": string}[]
  "Programme details_2": T1[]
  "Cleaning process table": T4[]
  "Graph Display multiple": cluster{"Element 1": f64[], "Element 2": f64[]}[]
  "same programme type ?": bool
  "banner": string
  "HACCP File Content:": string
  "common_2": T7[]
  "Cleaning statistics:": T8[]
  "Charge details": T9[]
types:
  T1 = cluster{"Mode/Event": string, "Cooking cabinet temp.": string, "Core probe Setpoint temp.": string, "Core sensor actual temp.": string, "Date and Time ⌚": string}
  T2 = cluster{"Element 1": timestamp[], "Element 2": f64[]}
  T3 = cluster{"Device type:": string, "Serial number:": string, "Software version:": string, "Start date:": string, "Charge number:": string, "Prozess-Typ:": string, "Cooking programme name:": string, "Energy consumption:": string}
  T4 = cluster{"Selected": bool, "Charge Nr.": string, "Process name": string, "Programme name": string, "Start time ⌚": string, "Duration": string, "Status": string, "Average temp. (°C/°F)": string, "Door cycles closed/opened": string, "Restart Power": string}
  T5 = cluster{"Information": string, "Details": string}
  T6 = cluster{"Selected": bool, "Charge Nr.": string, "Process name": string, "Programme name": string, "Date and time ⌚": string, "Duration": string, "Status": string, "Average temp. (°C/°F)": string, "closed D": string, "opened D": string}
  T7 = cluster{"Mode/Event": string, "Cooking cabinet temp.": string, "Core probe Setpoint temp.": string, "Core sensor actual temp.": string, "Used heating elements": string, "Date and Time ⌚": string}
  T8 = cluster{"Cleaning name": string, "Eco with SG": f64, "Standard with SG": f64, "Eco witout SG": f64, "Standard without SG": f64, "Aborted": f64}
  T9 = cluster{"Mode/Event": string, "Cooking cabinet temp.": string, "Core probe Setpoint temp.": string, "Core sensor actual temp.": string, "Date and time ⌚": string}
  T10 = cluster{"selected": bool, "Charge Nr.": string, "Process name": string, "Programme name": string, "Date and time": string, "Duration": string, "Status": string, "Average temp.": string, "counter Door closed": string, "counter Door opened": string}
  T11 = cluster{"Device type:": string, "Serial number:": string, "Software version:": string, "Start date:": string, "Charge number:": string, "Prozess-Typ:": string, "Cooking programme name": string, "Energy consumption:": string}
uses:
  FileTasks::Read File Text.gvi
  WebApp::Check_File_Content_iCombi_Pro.gviweb
  WebApp::Read_XML_Part.gviweb
  WebApp::Specifications_haccp.gviweb
  WebApp::Get_All_Part_Txt.gviweb
  WebApp::Specifications_txt.gviweb
  WebApp::Add_Parts.gviweb
  WebApp::Measurements.gviweb
  ControlExtensions::Data Grid - String Column - Create Background Color Style.gvi
  WebApp::Measurements_Txt_iCombiPro.gviweb
  WebApp::Get_Cleaning_Processes.gviweb
  WebApp::Display_all_programm_in_graph_iCombi_Pro.gviweb
  WebApp::Display_Details.gviweb
  WebApp::Sort_table.gviweb
  WebApp::Select_more_than_Cleaning_process.gviweb
diagram:
  w1 = "Init"  # State
  s1 = w1  # shift register
  s2 = ""  # shift register
  s3 = ""  # shift register
  s4 = ""  # shift register
  s5 = T11 {all zero or empty}  # shift register
  s6 = T10[] []  # shift register
  s7 = string[] []  # shift register
  s8 = ""  # shift register
  while {
    # s4: Energieverbrauch
    # s3: Start time & date
    # s6: General information txt
    # s5: Specifications
    # s2: Inhalt txt/XML
    # s7: Selected Charge nr
    case (s1) {
      frame "Init", Default {
        w11 = "Wait For Interaction"  # State
        Property Node(instance in=reference to "Please wait...", "Visible"=FALSE, error in=no error) -> (error out=w12, instance out=w13)
        Close Reference(error in=w12, reference=w13) -> (error out=w14)
        Property Node(instance in=reference to "common", "Visible"=FALSE, error in=w14) -> (error out=w15, instance out=w16)
        Close Reference(error in=w15, reference=w16) -> (error out=w17)
        Property Node(instance in=reference to "Specifications", "Visible"=FALSE, error in=w17) -> (error out=w18, instance out=w19)
        Close Reference(error in=w18, reference=w19) -> (error out=w20)
        Property Node(instance in=reference to "icombi pro xml", "Visible"=FALSE, error in=w20) -> (error out=w21, instance out=w22)
        Close Reference(error in=w21, reference=w22) -> (error out=w23)
        Property Node(instance in=reference to "i Combi Pro txt", "Visible"=TRUE, error in=w23) -> (error out=w24, instance out=w25)
        Close Reference(error in=w24, reference=w25) -> (error out=w26)
        Property Node(instance in=reference to "Press the button to display details:", "Disabled"=TRUE, error in=w26) -> (error out=w27, instance out=w28)
        Close Reference(error in=w27, reference=w28) -> (error out=w29)
        Property Node(instance in=reference to "Sort Process name", "Disabled"=TRUE, error in=w29) -> (error out=w30, instance out=w31)
        Close Reference(error in=w30, reference=w31) -> (error out=w32)
        Property Node(instance in=reference to "Default View", "Disabled"=TRUE, error in=w32) -> (error out=w33, instance out=w34)
        Close Reference(error in=w33, reference=w34) -> (error out=w2)
        $"URL-Grafik" <- "Rational_logo.jpg"
        w3 = w11
        w4 = s2
        w5 = s3
        w6 = s4
        w7 = s5
        w8 = s6
        w9 = s7
        w10 = s8
      }
      frame "Read XML File" {
        call "Read File Text.gvi"(allowed file types=[".xml", ".txt"], error in=no error) -> (file content=w35, file name=w36, error out=w37)
        Match Pattern(regular expression=".xml", string=w36) -> (match substring=w38)
        call "Check_File_Content_iCombi_Pro.gviweb"(Inhalt Haccp=w35, file type xml=w38, file type_txt=w36, Error input=w37) -> (HACCP File Content=w39, i Combi Pro ?=w40, Error Output=w41)
        case (w40) {
          frame False, Default {
            Property Node(instance in=reference to "Specifications:", "Value"=T5[] [], error in=w41) -> (error out=w42, instance out=w43)
            Close Reference(error in=w42, reference=w43) -> (error out=w44)
            Property Node(instance in=reference to "common_icombi_pro", "Value"=T10[] [], error in=w44) -> (error out=w45, instance out=w46)
            Close Reference(error in=w45, reference=w46) -> (error out=w2)
            w3 = "Wait For Interaction"
          }
          frame True {
            case (w38) {
              frame "False", Default {
                Match Pattern(regular expression=".txt", string=w36) -> (match substring=w47)
                case (w47) {
                  frame ".txt" {
                    w48 = "Specifications TXT"  # State
                    Property Node(instance in=reference to "i Combi Pro txt", "Visible"=TRUE, error in=w41) -> (error out=w49, instance out=w50)
                    Close Reference(error in=w49, reference=w50) -> (error out=w51)
                    Property Node(instance in=reference to "icombi pro xml", "Visible"=FALSE, error in=w51) -> (error out=w52, instance out=w53)
                    Close Reference(error in=w52, reference=w53) -> (error out=w54)
                    Property Node(instance in=reference to "Specifications:", "Value"=T5[] [], error in=w54) -> (error out=w55, instance out=w56)
                    Close Reference(error in=w55, reference=w56) -> (error out=w57)
                    Property Node(instance in=reference to "common_icombi_pro", "Value"=T10[] [], error in=w57) -> (error out=w58, instance out=w59)
                    Close Reference(error in=w58, reference=w59) -> (error out=w2)
                    w3 = w48
                  }
                  frame "False", Default {
                    w60 = "Wait For Interaction"  # State
                    w3 = w60
                    w2 = w41
                  }
                }
              }
              frame ".xml" {
                w61 = "Specifications XML"  # State
                Property Node(instance in=reference to "i Combi Pro txt", "Visible"=FALSE, error in=w41) -> (error out=w62, instance out=w63)
                Close Reference(error in=w62, reference=w63) -> (error out=w64)
                Property Node(instance in=reference to "icombi pro xml", "Visible"=TRUE, "ActiveTab"=0, "Value"=0, error in=w64) -> ("Tab"=w65, instance out=w66)
                Property Node(instance in=w65, "Visible"=TRUE) -> (error out=w67)
                Close Reference(error in=w67, reference=w66) -> (error out=w2)
                w3 = w61
              }
            }
          }
        }
        Concatenate Strings(w35, ";") -> w4
        $"HACCP File Content:" <- w39
        w5 = s3
        w6 = s4
        w7 = s5
        w8 = s6
        w9 = s7
        w10 = s8
      }
      frame "Specifications XML" {
        w68 = "Get Events from XML"  # State
        Property Node(instance in=reference to "Details of the programme:", "Visible"=FALSE, error in=no error) -> (error out=w69, instance out=w70)
        Close Reference(error in=w69, reference=w70) -> (error out=w71)
        Property Node(instance in=reference to "Programme details_2", "Visible"=FALSE, error in=w71) -> (error out=w72, instance out=w73)
        Close Reference(error in=w72, reference=w73) -> (error out=w74)
        call "Read_XML_Part.gviweb"(Input XML=s2, Start XML Part="<_1>", End XML Part="</_1>", Error in=w74) -> (Output XML array=w75, Error out=w76)
        call "Specifications_haccp.gviweb"(Output XML array=w75, Energy consumption:=s4, Error in=w76) -> (Specifications=w7, Unit temp.=w10, Start date=w5, Error out=w2)
        w3 = w68
        w4 = s2
        w6 = s4
        w8 = s6
        w9 = s7
      }
      frame "Specifications TXT" {
        call "Get_All_Part_Txt.gviweb"(Happ_file=s2, Error input=no error) -> (Get all charge=w77, Error Output=w78)
        Array Size(array=w77) -> (size(s)=w79)
        Is Greater(x=w79, y=1) -> w80
        case (w80) {
          frame False, Default {
            Property Node(instance in=reference to "Details of the programme:", "Visible"=TRUE, error in=w78) -> (error out=w81, instance out=w82)
            Close Reference(error in=w81, reference=w82) -> (error out=w83)
            Property Node(instance in=reference to "Programme details_2", "Visible"=TRUE, error in=w83) -> (error out=w84, instance out=w85)
            Close Reference(error in=w84, reference=w85) -> (error out=w86)
            Property Node(instance in=reference to "common", "Visible"=FALSE, error in=w86) -> (error out=w87, instance out=w88)
            Close Reference(error in=w87, reference=w88) -> (error out=w89)
            Property Node(instance in=reference to "Specifications", "Visible"=FALSE, error in=w89) -> (error out=w90, instance out=w91)
            Close Reference(error in=w90, reference=w91) -> (error out=w92)
            Property Node(instance in=reference to "icombi pro xml", "Visible"=TRUE, "ActiveTab"=0, "Value"=0, error in=w92) -> ("Tab"=w93, instance out=w94)
            Property Node(instance in=w93, "Visible"=TRUE) -> (error out=w95, instance out=w96)
            Close Reference(error in=w95, reference=w96) -> (error out=w97)
            Close Reference(error in=w97, reference=w94) -> (error out=w98)
            Property Node(instance in=reference to "i Combi Pro txt", "Visible"=FALSE, error in=w98) -> (error out=w99, instance out=w100)
            Close Reference(error in=w99, reference=w100) -> (error out=w2)
            w101 = "Get  Event from one TXT"  # State
            w3 = w101
          }
          frame True {
            w102 = "Get Events from TXT"  # State
            Property Node(instance in=reference to "common", "Visible"=FALSE, error in=w78) -> (error out=w103, instance out=w104)
            Close Reference(error in=w103, reference=w104) -> (error out=w105)
            Property Node(instance in=reference to "Specifications", "Visible"=FALSE, error in=w105) -> (error out=w106, instance out=w107)
            Close Reference(error in=w106, reference=w107) -> (error out=w108)
            Property Node(instance in=reference to "icombi pro xml", "Visible"=FALSE, error in=w108) -> (error out=w109, instance out=w110)
            Close Reference(error in=w109, reference=w110) -> (error out=w111)
            call "Specifications_txt.gviweb"(Get all charge=w77, Error input=w111) -> (General information=w112, Error Output=w2)
            $"Specifications:" <- w112
            w3 = w102
          }
        }
        w4 = s2
        w5 = s3
        w6 = s4
        w7 = s5
        w8 = s6
        w9 = s7
        w10 = s8
      }
      frame "Get Events from XML" {
        Property Node(instance in=reference to "common", "Visible"=TRUE, error in=no error) -> (error out=w113, instance out=w114)
        Close Reference(error in=w113, reference=w114) -> (error out=w115)
        Property Node(instance in=reference to "Specifications", "Visible"=TRUE, error in=w115) -> (error out=w116, instance out=w117)
        Close Reference(error in=w116, reference=w117) -> (error out=w118)
        call "Add_Parts.gviweb"(Imput XML=s2, Error input=w118) -> (Output all Parts=w119, Output=w120)
        call "Measurements.gviweb"(Output all Parts=w119, Start date and time=s3, Unit Temp=s8, Error input=w120) -> (average temp.=w121, max value=w122, General information=w123, Observed Data and Fitted Curve=w124, Energieverbrauch=w6, Output Error=w125)
        $common <- w123
        w126 = "Wait For Interaction"  # State
        Property Node(instance in=reference to "Please wait...", "Visible"=FALSE, error in=w125) -> (error out=w127, instance out=w128)
        Close Reference(error in=w127, reference=w128) -> (error out=w129)
        call "Data Grid - String Column - Create Background Color Style.gvi"(reference in=reference to "common", column index=4, color=4294965402, error in=w129, match operator="contains", match text="1904") -> (reference out=w130, error out=w131)
        Close Reference(error in=w131, reference=w130) -> (error out=w2)
        $"Graph Display" <- w124
        $"Max temperature (C°/°F):" <- w122
        $"Average temperature (C°/°F):" <- w121
        Property Node(instance in=s5, "Energy consumption:"=w6) -> (instance out=w7)
        Property Node(instance in=w7) -> ("Start date:"=w132)
        String Length(string=w132) -> (length=w133)
        Is Greater Than 0(x=w133) -> w134
        case (w134) {
          frame True {
            w135 = w7
          }
          frame False {
            Property Node(instance in=w7, "Start date:"="⛔Missing") -> (instance out=w135)
          }
        }
        $Specifications <- w135
        w3 = w126
        w4 = s2
        w5 = s3
        w8 = s6
        w9 = s7
        w10 = s8
      }
      frame "Get Events from TXT" {
        w136 = "Wait For Interaction"  # State
        call "Get_All_Part_Txt.gviweb"(Happ_file=s2, Error input=no error) -> (Get all charge=w137, Error Output=w138)
        call "Measurements_Txt_iCombiPro.gviweb"(Get all charge=w137, Error in=w138) -> (Charge infos output=w8, First charge=w139, Charge infos with OM=w140, Error out=w141)
        call "Get_Cleaning_Processes.gviweb"(Charge infos input=w8, Error in=w141) -> (Only cleaning=w142, First Process=w143, Error out=w144)
        Property Node(instance in=reference to "Please wait...", "Visible"=FALSE, error in=w144) -> (error out=w145, instance out=w146)
        Close Reference(error in=w145, reference=w146) -> (error out=w147)
        call "Display_all_programm_in_graph_iCombi_Pro.gviweb"(Charge infos output=w8, Error input=w147) -> (Error Output=w148, Curve=w149, Statistics=w150, Cleaning graphic=w151, Cleaning statistics=w152)
        $Curve <- w149
        $"General statistics:" <- w150
        w153 = reference to "Press the button to display the graphic of the two selected cleaning processes"
        Concatenate Strings("Charge Nr: ", w139) -> w154
        Build Array(w154) -> w9
        Property Node(instance in=reference to "Press the button to display details:", "Text"=w9, error in=w148) -> (error out=w155, instance out=w156)
        Close Reference(error in=w155, reference=w156) -> (error out=w157)
        Concatenate Strings("Charge Nr: ", w143) -> w158
        Build Array(w158) -> w159
        Property Node(instance in=w153, "Text"=w159, error in=w157) -> (error out=w160, instance out=w161)
        Close Reference(error in=w160, reference=w161) -> (error out=w162)
        call "Data Grid - String Column - Create Background Color Style.gvi"(reference in=reference to "common_icombi_pro", column index=6, color=4294965402, error in=w162, match operator="contains", match text="aborted") -> (reference out=w163, error out=w164)
        Close Reference(error in=w164, reference=w163) -> (error out=w165)
        call "Data Grid - String Column - Create Background Color Style.gvi"(reference in=reference to "Cleaning process table", column index=6, color=4294965402, error in=w165, match operator="contains", match text="aborted") -> (reference out=w166, error out=w167)
        Close Reference(error in=w167, reference=w166) -> (error out=w168)
        call "Data Grid - String Column - Create Background Color Style.gvi"(reference in=reference to "common_icombi_pro", column index=9, color=4294142798, error in=w168, match operator="contains", match text="YES") -> (reference out=w169, error out=w170)
        Close Reference(error in=w170, reference=w169) -> (error out=w171)
        call "Data Grid - String Column - Create Background Color Style.gvi"(reference in=reference to "Cleaning process table", column index=9, color=4294142798, error in=w171, match operator="contains", match text="YES") -> (reference out=w172, error out=w173)
        Close Reference(error in=w173, reference=w172) -> (error out=w174)
        Property Node(instance in=reference to "Press the button to display details:", "Disabled"=FALSE, error in=w174) -> (error out=w175, instance out=w176)
        Close Reference(error in=w175, reference=w176) -> (error out=w177)
        Property Node(instance in=reference to "Sort Process name", "Disabled"=FALSE, error in=w177) -> (error out=w178, instance out=w179)
        Close Reference(error in=w178, reference=w179) -> (error out=w180)
        Property Node(instance in=reference to "Default View", "Disabled"=FALSE, error in=w180) -> (error out=w181, instance out=w182)
        Close Reference(error in=w181, reference=w182) -> (error out=w2)
        $"Cleaning graphic:" <- w151
        $"Cleaning statistics:" <- w152
        $"Cleaning process table" <- w142
        $common_icombi_pro_2 <- w140
        $common_icombi_pro <- w140
        w3 = w136
        w4 = s2
        w5 = s3
        w6 = s4
        w7 = s5
        w10 = s8
      }
      frame "Details of selected charge" {
        call "Get_All_Part_Txt.gviweb"(Happ_file=s2, Error input=no error) -> (Get all charge=w183, Error Output=w184)
        call "Display_Details.gviweb"(Get all charge=w183, Charge Name=s7, all in txt ?=TRUE, Error input=w184) -> (Details of the selected programme:=w185, Programme Details=w186, Curve=w187, Error Output=w2)
        $"Details of the selected programme:" <- w185
        w188 = "Wait For Interaction"  # State
        $"Charge details" <- w186
        $"Graph Display_txt" <- w187
        w3 = w188
        w4 = s2
        w5 = s3
        w6 = s4
        w7 = s5
        w8 = s6
        w9 = s7
        w10 = s8
      }
      frame "Details of multiple charges" {
        w189 = "Wait For Interaction"  # State
        call "Get_All_Part_Txt.gviweb"(Happ_file=s2, Error input=no error) -> (Get all charge=w190, Error Output=w191)
        Array Index(array=s7) -> (out0[0]=w192)
        Match Pattern(regular expression=";", string=w192) -> (after substring=w193, before substring=w194, match substring=w195)
        case (w195) {
          frame ";" {
            Build Array(w194) -> w197
            call "Display_Details.gviweb"(Get all charge=w190, Charge Name=w197, all in txt ?=TRUE, Error input=w191) -> (Curve double=w198, Error Output=w199)
            Concatenate Strings("Charge Nr:", w193) -> w200
            Build Array(w200) -> w201
            call "Display_Details.gviweb"(Get all charge=w190, Charge Name=w201, all in txt ?=TRUE, Error input=w199) -> (Curve double=w202, Error Output=w2)
            Insert Into Array(inArray=w198, new=w202) -> w196
          }
          frame "False", Default {
            call "Display_Details.gviweb"(Get all charge=w190, Charge Name=s7, all in txt ?=TRUE, Error input=w191) -> (Error Output=w2)
            w196 = default
          }
        }
        $"Graph Display multiple" <- w196
        w3 = w189
        w4 = s2
        w5 = s3
        w6 = s4
        w7 = s5
        w8 = s6
        w9 = s7
        w10 = s8
      }
      frame "Get  Event from one TXT" {
        call "Get_All_Part_Txt.gviweb"(Happ_file=s2, Error input=no error) -> (Get all charge=w203, Error Output=w204)
        call "Display_Details.gviweb"(Get all charge=w203, Charge Name=s7, all in txt ?=TRUE, Error input=w204) -> (Details of the selected programme:=w205, Programme Details=w206, Curve=w207, Error Output=w2, Average temp.=w208, max value=w209)
        $"Average temperature (C°/°F):" <- w208
        $"Max temperature (C°/°F):" <- w209
        $"Details of the programme:" <- w205
        $"Programme details_2" <- w206
        w210 = "Wait For Interaction"  # State
        $"Graph Display" <- w207
        w3 = w210
        w4 = s2
        w5 = s3
        w6 = s4
        w7 = s5
        w8 = s6
        w9 = s7
        w10 = s8
      }
      frame "Wait For Interaction" {
        Property Node(instance in=reference to "Please wait...", "Visible"=FALSE, error in=no error) -> (error out=w211, instance out=w212)
        Close Reference(error in=w211, reference=w212) -> (error out=w213)
        event {
          on "Analyse" Value changed {
            w214 = "Read XML File"  # State
            $"same programme type ?" <- FALSE
            Property Node(instance in=reference to "Average temperature (C°/°F):", "Value"=0) -> (error out=w215, instance out=w216)
            Close Reference(error in=w215, reference=w216) -> (error out=w217)
            Property Node(instance in=reference to "Max temperature (C°/°F):", "Value"=0, error in=w217) -> (error out=w218, instance out=w219)
            Close Reference(error in=w218, reference=w219) -> (error out=w220)
            Property Node(instance in=reference to "icombi pro xml", "Value"=0, error in=w220) -> (error out=w221, instance out=w222)
            Close Reference(error in=w221, reference=w222) -> (error out=w223)
            Property Node(instance in=reference to "Graph Display", "Value"=T2[] [], error in=w223) -> (error out=w224, instance out=w225)
            Close Reference(error in=w224, reference=w225) -> (error out=w226)
            Property Node(instance in=reference to "i Combi Pro txt", "Value"=0, error in=w226) -> (error out=w227, instance out=w228)
            Close Reference(error in=w227, reference=w228) -> (error out=w229)
            Property Node(instance in=reference to "Specifications:", "Value"=T5[] [], error in=w229) -> (error out=w230, instance out=w231)
            Close Reference(error in=w230, reference=w231) -> (error out=w232)
            Property Node(instance in=reference to "General statistics:", "Value"=cluster{"Process": string, "quantity": string}[] [], error in=w232) -> (error out=w233, instance out=w234)
            Property Node(instance in=reference to "Specifications", "Value"=T3 {all zero or empty}, error in=w233) -> (error out=w235, instance out=w236)
            Close Reference(error in=w235, reference=w236) -> (error out=w237)
            Property Node(instance in=reference to "Graph Display", "Value"=T2[] [], error in=w237) -> (error out=w238, instance out=w239)
            Close Reference(error in=w238, reference=w239) -> (error out=w240)
            Property Node(instance in=reference to "common", "Value"=T1[] [], error in=w240) -> (error out=w241, instance out=w242)
            Close Reference(error in=w241, reference=w242) -> (error out=w243)
            Property Node(instance in=reference to "Details of the programme:", "Value"=cluster{"Information": string, "Detail": string}[] [], error in=w243) -> (error out=w244, instance out=w245)
            Close Reference(error in=w244, reference=w245) -> (error out=w246)
            Property Node(instance in=reference to "Programme details_2", "Value"=T1[] [], error in=w246) -> (error out=w247, instance out=w248)
            Close Reference(error in=w247, reference=w248) -> (error out=w249)
            Close Reference(error in=w249, reference=w234) -> (error out=w250)
            Property Node(instance in=reference to "common_icombi_pro", "Value"=T10[] [], error in=w250) -> (error out=w251, instance out=w252)
            Close Reference(error in=w251, reference=w252) -> (error out=w253)
            Property Node(instance in=reference to "Cleaning graphic:", "Value"=cluster{"Element 1": f64[], "Element 2": f64[]}[] [], error in=w253) -> (error out=w254, instance out=w255)
            Close Reference(error in=w254, reference=w255) -> (error out=w256)
            Property Node(instance in=reference to "Details of the selected programme:", "Value"=cluster{"Information": string, "Detail": string}[] [], error in=w256) -> (error out=w257, instance out=w258)
            Close Reference(error in=w257, reference=w258) -> (error out=w259)
            Property Node(instance in=reference to "Charge details", "Value"=T1[] [], error in=w259) -> (error out=w260, instance out=w261)
            Close Reference(error in=w260, reference=w261) -> (error out=w262)
            Property Node(instance in=reference to "Curve", "Value"=T2[] [], error in=w262) -> (error out=w263, instance out=w264)
            Close Reference(error in=w263, reference=w264) -> (error out=w265)
            Property Node(instance in=reference to "Graph Display_txt", "Value"=T2[] [], error in=w265) -> (error out=w266, instance out=w267)
            Close Reference(error in=w266, reference=w267) -> (error out=w268)
            Property Node(instance in=reference to "Press the button to display details:", "Disabled"=TRUE, "Text"=["No charge is selected"], error in=w268) -> (error out=w269, instance out=w270)
            Close Reference(error in=w269, reference=w270) -> (error out=w271)
            Property Node(instance in=reference to "Sort Process name", "Disabled"=TRUE, "Value"=FALSE, "Text"=["Sort Process name"], error in=w271) -> (error out=w272, instance out=w273)
            Close Reference(error in=w272, reference=w273) -> (error out=w274)
            Property Node(instance in=reference to "Default View", "Disabled"=TRUE, "Value"=TRUE, error in=w274) -> (error out=w275, instance out=w276)
            Close Reference(error in=w275, reference=w276) -> (error out=w277)
            Property Node(instance in=reference to "Graph Display multiple", "Value"=cluster{"Element 1": f64[], "Element 2": f64[]}[] [], error in=w277) -> (error out=w278, instance out=w279)
            Close Reference(error in=w278, reference=w279) -> (error out=w2)
            Property Node(instance in=reference to "Please wait...", "Visible"=TRUE, error in=w213) -> (error out=w280, instance out=w281)
            Close Reference(error in=w280, reference=w281)
            w3 = w214
            w9 = s7
          }
          on "Sort Process name" Value changed {
            w282 = "Wait For Interaction"  # State
            Event Data() -> ("Old Value"=w283, "New Value"=w284)
            Not(x=w283) -> w285
            case (w284) {
              frame False, Default {
                Property Node(instance in=reference to "Sort Process name", "Text"=["Sort Process name ▼ "], error in=w213) -> (error out=w286, instance out=w287)
              }
              frame True {
                Property Node(instance in=reference to "Sort Process name", "Text"=["Sort Process name ▲"], error in=w213) -> (error out=w286, instance out=w287)
              }
            }
            Close Reference(error in=w286, reference=w287) -> (error out=w288)
            Property Node(instance in=reference to "Default View", "Value"=FALSE, error in=w288) -> (error out=w289)
            call "Sort_table.gviweb"(Sort Process name=w285, Imput infos=$common_icombi_pro, Error Cluster input=w289) -> (Output infos=w290, Error Output=w2)
            $common_icombi_pro <- w290
            w3 = w282
            w9 = s7
          }
          on "Default View" Value changed {
            w291 = "Wait For Interaction"  # State
            case ($"Default View") {
              frame False, Default {
                w2 = w213
              }
              frame True {
                $common_icombi_pro <- $common_icombi_pro_2
                Property Node(instance in=reference to "Sort Process name", "Text"=["Sort Process name"], "Value"=FALSE, error in=w213) -> (error out=w292, instance out=w293)
                Close Reference(error in=w292, reference=w293) -> (error out=w2)
              }
            }
            w3 = w291
            w9 = s7
          }
          on "common_icombi_pro" Value changed {
            w294 = "Wait For Interaction"  # State
            Event Data() -> ("Old Value"=w295, "New Value"=w296)
            for {
              w297 = each element of w295
              w298 = each element of w296
              Property Node(instance in=w297) -> ("Selected"=w300)
              case (w300) {
                frame False, Default {
                  Property Node(instance in=w298) -> ("Selected"=w301, "Charge Nr."=w302)
                  case (w301) {
                    frame False, Default {
                      w9 = s7
                    }
                    frame True {
                      Concatenate Strings("Charge Nr: ", w302) -> w303
                      Build Array(w303) -> w9
                      Property Node(instance in=reference to "Press the button to display details:", "Text"=w9) -> (error out=w304, instance out=w305)
                      Close Reference(error in=w304, reference=w305)
                    }
                  }
                }
                frame True {
                  Not(x=w300) -> w301
                  w9 = s7
                }
              }
              Property Node(instance in=w298, "Selected"=w301) -> (instance out=w306)
              append w306 to w299
            }
            $common_icombi_pro <- w299
            w2 = w213
            w3 = w294
          }
          on "Cleaning process table" Value changed {
            w307 = "Wait For Interaction"  # State
            Event Data() -> ("Old Value"=w308, "New Value"=w309)
            call "Select_more_than_Cleaning_process.gviweb"(Cleaning process old=w308, Cleaning process new=w309, Error input=w213) -> (Infos output=w310, Selected Charge Nr.=w311, same reciepe name=w312, Error Output=w313)
            $"same programme type ?" <- w312
            w314 = reference to "Press the button to display the graphic of the two selected cleaning processes"
            Concatenate Strings("Charge Nr: ", w311) -> w315
            Build Array(w315) -> w316
            Property Node(instance in=w314, "Text"=w316, error in=w313) -> (error out=w317, instance out=w318)
            Close Reference(error in=w317, reference=w318) -> (error out=w2)
            $"Cleaning process table" <- w310
            w3 = w307
            w9 = s7
          }
          on "Press the button to display details:" Value changed {
            Property Node(instance in=reference to "Press the button to display details:", error in=w213) -> ("Text"=w9, error out=w319)
            for {
              w320 = each element of w9
              case (w320) {
                frame "No charge is selected" {
                  w321 = "Please select a programme after opening a haccp file \nand click the button again to display the details!"
                  One Button Dialog(message=w321)
                  w2 = w319
                }
                frame "False", Default {
                  Property Node(instance in=reference to "i Combi Pro txt", "Value"=2, error in=w319) -> (error out=w322, instance out=w323)
                  Close Reference(error in=w322, reference=w323) -> (error out=w2)
                }
              }
            }
            w324 = "Details of selected charge"  # State
            w3 = w324
          }
          on "Press the button to display the graphic of the two selected cleaning processes" Value changed {
            w325 = "Details of multiple charges"  # State
            w326 = reference to "Press the button to display the graphic of the two selected cleaning processes"
            Property Node(instance in=w326, error in=w213) -> ("Text"=w9, error out=w327)
            case ($"same programme type ?") {
              frame False {
                w328 = "Please select two cleaning programmes of the same type and click on the button again to display the details!"
                One Button Dialog(message=w328)
                w2 = w327
              }
              frame True {
                Property Node(instance in=reference to "i Combi Pro txt", "Value"=5, error in=w327) -> (error out=w329, instance out=w330)
                Close Reference(error in=w329, reference=w330) -> (error out=w2)
              }
            }
            w3 = w325
          }
        }
        w4 = s2
        w5 = s3
        w6 = s4
        w7 = s5
        w8 = s6
        w10 = s8
      }
    }
    next s1 = w3
    next s2 = w4
    next s3 = w5
    next s4 = w6
    next s5 = w7
    next s6 = w8
    next s7 = w9
    next s8 = w10
    stop if FALSE
  }
